# Grasshopper definition 布局.gh (Grasshopper 1.0.7)

运行 = BooleanToggle(True)
c_script = CSharpScript(nickNames="buildingGenerator", active=运行)  # -> out, A; inputs nickNames: tree of String, active: Boolean
# ---------- c_script: C# ----------
    _nickNames = nickNames;
    _active = active;
    GrasshopperDocument.ScheduleSolution(5, Callback);
# ---------- c_script: C# additional code ----------
  private DataTree<string> _nickNames;
  private bool _active;
  private void Callback(GH_Document doc)
  {
    foreach(var obj in GrasshopperDocument.ActiveObjects())
      if(_nickNames.AllData().Contains(obj.NickName))
      {
        obj.Locked = !_active;
        obj.ExpireSolution(false);
      }
  }
# ---------- end c_script ----------

rec = Rectangle({Plane=PlaneXY(155.779919, 83.17569601, 0), Size=Domain2(u=-153.6855286..153.6855286, v=-76.73706589..76.73706589)})
crv = Curve(<curve referenced from the Rhino model>)
toggle = BooleanToggle(True)  # disabled
建筑密度 = Slider(0.32, range=0..1)
缩放因子 = Slider(0.9, range=0..1)
建筑个数 = Slider(12, range=0..20)
容积率 = Slider(5, range=0..15)
容错阈值 = Slider(0, range=0..1)

# ----
# 建筑类型
pt = Point([Point(0, 0, 0), Point(0, 1, 0), Point(2, 1, 0), Point(2, 0, 0), Point(0, 0, 0)])
pt_2 = Point([Point(0, 0, 0), Point(0, 2, 0), Point(1, 2, 0), Point(1, 1, 0), Point(3, 1, 0), Point(3, 2, 0), Point(4, 2, 0), Point(4, 0, 0), Point(0, 0, 0)])
pt_3 = Point([Point(0, 0, 0), Point(0, 3, 0), Point(1, 3, 0), Point(1, 1, 0), Point(2, 1, 0), Point(2, 0, 0), Point(0, 0, 0)])
pt_4 = Point([Point(0, 0, 0), Point(0, 1, 0), Point(1, 1, 0), Point(1, 3, 0), Point(0, 3, 0), Point(0, 4, 0), Point(3, 4, 0), Point(3, 3, 0), Point(2, 3, 0), Point(2, 1, 0), Point(3, 1, 0), Point(3, 0, 0), Point(0, 0, 0)])
工型 = PolyLine(Vertices=pt_4, Closed=False)
u型 = PolyLine(Vertices=pt_2, Closed=False)
矩形 = PolyLine(Vertices=pt, Closed=False)
l型 = PolyLine(Vertices=pt_3, Closed=False)

crv_2 = Curve(<curve referenced from the Rhino model>)
rec_2 = Rectangle({Plane=PlaneXY(155.779919, 83.17569601, 0), Size=Domain2(u=-153.6855286..153.6855286, v=-76.73706589..76.73706589)})
panel = Panel("""1.94
2.16
2.38
2.6
2.82
3.04
3.48
3.7
3.92
4.14""")
panel_2 = Panel("""0.35
0.4
0.45
0.5
0.55
0.6
0.7
0.75
0.8
0.85""")
boundary = BoundarySurfaces(Edges=rec_2)
buildinggenerator = CSharpScript(
    block=boundary,
    boundary=rec_2,
    offDist=3,
    posX=panel_2,
    posY=panel_2,
    shapeRatio=panel,
    density=0.3,
    FAR=2,
    floorHeight=4,
    num=12,
    threashold=0.01,
    roads=crv_2,
    ifAlignBoundary=Toggle(False),
    ifChangeScale=Toggle(False))  # -> out, position, buildings, offShape, directions, closest, ratio, levels; inputs block: Surface, boundary: Curve, offDist: Int32, posX: list of Double, posY: list of Double, shapeRatio: list of Double, density: Double, FAR: Double, floorHeight: Double, num: Int32, threashold: Double, roads: list of Curve, ifAlignBoundary: Boolean, ifChangeScale: Boolean
# ---------- buildinggenerator: C# ----------
    //======初始化======
    bs = new List<Building>();
    Interval blockDomain1 = block.Domain(0);
    Interval blockDomain2 = block.Domain(1);
    double blockArea = AreaMassProperties.Compute(boundary).Area;
    averageArea = blockArea * density / num;
    buildArea = AreaMassProperties.Compute(boundary).Area * FAR;
    boundaryDist = Math.Sqrt(averageArea) * 0.5;
    boundaryDist += 20;
    for(int i = 0; i < num; i++){
      Point3d p = block.PointAt(posX[i] * blockDomain1.Length + blockDomain1.T0, posY[i] * blockDomain2.Length + blockDomain2.T0);

      if(boundary.Contains(p, Plane.WorldXY, 0.1).ToString() == "Outside"){
        double t;
        boundary.ClosestPoint(p, out t);
        p = boundary.PointAt(t);
      }
      Building b = new Building(i, p, averageArea, shapeRatio[i], boundary);
      bs.Add(b);
    }
    meanLevel = (int) Math.Ceiling(buildArea / (AreaMassProperties.Compute(bs[0].shape).Area * bs.Count));
    count = 0;
    totalOverlap = double.MaxValue;
    double meanDist = 0;
    while(totalOverlap > averageArea * threashold){
      totalOverlap = 0;
      //======运行======
      for (int i = 0; i < bs.Count; i++){
        double minDist = double.MaxValue;
        int index = -1;
        for (int j = 0; j < roads.Count; j++){
          double t;
          roads[j].ClosestPoint(bs[i].pos, out t);
          Point3d closePoint = roads[j].PointAt(t);
          double dist = bs[i].pos.DistanceTo(closePoint);
          if(dist < minDist){
            minDist = dist;
            index = j;
            bs[i].closestBP = closePoint;
          }
        }
        bs[i].closestDist = minDist;
        bs[i].closestRoad = index;
      }
      //计算当前分布标准差
      meanDist = 0;
      for (int i = 0; i < bs.Count; i++){
        meanDist += bs[i].closestDist;
      }
      meanDist /= bs.Count;
      double variance = 0;
      for (int i = 0; i < bs.Count; i++){
        variance += (bs[i].closestDist - meanDist) * (bs[i].closestDist - meanDist);

      }
      variance /= bs.Count;
      double standDeviation = Math.Sqrt(variance);
      double lowDist = meanDist - 2 * standDeviation;
      double upDist = meanDist + 2 * standDeviation;
      for(int i = 0; i < num; i++){
        bs[i].Overlap(bs);
      }
      for(int i = 0;i < num ;i++){
        bs[i].CalculateHeight(meanLevel, meanDist, standDeviation, floorHeight, ref bs[i].offDist, ref bs[i].level);
        bs[i].CheckEdge();
        if(ifAlignBoundary){
          bs[i].AlignBoundary(boundaryDist, roads);
        }
        for(int j = i + 1; j < num; j++){
          if(ifChangeScale){
            if(count > 60){
              double threasholdC = 0.5;
              double chanceChange = bs[i].rand.NextDouble();
              if(chanceChange < threasholdC){
                bs[i].ChangeScale(bs[j]);
              }
            }
          }
          bs[i].Seperate(bs[j]);
        }
        bs[i].Update(num);
        totalOverlap += bs[i].overlapArea;
        bs[i].ClearOverlapArea();
      }
      count++;
    }

    //====输出=====
    pos = new List<Point3d>();
    footPrint = new List<Curve>();
    offSet = new List<Curve>();
    List < Vector3d > direction = new List<Vector3d>();
    List < Point3d > closestPoint = new List<Point3d>();
    List < double > ratios = new List<double>();
    List < int> level = new List<int>();
    for(int i = 0; i < num; i++){
      footPrint.Add(bs[i].shape);
      pos.Add(bs[i].pos);
      offSet.Add(bs[i].offShape);
      direction.Add(bs[i].directionY);
      closestPoint.Add(bs[i].closestBP);
      ratios.Add(bs[i].width / bs[i].length);
      level.Add(bs[i].level);
    }

    position = pos;
    buildings = footPrint;
    offShape = offSet;
    directions = direction;
    closest = closestPoint;
    ratio = ratios;
    levels = level;
# ---------- buildinggenerator: C# additional code ----------
  //全局变量
  List<Building> bs;
  List<Point3d> pos;
  List<Curve> footPrint;
  List<Curve> offSet;
  int count;
  double boundaryDist;
  double totalOverlap;
  double averageArea;
  double buildArea;
  int meanLevel;

  //以下为构建建筑单体智能体代码
  public class Building{
    public Point3d pos;
    public Curve shape;
    public double area;
    public double averageArea;
    public Curve offShape;
    public double offDist;
    public int level;
    public double closestDist;
    public Point3d closestBP;
    public int closestRoad;
    public Vector3d move;
    public Curve boundary;
    public Point3d siteCenter;
    public BoundingBox overlapBox;
    public double overlapArea;
    public int index;
    public Random rand;
    public Vector3d directionY;
    public Vector3d directionX;
    public double length;
    public double width;
    public double rotateAngle;
    public double stressX;
    public double stressY;


    public Building(int index_, Point3d pos_, double averageArea_, double ratio, Curve boundary_){
      index = index_;
      rand = new Random(index);
      averageArea = averageArea_;
      length = Math.Sqrt(averageArea / ratio);
      width = ratio * length;
      offDist = 3;
      level = 0;
      closestDist = 0;
      pos = pos_;
      boundary = boundary_;
      siteCenter = GetCenter(boundary);
      closestBP = pos;
      shape = new Rectangle3d(Plane.WorldXY, new Point3d(pos.X - length / 2, pos.Y - width / 2, 0), new Point3d (length / 2 + pos.X, width / 2 + pos.Y, 0)).ToNurbsCurve();
      offShape = shape.Offset(Plane.WorldXY, offDist, 0.1, Rhino.Geometry.CurveOffsetCornerStyle.Sharp)[0];
      area = AreaMassProperties.Compute(shape).Area;

      double p;
      shape.ClosestPoint(pos, out p);
      directionY = Point3d.Subtract(shape.PointAt(p), pos);
      directionY.Unitize();
      directionX = Vector3d.CrossProduct(directionY, Vector3d.ZAxis);

      overlapArea = 0;
      stressX = 0;
      stressY = 0;
    }

    private Point3d GetCenter(Curve c){
      Point3d center = AreaMassProperties.Compute(c).Centroid;
      return center;
    }

    public void ClearOverlapArea(){
      overlapArea = 0;
    }

    //计算各单体层数和间距
    public void CalculateHeight(int meanLevel, double meanDist, double standDeviation, double floorHeight, ref double offDist, ref int level){
      double deviation = closestDist - meanDist;
      if(Math.Abs(deviation) < 0.5 * standDeviation){
        level = meanLevel;
      }
      if(deviation >= 0.5 * standDeviation && deviation < 1.5 * standDeviation){
        level = (int) (meanLevel * 0.75);
      }
      if(deviation <= -0.5 * standDeviation && deviation > -1.5 * standDeviation){
        level = (int) (meanLevel * 1.25);
      }
      if(deviation <= -1.5 * standDeviation){
        level = (int) (meanLevel * 1.5);
      }
      if(deviation >= 1.5 * standDeviation){
        level = (int) (meanLevel * 0.5);
      }
      if(level * floorHeight <= 24){
        offDist = 3;
        offShape = shape.Offset(Plane.WorldXY, offDist, 0.1, Rhino.Geometry.CurveOffsetCornerStyle.Sharp)[0];
      }
      else if(level * floorHeight > 24 && level * floorHeight <= 100){
        offDist = 6.5;
        offShape = shape.Offset(Plane.WorldXY, offDist, 0.1, Rhino.Geometry.CurveOffsetCornerStyle.Sharp)[0];
      }
      else{
        offDist = 12;
        offShape = shape.Offset(Plane.WorldXY, offDist, 0.1, Rhino.Geometry.CurveOffsetCornerStyle.Sharp)[0];
      }
    }

    //避免中心点重叠
    public void Overlap(List<Building> buildings){
      Vector3d randMove = new Vector3d(0, 0, 0);
      for(int i = 0; i < buildings.Count; i++){
        Building b = buildings[i];
        if(b != this && pos == b.pos){
          double randDir = Math.PI * rand.NextDouble();
          double bArea = AreaMassProperties.Compute(b.offShape).Area; //面积越大移动越远
          randMove = new Vector3d(Math.Cos(randDir) * bArea * 0.005, Math.Sin(randDir) * bArea * 0.005, 0);
          break;
        }
      }
      pos = Point3d.Add(pos, randMove);
      shape.Translate(randMove);
      offShape.Translate(randMove);
    }
    //排斥
    public void Seperate (Building b){
      double overlap = 0;
      Curve[] intersecs = Curve.CreateBooleanIntersection(offShape, b.offShape, 0.1);
      if(intersecs.Length != 0){
        for (int j = 0; j < intersecs.Length; j++){
          overlap += AreaMassProperties.Compute(intersecs[j]).Area;
          Point3d interCenter = GetCenter(intersecs[j]);
          Vector3d pi = Point3d.Subtract(pos, interCenter);
          Vector3d pj = Point3d.Subtract(b.pos, interCenter);
          if(pi.Length == 0){
            pi = Point3d.Subtract(pos, b.pos);
            pj = Point3d.Subtract(b.pos, pos);
          }

          double dist = pos.DistanceTo(b.pos);
          pi = Vector3d.Multiply(pi, 4 / dist);
          pj = Vector3d.Multiply(pj, 4 / dist);
          move = Vector3d.Add(move, Vector3d.Multiply(pi, 0.5));
          b.move = Vector3d.Add(b.move, Vector3d.Multiply(pj, 0.5));
        }
      }
      overlapArea += overlap;
    }


    public void ChangeScale (Building b){
      Curve[] intersecs = Curve.CreateBooleanIntersection(offShape, b.offShape, 0.1);
      Vector3d trend = new Vector3d(0, 0, 0);
      if(intersecs.Length != 0){
        for (int j = 0; j < intersecs.Length; j++){
          double interArea = AreaMassProperties.Compute(intersecs[j]).Area;
          Point3d interCenter = GetCenter(intersecs[j]);
          Vector3d pi = Point3d.Subtract(pos, interCenter);
          pi = Vector3d.Multiply(pi, 5 * interArea / averageArea);
          Vector3d pj = Point3d.Subtract(b.pos, interCenter);
          pj = Vector3d.Multiply(pj, 5 * interArea / averageArea);

          if(pi.Length == 0){ //判断是否包含
            pi = Point3d.Subtract(pos, b.pos);
            pi = Vector3d.Multiply(pi, 5 * interArea / averageArea);
            pj = Point3d.Subtract(b.pos, pos);
            pj = Vector3d.Multiply(pj, 5 * interArea / averageArea);
          }
          if(width / length > 0.25){//判断比例超过限制则不再改变
            stressY += Math.Abs(Vector3d.Multiply(pi, directionY)) * 0.5;
          }
          if(width / length < 4){
            stressX += Math.Abs(Vector3d.Multiply(pi, directionX)) * 0.5;
          }
          if(b.width / b.length > 0.25){
            b.stressY += Math.Abs(Vector3d.Multiply(pj, b.directionY)) * 0.5;
          }
          if(b.width / b.length < 4){
            b.stressX += Math.Abs(Vector3d.Multiply(pj, b.directionX)) * 0.5;
          }
        }
      }
    }

    //避免出界
    public void CheckEdge(){
      Curve[] differC = Curve.CreateBooleanDifference(shape, boundary, 0.1);
      if(differC.Length != 0){
        Vector3d pushBack = new Vector3d();
        for (int i = 0; i < differC.Length; i++){
          overlapArea += AreaMassProperties.Compute(differC[i]).Area;
          Point3d subCenter = GetCenter(differC[i]);
          Vector3d push = Point3d.Subtract(siteCenter, subCenter);
          pushBack = Vector3d.Add(pushBack, push);
        }
        pushBack = Vector3d.Multiply(pushBack, 2.5 / pushBack.Length);
        move += pushBack;
      }
    }

    //对齐边界旋转
    public void AlignBoundary(double boundaryDist, List<Curve> roads){
      double shapeP;
      shape.ClosestPoint(closestBP, out shapeP);
      Point3d shapeCP = shape.PointAt(shapeP);
      double shapeDist = shapeCP.DistanceTo(closestBP);
      if(shapeDist < boundaryDist){
        Vector3d roadVec = Point3d.Subtract(roads[closestRoad].PointAtEnd, roads[closestRoad].PointAtStart);
        roadVec.Unitize();
        Vector3d axis = Vector3d.CrossProduct(directionY, roadVec);
        double angleDiff = Vector3d.VectorAngle(directionY, roadVec);
        if(angleDiff != 0 || angleDiff != Math.PI * 0.5 || angleDiff != Math.PI){
          //将旋转动作控制在90°以内
          if(angleDiff < Math.PI * 0.5){ //锐角
            directionY.Rotate(angleDiff, axis);
            directionX.Rotate(angleDiff, axis);
            shape.Rotate(angleDiff, axis, pos);
            offShape.Rotate(angleDiff, axis, pos);
          }
          else{
            if(angleDiff - Math.PI * 0.5 < Math.PI * 0.25){
              angleDiff -= Math.PI * 0.5;
              directionY.Rotate(angleDiff, axis);
              directionX.Rotate(angleDiff, axis);
              shape.Rotate(angleDiff, axis, pos);
              offShape.Rotate(angleDiff, axis, pos);
            }
            else{
              angleDiff -= Math.PI;
              directionY.Rotate(angleDiff, axis);
              directionX.Rotate(angleDiff, axis);
              shape.Rotate(angleDiff, axis, pos);
              offShape.Rotate(angleDiff, axis, pos);
            }
          }
        }
      }
      else{
        //每次都要判断是否离边界足够近， 否则保持正南北
        Vector3d axis = Vector3d.CrossProduct(directionY, Vector3d.XAxis);
        double angleDiff = Vector3d.VectorAngle(directionY, Vector3d.XAxis);
        if(angleDiff != 0 || angleDiff != Math.PI * 0.5 || angleDiff != Math.PI){
          //将旋转动作控制在90°以内
          if (angleDiff < Math.PI * 0.5){
            directionY.Rotate(angleDiff, axis);
            directionX.Rotate(angleDiff, axis);
            shape.Rotate(angleDiff, axis, pos);
            offShape.Rotate(angleDiff, axis, pos);
          }
          else{
            if(angleDiff - Math.PI * 0.5 < Math.PI * 0.25){
              angleDiff -= Math.PI * 0.5;
              directionY.Rotate(angleDiff, axis);
              directionX.Rotate(angleDiff, axis);
              shape.Rotate(angleDiff, axis, pos);
              offShape.Rotate(angleDiff, axis, pos);
            }
            else{//更接近方向相反
              angleDiff -= Math.PI;
              directionY.Rotate(angleDiff, axis);
              directionX.Rotate(angleDiff, axis);
              shape.Rotate(angleDiff, axis, pos);
              offShape.Rotate(angleDiff, axis, pos);
            }
          }
        }
      }
    }

    public void Update (int num){
      //移动
      pos = Point3d.Add(pos, move);
      shape.Translate(move);
      offShape.Translate(move);
      move = Vector3d.Multiply(move, 0); //改变尺寸比例
      if(stressX != 0 || stressY != 0){
        if(stressX > stressY){
          length -= (0.4 * stressX / num);
          width = averageArea / length;
          shape = new Rectangle3d(new Plane(pos, directionX, directionY), new Interval(-length / 2, length / 2), new Interval(-width / 2, width / 2)).ToNurbsCurve();
          // shape = new Rectangle3d(Plane.WorldXY, new Point3d(pos.X - length / 2, pos.Y - width / 2, 0), new Point3d (length / 2 + pos.X, width / 2 + pos.Y,0)).ToNurbsCurve();
          offShape = shape.Offset(Plane.WorldXY, offDist, 0.1, Rhino.Geometry.CurveOffsetCornerStyle.Sharp)[0];
        }
        else{
          width -= (0.4 * stressY / num);
          length = averageArea / width;
          shape = new Rectangle3d(new Plane(pos, directionX, directionY), new Interval(-length / 2, length / 2), new Interval(-width / 2, width / 2)).ToNurbsCurve();
          offShape = shape.Offset(Plane.WorldXY, offDist, 0.1, Rhino.Geometry.CurveOffsetCornerStyle.Sharp)[0];
        }
        stressX = 0;
        stressY = 0;
      }
    }

  }
# ---------- end buildinggenerator ----------

pt_5 = Point(Point(280.086598, 142.4449278, 0))
geo = Geometry(<curve referenced from the Rhino model>)
pcen = PolygonCenter(Polyline=geo)  # -> CenterV, CenterE, CenterA
vec2pt = Vector2Pt(PointA=pcen.CenterA, PointB=pt_5, Unitize=False)  # -> Vector, Length
move = Move(Geometry=geo, Motion=vec2pt.Vector)  # -> Geometry, Transform
geo_2 = Geometry(move.Geometry)

pop2d = Populate2D(Region=rec, Count=建筑个数, Seed=1)
repeat = RepeatData(Data=矩形, Length=建筑个数)
buildinggenerator_2 = CSharpScript(
    boundary=rec,
    roads=crv,
    shape_type=repeat,
    num=建筑个数,
    RandomPoints=pop2d,
    density=建筑密度,
    FAR=容积率,
    floorHeight=5,
    threashold=容错阈值,
    ifChangeScale=toggle,
    scale_factor=缩放因子)  # -> out, position, buildings, offShape, closest, levels; inputs boundary: Curve, roads: list of Curve, shape_type: list of Curve, num: Int32, RandomPoints: list of Point3d, density: Double, FAR: Double, floorHeight: Double, threashold: Double, ifChangeScale: Boolean, scale_factor: Double
# ---------- buildinggenerator_2: C# ----------
    //======初始化======
    //计算智能体的平均面积
    double boundaryArea = AreaMassProperties.Compute(boundary).Area;
    averageArea = boundaryArea * density / num;
    //创建智能体
    bs = new List<Building>();
    for(int i = 0; i < num; i++){
      Building b = new Building(i, RandomPoints[i], averageArea, boundary, shape_type[i], floorHeight);
      bs.Add(b);
    }
    //计算平均楼层数
    buildArea = AreaMassProperties.Compute(boundary).Area * FAR;
    meanLevel = (int) Math.Ceiling(buildArea / boundaryArea * density);

    count = 0;
    totalOverlap = double.MaxValue;
    //======运行======
    while(totalOverlap > averageArea * threashold){
      totalOverlap = 0;
      //迭代次数大于100时，每迭代5次对最不符合要求的建筑缩小
      if(ifChangeScale && count > 100 && count % 3 == 0){
        //根据智能体逾越场地边界的面积及其与其他智能体缓冲区内的总重叠面积——>判断最不符合要求的建筑
        int scale_index = -1;
        double scale_index_area = 0;
        for(int i = 0;i < num ;i++){
          //计算各智能体不符合要求的面积总和
          bs[i].UpdateOverlap(bs);
          //获取索引
          if(bs[i].overlapArea > scale_index_area)
          {
            scale_index = i;
            scale_index_area = bs[i].overlapArea;
          }
          //清空各智能体的存储数据——>不符合要求的面积总和
          bs[i].ClearOverlapArea();
        }
        //根据索引调用缩放函数
        if(scale_index != -1){
          bs[scale_index].Narrow(scale_factor);
        }
      }

      //计算各智能体与道路距离最短原则，寻找相应的道路点与距离
      for (int i = 0; i < bs.Count; i++){
        double minDist = double.MaxValue;
        int index = -1;
        for (int j = 0; j < roads.Count; j++){
          double t;
          roads[j].ClosestPoint(bs[i].pos, out t);
          Point3d closePoint = roads[j].PointAt(t);
          double dist = bs[i].pos.DistanceTo(closePoint);
          if(dist < minDist){
            minDist = dist;
            index = j;
            bs[i].closestBP = closePoint;
          }
        }
        bs[i].closestDist = minDist;
        bs[i].closestRoad = index;
      }

      //计算当前分布标准差
      double meanDist = 0;
      for (int i = 0; i < bs.Count; i++){
        meanDist += bs[i].closestDist;
      }
      meanDist /= bs.Count;
      double variance = 0;
      for (int i = 0; i < bs.Count; i++){
        variance += (bs[i].closestDist - meanDist) * (bs[i].closestDist - meanDist);
      }
      variance /= bs.Count;
      double standDeviation = Math.Sqrt(variance);
      double lowDist = meanDist - 2 * standDeviation;
      double upDist = meanDist + 2 * standDeviation;
      for(int i = 0; i < num; i++){
        bs[i].Overlap(bs);
      }


      for(int i = 0;i < num ;i++){
        //计算各智能体的楼层数量
        bs[i].CalculateHeight(meanLevel, meanDist, standDeviation, floorHeight, ref bs[i].level);
        //计算场地边界对出界智能体的动量
        bs[i].CheckEdge();
        //根据该智能体与其他智能体的缓冲边界内的重叠情况，计算动量
        for(int j = i + 1; j < num; j++){
          bs[i].Seperate(bs[j]);
        }
        //根据动量更新智能体位置
        bs[i].Update();
        //清空各智能体的存储数据——>不符合要求的面积总和
        bs[i].ClearOverlapArea();
      }
      totalOverlap = bs[0].CheckOverlap(bs);
      count++;
    }

    //====输出=====
    pos = new List<Point3d>();
    footPrint = new List<Curve>();
    offSet = new List<Curve>();
    List < Vector3d > direction = new List<Vector3d>();
    List < Point3d > closestPoint = new List<Point3d>();
    List < double > ratios = new List<double>();
    List < double> level = new List<double>();
    for(int i = 0; i < num; i++){
      footPrint.Add(bs[i].shape);
      pos.Add(bs[i].pos);
      offSet.Add(bs[i].offShape);
      closestPoint.Add(bs[i].closestBP);
      level.Add(bs[i].level);
    }
    level.Add(totalOverlap);
    level.Add(count);
    position = pos;
    buildings = footPrint;
    offShape = offSet;
    closest = closestPoint;
    levels = level;
# ---------- buildinggenerator_2: C# additional code ----------
  //全局变量
  List<Building> bs;
  List<Point3d> pos;
  List<Curve> footPrint;
  List<Curve> offSet;
  int count;
  double totalOverlap;
  double averageArea;
  double buildArea;
  int meanLevel;

  //以下为构建建筑单体智能体代码
  public class Building{
    public Point3d pos;
    public double averageArea;
    public Curve boundary;
    public Curve shape;
    public Curve offShape;

    public double area;
    public double overlapArea;

    public double closestDist;
    public Point3d closestBP;
    public int closestRoad;

    public int level;
    public double height;
    public double floorHeight;

    public Vector3d move;
    public Point3d siteCenter;
    public BoundingBox overlapBox;

    public int index;
    public Random rand;

    public Building(int index_, Point3d pos_, double averageArea_, Curve boundary_, Curve shape_type_, double floorHeight_){
      pos = pos_;
      averageArea = averageArea_;
      boundary = boundary_;
      shape = shape_type_;
      siteCenter = GetCenter(boundary);

      level = 4;
      floorHeight = floorHeight_;
      Point3d center = AreaMassProperties.Compute(shape).Centroid;
      shape.Translate(new Vector3d(pos.X - center.X, pos.Y - center.Y, 0));
      shape.Transform(Transform.Scale(pos, Math.Sqrt(averageArea / AreaMassProperties.Compute(shape).Area)));
      offShape = CreateBuffer(shape, level * 3);

      area = AreaMassProperties.Compute(shape).Area;
      overlapArea = 0;

    }

    //计算图形几何中心
    private Point3d GetCenter(Curve c){
      Point3d center = AreaMassProperties.Compute(c).Centroid;
      return center;
    }

    //清空各智能体的存储数据——>不符合要求的面积总和
    public void ClearOverlapArea(){
      overlapArea = 0;
    }

    //计算各智能体楼层数&&创建缓冲
    public void CalculateHeight(int meanLevel, double meanDist, double standDeviation, double floorHeight, ref int level){
      double deviation = closestDist - meanDist;
      if(Math.Abs(deviation) < 0.5 * standDeviation){
        level = meanLevel;
      }
      if(deviation >= 0.5 * standDeviation && deviation < 1.5 * standDeviation){
        level = (int) (meanLevel * 0.75);
      }
      if(deviation <= -0.5 * standDeviation && deviation > -1.5 * standDeviation){
        level = (int) (meanLevel * 1.25);
      }
      if(deviation <= -1.5 * standDeviation){
        level = (int) (meanLevel * 1.5);
      }
      if(deviation >= 1.5 * standDeviation){
        level = (int) (meanLevel * 0.5);
      }
      offShape = CreateBuffer(shape, level * floorHeight);
    }
    //创建缓冲
    private Curve CreateBuffer(Curve x, double y)
    {

      List<Point3d> points_o = new List<Point3d>();
      List<Point3d> points_c = new List<Point3d>();
      int points_num = x.ToNurbsCurve().Points.Count;
      for (int i = 0;i < points_num;i++)
      {
        Point3d temp = new Point3d();
        x.ToNurbsCurve().Points.GetPoint(i, out temp);
        points_o.Add(temp);
        points_c.Add(temp);
      }
      //计算东南西北侧方向上的缓冲距离
      double distance_N,distance_E,distance_S,distance_W;
      if(0.3 * 30 + y - 30 * 0.1 < 6)
      {
        distance_E = distance_W = 6;
      }
      else
      {
        distance_E = distance_W = 0.3 * 30 + y - 30 * 0.1;
      }
      /*
      if(0.8 * 30 + y - 30 * 0.5 < 8)
      {
        distance_S = 8;
      }
      else
      {
        distance_S = 0.8 * 30 + y - 30 * 0.5;
      }
      */
      distance_S = 0;
      double sinHs = Math.Sin(Math.PI / 180 * 23) * Math.Sin(Math.PI / 180 * -23.5) + Math.Cos(Math.PI / 180 * 23) * Math.Cos(Math.PI / 180 * -23.5) * Math.Cos(0);
      double L = Math.Sqrt((y / sinHs) * (y / sinHs) - y * y);
      distance_N = L;
      //图形均基于顺时针构建，因而可根据两点所形成的矢量方向，判断需要构建哪一方向的缓冲，最后用两点位置的移动进行缓冲的构建
      for (int i = 0;i < points_num - 1;i++)
      {
        Point3d temp = new Point3d();
        //南北侧
        if(Math.Abs(points_o[i + 1].X - points_o[i].X) > Math.Abs(points_o[i + 1].Y - points_o[i].Y))
        {
          //北侧
          if((points_o[i + 1].X - points_o[i].X) > 0)
          {
            temp = new Point3d(points_c[i].X, points_c[i].Y + distance_N, points_c[i].Z);
            points_c.RemoveAt(i);
            points_c.Insert(i, temp);
            temp = new Point3d(points_c[i + 1].X, points_c[i + 1].Y + distance_N, points_c[i + 1].Z);
            points_c.RemoveAt(i + 1);
            points_c.Insert(i + 1, temp);
          }
            //南侧
          else
          {
            temp = new Point3d(points_c[i].X, points_c[i].Y - distance_S, points_c[i].Z);
            points_c.RemoveAt(i);
            points_c.Insert(i, temp);
            temp = new Point3d(points_c[i + 1].X, points_c[i + 1].Y - distance_S, points_c[i + 1].Z);
            points_c.RemoveAt(i + 1);
            points_c.Insert(i + 1, temp);
          }
        }
          //东西侧
        else
        {
          if((points_o[i + 1].Y - points_o[i].Y) < 0)
          {
            //东侧
            temp = new Point3d(points_c[i].X + distance_E, points_c[i].Y, points_c[i].Z);
            points_c.RemoveAt(i);
            points_c.Insert(i, temp);
            temp = new Point3d(points_c[i + 1].X + distance_E, points_c[i + 1].Y, points_c[i + 1].Z);
            points_c.RemoveAt(i + 1);
            points_c.Insert(i + 1, temp);
          }
          else
          {
            //西侧
            temp = new Point3d(points_c[i].X - distance_W, points_c[i].Y, points_c[i].Z);
            points_c.RemoveAt(i);
            points_c.Insert(i, temp);
            temp = new Point3d(points_c[i + 1].X - distance_W, points_c[i + 1].Y, points_c[i + 1].Z);
            points_c.RemoveAt(i + 1);
            points_c.Insert(i + 1, temp);
          }
        }
      }
      //计算一个新的重合点，因为建筑轮廓上第一个点与最后一个点重合，构建缓冲后不重合
      double temp_x,temp_y;
      if(points_o[0].X == points_c[0].X)
      {
        temp_x = points_c[points_num - 1].X;
        temp_y = points_c[0].Y;
      }
      else
      {
        temp_x = points_c[0].X;
        temp_y = points_c[points_num - 1].Y;
      }
      Point3d point_orignal = new Point3d(temp_x, temp_y, points_c[0].Z);
      //重合点替换第一点
      points_c.RemoveAt(0);
      points_c.Insert(0, point_orignal);
      //重合点替换最后一点
      points_c.RemoveAt(points_num - 1);
      points_c.Insert(points_num - 1, point_orignal);
      Polyline buffer = new Polyline(points_c);
      return buffer.ToNurbsCurve();
    }


    //避免中心点重叠
    public void Overlap(List<Building> buildings){
      Vector3d randMove = new Vector3d(0, 0, 0);
      for(int i = 0; i < buildings.Count; i++){
        Building b = buildings[i];
        if(b != this && pos == b.pos){
          double randDir = Math.PI * rand.NextDouble();
          double bArea = AreaMassProperties.Compute(b.offShape).Area; //面积越大移动越远
          randMove = new Vector3d(Math.Cos(randDir) * bArea * 0.005, Math.Sin(randDir) * bArea * 0.005, 0);
          break;
        }
      }
      pos = Point3d.Add(pos, randMove);
      shape.Translate(randMove);
      offShape.Translate(randMove);
    }

    //计算各智能体不符合要求面积——>逾越场地边界的面积与其他智能体缓冲区内的重叠面积
    public void UpdateOverlap (List<Building> buildings){
      overlapArea = 0;
      for(int i = 0; i < buildings.Count; i++){
        Building b = buildings[i];
        Curve[] intersecs = Curve.CreateBooleanIntersection(offShape, b.shape, 0.000001);
        if(intersecs.Length != 0){
          for (int j = 0; j < intersecs.Length; j++){
            overlapArea += AreaMassProperties.Compute(intersecs[j]).Area;
          }
        }
      }
      Curve[] differC = Curve.CreateBooleanDifference(shape, boundary, 0.000001);
      if(differC.Length != 0){
        for (int i = 0; i < differC.Length; i++){
          overlapArea += AreaMassProperties.Compute(differC[i]).Area;
        }
      }
    }

    //计算所有智能体不符合要求面积总和——>逾越场地边界的面积与其他智能体缓冲区内的重叠面积
    public double CheckOverlap (List<Building> bs){
      double totalOverlap = 0;
      for(int i = 0; i < bs.Count; i++){
        for(int j = 0; j < bs.Count; j++){
          if(i != j)
          {
            Curve[] intersecs = Curve.CreateBooleanIntersection(bs[i].shape, bs[j].offShape, 0.000001);
            if(intersecs.Length != 0){
              for (int k = 0; k < intersecs.Length; k++){
                totalOverlap += AreaMassProperties.Compute(intersecs[k]).Area;
              }
            }
          }
        }
        Curve[] differC = Curve.CreateBooleanDifference(bs[i].shape, bs[i].boundary, 0.000001);
        if(differC.Length != 0){
          for (int j = 0; j < differC.Length; j++){
            totalOverlap += AreaMassProperties.Compute(differC[j]).Area;
          }
        }
      }
      return totalOverlap;
    }

    //计算场地边界对出界智能体的动量
    public void CheckEdge(){
      Curve[] differC = Curve.CreateBooleanDifference(shape, boundary, 0.000001);
      if(differC.Length != 0){
        Vector3d pushBack = new Vector3d();
        for (int i = 0; i < differC.Length; i++){
          overlapArea += AreaMassProperties.Compute(differC[i]).Area;
          Point3d subCenter = GetCenter(differC[i]);
          Vector3d push = Point3d.Subtract(siteCenter, subCenter);
          pushBack = Vector3d.Add(pushBack, push);
        }
        pushBack = Vector3d.Multiply(pushBack, 2.5 / pushBack.Length);
        move += pushBack;
      }
    }

    //判断该智能体是否与某智能体缓冲区内重叠，若有则两智能体都增加动量
    public void Seperate (Building b){
      double overlap = 0;
      Curve[] intersecs = Curve.CreateBooleanIntersection(shape, b.offShape, 0.000001);
      if(intersecs.Length != 0){
        for (int j = 0; j < intersecs.Length; j++){
          overlap += AreaMassProperties.Compute(intersecs[j]).Area;
          Point3d interCenter = GetCenter(intersecs[j]);
          Vector3d pi = Point3d.Subtract(pos, interCenter);
          Vector3d pj = Point3d.Subtract(GetCenter(b.offShape), interCenter);
          if(pi.Length == 0){
            pi = Point3d.Subtract(pos, b.pos);
            pj = Point3d.Subtract(GetCenter(b.offShape), pos);
          }

          double dist = pos.DistanceTo(GetCenter(b.offShape));
          pi = Vector3d.Multiply(pi, 4 / dist);
          pj = Vector3d.Multiply(pj, 4 / dist);
          move = Vector3d.Add(move, Vector3d.Multiply(pi, 0.5));
          b.move = Vector3d.Add(b.move, Vector3d.Multiply(pj, 0.5));
        }
      }
    }

    //根据动量更新智能体位置
    public void Update (){
      pos = Point3d.Add(pos, move);
      shape.Translate(move);
      offShape.Translate(move);
      move = Vector3d.Multiply(move, 0);
    }

    //缩小
    public void Narrow (double scale_factor){
      shape.Transform(Transform.Scale(pos, scale_factor));
      offShape = CreateBuffer(shape, level * floorHeight);
    }

  }
# ---------- end buildinggenerator_2 ----------
panel_3 = Panel(buildinggenerator_2.levels)

panel_4 = Panel([Slider(0.01, range=0..1), Slider(0.98, range=0..1), Slider(0.99, range=0..1), Slider(0.34, range=0..1), Slider(0.68, range=0..1), Slider(0.01, range=0..1), Slider(0.99, range=0..1), Slider(0.71, range=0..1), Slider(0.35, range=0..1), Slider(0.02, range=0..1), Slider(0.98, range=0..1), Slider(0, range=0..1), Slider(0.52, range=0..1), Slider(0.03, range=0..1), Slider(0.98, range=0..1)])
c_script_2 = CSharpScript(Genes=panel_4)  # -> Out, PosXList, PosYList, RatioList, RotationList

# ----
# 三维拉伸
vec = VectorXYZ(XComponent=0, YComponent=0, ZComponent=20)  # -> Vector, Length
extr = Extrude(Base=buildinggenerator_2.buildings, Direction=vec.Vector)
brep = Brep(extr)
cap = CapHoles(Brep=brep)
drawbrep = CSharpScript(B=cap, C=ColourSwatch(SwatchColor=RGB(96, 96, 96)))  # -> out; inputs B: Brep, C: Color
# ---------- drawbrep: C# usings ----------
using System.IO;
using System.Linq;
using System.Data;
using System.Drawing;
using System.Reflection;
using System.Windows.Forms;
using System.Xml;
using System.Xml.Linq;
using System.Runtime.InteropServices;

using Rhino.DocObjects;
using Rhino.Collections;
using GH_IO;
using GH_IO.Serialization;
# ---------- drawbrep: C# ----------
    if (B == null) return;
    if (C.A == 0) return;

    _breps.Add(B);
    _materials.Add(new Rhino.Display.DisplayMaterial(C));
# ---------- drawbrep: C# additional code ----------
  private readonly List<Brep> _breps = new List<Brep>();
  private readonly List<Rhino.Display.DisplayMaterial> _materials = new List<Rhino.Display.DisplayMaterial>();
  private BoundingBox _box;

  /// <summary>
  /// This method will be called once every solution, before any calls to RunScript.
  /// </summary>
  public override void BeforeRunScript()
  {
    _box = BoundingBox.Empty;
    _breps.Clear();
    _materials.Clear();
  }

  public override BoundingBox ClippingBox
  {
    get { return _box; }
  }
  public override void DrawViewportMeshes(IGH_PreviewArgs args)
  {
    for (int i = 0; i < _breps.Count; i++)
      args.Display.DrawBrepWires(_breps[i], _materials[i].Diffuse, 0);
  }
  public override void DrawViewportWires(IGH_PreviewArgs args)
  {
    for (int i = 0; i < _breps.Count; i++)
      args.Display.DrawBrepShaded(_breps[i], _materials[i]);
  }
# ---------- end drawbrep ----------

c_script_3 = CSharpScript(clear=Toggle(True))  # -> out, A; inputs clear: list of Boolean
# ---------- c_script_3: C# usings ----------
using System.Drawing;
# ---------- c_script_3: C# ----------
    Rhino.Display.CustomDisplay display = new Rhino.Display.CustomDisplay(true);

    display.Clear();
# ---------- end c_script_3 ----------

# ----
# 曲线渲染
toggle_2 = BooleanToggle(True)  # disabled
crv_3 = Curve(buildinggenerator_2.offShape)
宽度 = Slider(4, range=0..20)
c_script_4 = CSharpScript(curve=crv_3, thickness=宽度, ifSolidLine=toggle_2, color=ColourSwatch(SwatchColor=RGB(255, 165, 158)))  # -> out, A; inputs curve: list of Curve, thickness: Int32, ifSolidLine: Boolean, color: Color
# ---------- c_script_4: C# ----------
    //Rhino.Display.CustomDisplay display = new Rhino.Display.CustomDisplay(true);
    //for(int i = 0;i < curve.Count ;i++)
    //{
    //display.AddCurve(curve[i], color, (int) width);
    //}
    if (curve == null) return;
    if (color.A == 0) return;
    for (int i = 0; i < curve.Count; i++)
    {
      _curves.Add(curve[i]);
    }
    _color = color;
    _thickness = thickness;
# ---------- c_script_4: C# additional code ----------
  private BoundingBox _box;
  private readonly List<Curve> _curves = new List<Curve>();
  private readonly List<Rhino.Display.DisplayMaterial> _materials = new List<Rhino.Display.DisplayMaterial>();
  public Color _color;
  public int _thickness;
  //private BoundingBox _box;

  /// <summary>
  /// This method will be called once every solution, before any calls to RunScript.
  /// </summary>
  public override void BeforeRunScript()
  {
    _box = BoundingBox.Empty;
    _curves.Clear();
  }

  public override BoundingBox ClippingBox
  {
    get { return _box; }
  }

  public override void DrawViewportWires(IGH_PreviewArgs args)
  {
    for (int i = 0; i < _curves.Count; i++)
    {
      args.Display.DrawCurve(_curves[i], _color, _thickness);
    }
  }
# ---------- end c_script_4 ----------
