# Grasshopper definition 布局v1.gh (Grasshopper 1.0.7)

# ----
# 程序运行
panel = Panel("buildingGenerator")
运行 = BooleanToggle(False)
c_script = CSharpScript(nickNames=panel, active=运行)  # -> out, A; inputs nickNames: tree of String, active: Boolean
# ---------- c_script: C# ----------
    _nickNames = nickNames;
    _active = active;
    GrasshopperDocument.ScheduleSolution(5, Callback);
# ---------- c_script: C# additional code ----------
  private DataTree<string> _nickNames;
  private bool _active;
  private void Callback(GH_Document doc)
  {
    foreach(var obj in GrasshopperDocument.ActiveObjects())
      if(_nickNames.AllData().Contains(obj.NickName))
      {
        obj.Locked = !_active;
        obj.ExpireSolution(false);
      }
  }
# ---------- end c_script ----------

楼高 = Slider(3, range=0..5)
层数 = Slider(8, range=0..50)
边界范围 = Rectangle({Plane=PlaneXY(155.779919, 83.17569601, 0), Size=Domain2(u=-153.6855286..153.6855286, v=-76.73706589..76.73706589)})
建筑密度下限 = Slider(0.25, range=0..1)
容积率下限 = Slider(2.5, range=0..6)
缩放因子 = Slider(0.95, range=0..1)
最小建筑面积 = Number(1200)
层数_2 = Slider(6, range=0..50)
层数_3 = Slider(10, range=0..50)
建筑密度上限 = Slider(0.4, range=0..1)
容积率上限 = Slider(3.5, range=0..6)
容错阈值 = Slider(0, range=0..1)

# ----
# 建筑类型
pt = Point([Point(0, 0, 0), Point(0, 1, 0), Point(2, 1, 0), Point(2, 0, 0), Point(0, 0, 0)])
pt_2 = Point([Point(0, 0, 0), Point(0, 2, 0), Point(1, 2, 0), Point(1, 1, 0), Point(3, 1, 0), Point(3, 2, 0), Point(4, 2, 0), Point(4, 0, 0), Point(0, 0, 0)])
pt_3 = Point([Point(0, 0, 0), Point(0, 3, 0), Point(1, 3, 0), Point(1, 1, 0), Point(2, 1, 0), Point(2, 0, 0), Point(0, 0, 0)])
pt_4 = Point([Point(0, 0, 0), Point(0, 1, 0), Point(1, 1, 0), Point(1, 3, 0), Point(0, 3, 0), Point(0, 4, 0), Point(3, 4, 0), Point(3, 3, 0), Point(2, 3, 0), Point(2, 1, 0), Point(3, 1, 0), Point(3, 0, 0), Point(0, 0, 0)])
u型 = PolyLine(Vertices=pt_2, Closed=False)
工型 = PolyLine(Vertices=pt_4, Closed=False)
矩形 = PolyLine(Vertices=pt, Closed=False)
l型 = PolyLine(Vertices=pt_3, Closed=False)

pcen = PolygonCenter(Polyline=矩形)  # -> CenterV, CenterE, CenterA

crv = Curve(<curve referenced from the Rhino model>)
rec = Rectangle({Plane=PlaneXY(155.779919, 83.17569601, 0), Size=Domain2(u=-153.6855286..153.6855286, v=-76.73706589..76.73706589)})
panel_2 = Panel("""1.94
2.16
2.38
2.6
2.82
3.04
3.48
3.7
3.92
4.14""")
panel_3 = Panel("""0.35
0.4
0.45
0.5
0.55
0.6
0.7
0.75
0.8
0.85""")
boundary = BoundarySurfaces(Edges=rec)  # disabled
buildinggenerator = CSharpScript(
    block=boundary,
    boundary=rec,
    offDist=3,
    posX=panel_3,
    posY=panel_3,
    shapeRatio=panel_2,
    density=0.3,
    FAR=2,
    floorHeight=4,
    num=12,
    threashold=0.01,
    roads=crv,
    ifAlignBoundary=Toggle(False),
    ifChangeScale=Toggle(False))  # -> out, position, buildings, offShape, directions, closest, ratio, levels; inputs block: Surface, boundary: Curve, offDist: Int32, posX: list of Double, posY: list of Double, shapeRatio: list of Double, density: Double, FAR: Double, floorHeight: Double, num: Int32, threashold: Double, roads: list of Curve, ifAlignBoundary: Boolean, ifChangeScale: Boolean; disabled
# ---------- buildinggenerator: C# ----------
    //======初始化======
    bs = new List<Building>();
    Interval blockDomain1 = block.Domain(0);
    Interval blockDomain2 = block.Domain(1);
    double blockArea = AreaMassProperties.Compute(boundary).Area;
    averageArea = blockArea * density / num;
    buildArea = AreaMassProperties.Compute(boundary).Area * FAR;
    boundaryDist = Math.Sqrt(averageArea) * 0.5;
    boundaryDist += 20;
    for(int i = 0; i < num; i++){
      Point3d p = block.PointAt(posX[i] * blockDomain1.Length + blockDomain1.T0, posY[i] * blockDomain2.Length + blockDomain2.T0);

      if(boundary.Contains(p, Plane.WorldXY, 0.1).ToString() == "Outside"){
        double t;
        boundary.ClosestPoint(p, out t);
        p = boundary.PointAt(t);
      }
      Building b = new Building(i, p, averageArea, shapeRatio[i], boundary);
      bs.Add(b);
    }
    meanLevel = (int) Math.Ceiling(buildArea / (AreaMassProperties.Compute(bs[0].shape).Area * bs.Count));
    count = 0;
    totalOverlap = double.MaxValue;
    double meanDist = 0;
    while(totalOverlap > averageArea * threashold){
      totalOverlap = 0;
      //======运行======
      for (int i = 0; i < bs.Count; i++){
        double minDist = double.MaxValue;
        int index = -1;
        for (int j = 0; j < roads.Count; j++){
          double t;
          roads[j].ClosestPoint(bs[i].pos, out t);
          Point3d closePoint = roads[j].PointAt(t);
          double dist = bs[i].pos.DistanceTo(closePoint);
          if(dist < minDist){
            minDist = dist;
            index = j;
            bs[i].closestBP = closePoint;
          }
        }
        bs[i].closestDist = minDist;
        bs[i].closestRoad = index;
      }
      //计算当前分布标准差
      meanDist = 0;
      for (int i = 0; i < bs.Count; i++){
        meanDist += bs[i].closestDist;
      }
      meanDist /= bs.Count;
      double variance = 0;
      for (int i = 0; i < bs.Count; i++){
        variance += (bs[i].closestDist - meanDist) * (bs[i].closestDist - meanDist);

      }
      variance /= bs.Count;
      double standDeviation = Math.Sqrt(variance);
      double lowDist = meanDist - 2 * standDeviation;
      double upDist = meanDist + 2 * standDeviation;
      for(int i = 0; i < num; i++){
        bs[i].Overlap(bs);
      }
      for(int i = 0;i < num ;i++){
        bs[i].CalculateHeight(meanLevel, meanDist, standDeviation, floorHeight, ref bs[i].offDist, ref bs[i].level);
        bs[i].CheckEdge();
        if(ifAlignBoundary){
          bs[i].AlignBoundary(boundaryDist, roads);
        }
        for(int j = i + 1; j < num; j++){
          if(ifChangeScale){
            if(count > 60){
              double threasholdC = 0.5;
              double chanceChange = bs[i].rand.NextDouble();
              if(chanceChange < threasholdC){
                bs[i].ChangeScale(bs[j]);
              }
            }
          }
          bs[i].Seperate(bs[j]);
        }
        bs[i].Update(num);
        totalOverlap += bs[i].overlapArea;
        bs[i].ClearOverlapArea();
      }
      count++;
    }

    //====输出=====
    pos = new List<Point3d>();
    footPrint = new List<Curve>();
    offSet = new List<Curve>();
    List < Vector3d > direction = new List<Vector3d>();
    List < Point3d > closestPoint = new List<Point3d>();
    List < double > ratios = new List<double>();
    List < int> level = new List<int>();
    for(int i = 0; i < num; i++){
      footPrint.Add(bs[i].shape);
      pos.Add(bs[i].pos);
      offSet.Add(bs[i].offShape);
      direction.Add(bs[i].directionY);
      closestPoint.Add(bs[i].closestBP);
      ratios.Add(bs[i].width / bs[i].length);
      level.Add(bs[i].level);
    }

    position = pos;
    buildings = footPrint;
    offShape = offSet;
    directions = direction;
    closest = closestPoint;
    ratio = ratios;
    levels = level;
# ---------- buildinggenerator: C# additional code ----------
  //全局变量
  List<Building> bs;
  List<Point3d> pos;
  List<Curve> footPrint;
  List<Curve> offSet;
  int count;
  double boundaryDist;
  double totalOverlap;
  double averageArea;
  double buildArea;
  int meanLevel;

  //以下为构建建筑单体智能体代码
  public class Building{
    public Point3d pos;
    public Curve shape;
    public double area;
    public double averageArea;
    public Curve offShape;
    public double offDist;
    public int level;
    public double closestDist;
    public Point3d closestBP;
    public int closestRoad;
    public Vector3d move;
    public Curve boundary;
    public Point3d siteCenter;
    public BoundingBox overlapBox;
    public double overlapArea;
    public int index;
    public Random rand;
    public Vector3d directionY;
    public Vector3d directionX;
    public double length;
    public double width;
    public double rotateAngle;
    public double stressX;
    public double stressY;


    public Building(int index_, Point3d pos_, double averageArea_, double ratio, Curve boundary_){
      index = index_;
      rand = new Random(index);
      averageArea = averageArea_;
      length = Math.Sqrt(averageArea / ratio);
      width = ratio * length;
      offDist = 3;
      level = 0;
      closestDist = 0;
      pos = pos_;
      boundary = boundary_;
      siteCenter = GetCenter(boundary);
      closestBP = pos;
      shape = new Rectangle3d(Plane.WorldXY, new Point3d(pos.X - length / 2, pos.Y - width / 2, 0), new Point3d (length / 2 + pos.X, width / 2 + pos.Y, 0)).ToNurbsCurve();
      offShape = shape.Offset(Plane.WorldXY, offDist, 0.1, Rhino.Geometry.CurveOffsetCornerStyle.Sharp)[0];
      area = AreaMassProperties.Compute(shape).Area;

      double p;
      shape.ClosestPoint(pos, out p);
      directionY = Point3d.Subtract(shape.PointAt(p), pos);
      directionY.Unitize();
      directionX = Vector3d.CrossProduct(directionY, Vector3d.ZAxis);

      overlapArea = 0;
      stressX = 0;
      stressY = 0;
    }

    private Point3d GetCenter(Curve c){
      Point3d center = AreaMassProperties.Compute(c).Centroid;
      return center;
    }

    public void ClearOverlapArea(){
      overlapArea = 0;
    }

    //计算各单体层数和间距
    public void CalculateHeight(int meanLevel, double meanDist, double standDeviation, double floorHeight, ref double offDist, ref int level){
      double deviation = closestDist - meanDist;
      if(Math.Abs(deviation) < 0.5 * standDeviation){
        level = meanLevel;
      }
      if(deviation >= 0.5 * standDeviation && deviation < 1.5 * standDeviation){
        level = (int) (meanLevel * 0.75);
      }
      if(deviation <= -0.5 * standDeviation && deviation > -1.5 * standDeviation){
        level = (int) (meanLevel * 1.25);
      }
      if(deviation <= -1.5 * standDeviation){
        level = (int) (meanLevel * 1.5);
      }
      if(deviation >= 1.5 * standDeviation){
        level = (int) (meanLevel * 0.5);
      }
      if(level * floorHeight <= 24){
        offDist = 3;
        offShape = shape.Offset(Plane.WorldXY, offDist, 0.1, Rhino.Geometry.CurveOffsetCornerStyle.Sharp)[0];
      }
      else if(level * floorHeight > 24 && level * floorHeight <= 100){
        offDist = 6.5;
        offShape = shape.Offset(Plane.WorldXY, offDist, 0.1, Rhino.Geometry.CurveOffsetCornerStyle.Sharp)[0];
      }
      else{
        offDist = 12;
        offShape = shape.Offset(Plane.WorldXY, offDist, 0.1, Rhino.Geometry.CurveOffsetCornerStyle.Sharp)[0];
      }
    }

    //避免中心点重叠
    public void Overlap(List<Building> buildings){
      Vector3d randMove = new Vector3d(0, 0, 0);
      for(int i = 0; i < buildings.Count; i++){
        Building b = buildings[i];
        if(b != this && pos == b.pos){
          double randDir = Math.PI * rand.NextDouble();
          double bArea = AreaMassProperties.Compute(b.offShape).Area; //面积越大移动越远
          randMove = new Vector3d(Math.Cos(randDir) * bArea * 0.005, Math.Sin(randDir) * bArea * 0.005, 0);
          break;
        }
      }
      pos = Point3d.Add(pos, randMove);
      shape.Translate(randMove);
      offShape.Translate(randMove);
    }
    //排斥
    public void Seperate (Building b){
      double overlap = 0;
      Curve[] intersecs = Curve.CreateBooleanIntersection(offShape, b.offShape, 0.1);
      if(intersecs.Length != 0){
        for (int j = 0; j < intersecs.Length; j++){
          overlap += AreaMassProperties.Compute(intersecs[j]).Area;
          Point3d interCenter = GetCenter(intersecs[j]);
          Vector3d pi = Point3d.Subtract(pos, interCenter);
          Vector3d pj = Point3d.Subtract(b.pos, interCenter);
          if(pi.Length == 0){
            pi = Point3d.Subtract(pos, b.pos);
            pj = Point3d.Subtract(b.pos, pos);
          }

          double dist = pos.DistanceTo(b.pos);
          pi = Vector3d.Multiply(pi, 4 / dist);
          pj = Vector3d.Multiply(pj, 4 / dist);
          move = Vector3d.Add(move, Vector3d.Multiply(pi, 0.5));
          b.move = Vector3d.Add(b.move, Vector3d.Multiply(pj, 0.5));
        }
      }
      overlapArea += overlap;
    }


    public void ChangeScale (Building b){
      Curve[] intersecs = Curve.CreateBooleanIntersection(offShape, b.offShape, 0.1);
      Vector3d trend = new Vector3d(0, 0, 0);
      if(intersecs.Length != 0){
        for (int j = 0; j < intersecs.Length; j++){
          double interArea = AreaMassProperties.Compute(intersecs[j]).Area;
          Point3d interCenter = GetCenter(intersecs[j]);
          Vector3d pi = Point3d.Subtract(pos, interCenter);
          pi = Vector3d.Multiply(pi, 5 * interArea / averageArea);
          Vector3d pj = Point3d.Subtract(b.pos, interCenter);
          pj = Vector3d.Multiply(pj, 5 * interArea / averageArea);

          if(pi.Length == 0){ //判断是否包含
            pi = Point3d.Subtract(pos, b.pos);
            pi = Vector3d.Multiply(pi, 5 * interArea / averageArea);
            pj = Point3d.Subtract(b.pos, pos);
            pj = Vector3d.Multiply(pj, 5 * interArea / averageArea);
          }
          if(width / length > 0.25){//判断比例超过限制则不再改变
            stressY += Math.Abs(Vector3d.Multiply(pi, directionY)) * 0.5;
          }
          if(width / length < 4){
            stressX += Math.Abs(Vector3d.Multiply(pi, directionX)) * 0.5;
          }
          if(b.width / b.length > 0.25){
            b.stressY += Math.Abs(Vector3d.Multiply(pj, b.directionY)) * 0.5;
          }
          if(b.width / b.length < 4){
            b.stressX += Math.Abs(Vector3d.Multiply(pj, b.directionX)) * 0.5;
          }
        }
      }
    }

    //避免出界
    public void CheckEdge(){
      Curve[] differC = Curve.CreateBooleanDifference(shape, boundary, 0.1);
      if(differC.Length != 0){
        Vector3d pushBack = new Vector3d();
        for (int i = 0; i < differC.Length; i++){
          overlapArea += AreaMassProperties.Compute(differC[i]).Area;
          Point3d subCenter = GetCenter(differC[i]);
          Vector3d push = Point3d.Subtract(siteCenter, subCenter);
          pushBack = Vector3d.Add(pushBack, push);
        }
        pushBack = Vector3d.Multiply(pushBack, 2.5 / pushBack.Length);
        move += pushBack;
      }
    }

    //对齐边界旋转
    public void AlignBoundary(double boundaryDist, List<Curve> roads){
      double shapeP;
      shape.ClosestPoint(closestBP, out shapeP);
      Point3d shapeCP = shape.PointAt(shapeP);
      double shapeDist = shapeCP.DistanceTo(closestBP);
      if(shapeDist < boundaryDist){
        Vector3d roadVec = Point3d.Subtract(roads[closestRoad].PointAtEnd, roads[closestRoad].PointAtStart);
        roadVec.Unitize();
        Vector3d axis = Vector3d.CrossProduct(directionY, roadVec);
        double angleDiff = Vector3d.VectorAngle(directionY, roadVec);
        if(angleDiff != 0 || angleDiff != Math.PI * 0.5 || angleDiff != Math.PI){
          //将旋转动作控制在90°以内
          if(angleDiff < Math.PI * 0.5){ //锐角
            directionY.Rotate(angleDiff, axis);
            directionX.Rotate(angleDiff, axis);
            shape.Rotate(angleDiff, axis, pos);
            offShape.Rotate(angleDiff, axis, pos);
          }
          else{
            if(angleDiff - Math.PI * 0.5 < Math.PI * 0.25){
              angleDiff -= Math.PI * 0.5;
              directionY.Rotate(angleDiff, axis);
              directionX.Rotate(angleDiff, axis);
              shape.Rotate(angleDiff, axis, pos);
              offShape.Rotate(angleDiff, axis, pos);
            }
            else{
              angleDiff -= Math.PI;
              directionY.Rotate(angleDiff, axis);
              directionX.Rotate(angleDiff, axis);
              shape.Rotate(angleDiff, axis, pos);
              offShape.Rotate(angleDiff, axis, pos);
            }
          }
        }
      }
      else{
        //每次都要判断是否离边界足够近， 否则保持正南北
        Vector3d axis = Vector3d.CrossProduct(directionY, Vector3d.XAxis);
        double angleDiff = Vector3d.VectorAngle(directionY, Vector3d.XAxis);
        if(angleDiff != 0 || angleDiff != Math.PI * 0.5 || angleDiff != Math.PI){
          //将旋转动作控制在90°以内
          if (angleDiff < Math.PI * 0.5){
            directionY.Rotate(angleDiff, axis);
            directionX.Rotate(angleDiff, axis);
            shape.Rotate(angleDiff, axis, pos);
            offShape.Rotate(angleDiff, axis, pos);
          }
          else{
            if(angleDiff - Math.PI * 0.5 < Math.PI * 0.25){
              angleDiff -= Math.PI * 0.5;
              directionY.Rotate(angleDiff, axis);
              directionX.Rotate(angleDiff, axis);
              shape.Rotate(angleDiff, axis, pos);
              offShape.Rotate(angleDiff, axis, pos);
            }
            else{//更接近方向相反
              angleDiff -= Math.PI;
              directionY.Rotate(angleDiff, axis);
              directionX.Rotate(angleDiff, axis);
              shape.Rotate(angleDiff, axis, pos);
              offShape.Rotate(angleDiff, axis, pos);
            }
          }
        }
      }
    }

    public void Update (int num){
      //移动
      pos = Point3d.Add(pos, move);
      shape.Translate(move);
      offShape.Translate(move);
      move = Vector3d.Multiply(move, 0); //改变尺寸比例
      if(stressX != 0 || stressY != 0){
        if(stressX > stressY){
          length -= (0.4 * stressX / num);
          width = averageArea / length;
          shape = new Rectangle3d(new Plane(pos, directionX, directionY), new Interval(-length / 2, length / 2), new Interval(-width / 2, width / 2)).ToNurbsCurve();
          // shape = new Rectangle3d(Plane.WorldXY, new Point3d(pos.X - length / 2, pos.Y - width / 2, 0), new Point3d (length / 2 + pos.X, width / 2 + pos.Y,0)).ToNurbsCurve();
          offShape = shape.Offset(Plane.WorldXY, offDist, 0.1, Rhino.Geometry.CurveOffsetCornerStyle.Sharp)[0];
        }
        else{
          width -= (0.4 * stressY / num);
          length = averageArea / width;
          shape = new Rectangle3d(new Plane(pos, directionX, directionY), new Interval(-length / 2, length / 2), new Interval(-width / 2, width / 2)).ToNurbsCurve();
          offShape = shape.Offset(Plane.WorldXY, offDist, 0.1, Rhino.Geometry.CurveOffsetCornerStyle.Sharp)[0];
        }
        stressX = 0;
        stressY = 0;
      }
    }

  }
# ---------- end buildinggenerator ----------

pt_5 = Point(Point(280.086598, 142.4449278, 0))
geo = Geometry(<curve referenced from the Rhino model>)
pcen_2 = PolygonCenter(Polyline=geo)  # -> CenterV, CenterE, CenterA; disabled
vec2pt = Vector2Pt(PointA=pcen_2.CenterA, PointB=pt_5, Unitize=False)  # -> Vector, Length; disabled
move = Move(Geometry=geo, Motion=vec2pt.Vector)  # -> Geometry, Transform; disabled
geo_2 = Geometry(move.Geometry)

scale = Scale(Geometry=矩形, Center=pcen.CenterA, Factor=30)  # -> Geometry, Transform
buildinggenerator_2 = CSharpScript(
    boundary=边界范围,
    shape_type=scale.Geometry,
    floor_height=楼高,
    floor_num=层数,
    density_min=建筑密度下限,
    density_max=建筑密度上限,
    plotRatio_min=容积率下限,
    plotRatio_max=容积率上限,
    threashold=容错阈值,
    scale_factor=缩放因子,
    area_limit=最小建筑面积,
    floor_limit=层数_2)  # -> out, position, buildings, offShape, w; inputs boundary: Curve, shape_type: Curve, floor_height: Double, floor_num: Int32, density_min: Double, density_max: Double, plotRatio_min: Double, plotRatio_max: Double, threashold: Double, scale_factor: Double, area_limit: Double, floor_limit: Int32; disabled
# ---------- buildinggenerator_2: C# ----------
    //======初始化======
    com_void = new Common_void();

    //计算场地面积
    double boundaryArea = AreaMassProperties.Compute(boundary).Area;
    double shape_area = AreaMassProperties.Compute(shape_type).Area;

    //建筑密度计算智能体个数范围
    double area_min = shape_area;
    while(area_min > area_limit){
      area_min = area_min * scale_factor * scale_factor;
    }
    if(area_min < shape_area){
      area_min = area_min / (scale_factor * scale_factor);
    }
    int build_num_dmin = (int) Math.Ceiling(boundaryArea * density_min / shape_area);
    int build_num_dmax = (int) (boundaryArea * density_max / (area_min));
    //容积率计算智能体个数范围
    int build_num_pmin = (int) Math.Ceiling(plotRatio_min * boundaryArea / (shape_area * floor_num));
    int build_num_pmax = (int) (plotRatio_max * boundaryArea / (area_min * floor_limit));
    //综合计算智能体个数范围
    int build_num_min,build_num_max = 0;
    if(build_num_dmin > build_num_pmin){
      build_num_min = build_num_dmin;}
    else{
      build_num_min = build_num_pmin;
    }
    if(build_num_dmax > build_num_pmax){
      build_num_max = build_num_pmax;}
    else{
      build_num_max = build_num_dmax;
    }


    List<double> tt = new List<double>();
    tt.Add(build_num_dmin);
    tt.Add(build_num_dmax);
    tt.Add(build_num_pmin);
    tt.Add(build_num_pmax);
    tt.Add(build_num_min);
    tt.Add(build_num_max);
    w = "拟合";
# ---------- buildinggenerator_2: C# additional code ----------
  //全局变量
  List<Building> bs;
  Common_void com_void;
  List<Point3d> pos_list;
  List<Curve> footPrint;
  List<Curve> offSet;


  //以下为构建建筑单体智能体代码
  public class Building{
    public Curve boundary;
    public Point3d pos;
    public Curve shape;
    public double floor_height;
    public int floor_num;
    public double area_limit;
    public int floor_limit;

    public Point3d siteCenter;
    public Curve offShape;
    public Vector3d move;

    public double overlapArea;
    public bool alimit;
    public bool flimit;
    public Random rand;

    public Building(Curve boundary_, Point3d pos_, Curve shape_, double floor_height_, int floor_num_, double area_limit_, int floor_limit_){

      pos = new Point3d();
      floor_height = new double();
      floor_num = new int();
      area_limit = new double();
      boundary = boundary_;
      pos = pos_;
      shape = shape_;
      floor_height = floor_height_;
      floor_num = floor_num_;
      area_limit = area_limit_;
      floor_limit = floor_limit_;

      siteCenter = GetCenter(boundary);
      Point3d center = AreaMassProperties.Compute(shape).Centroid;
      shape.Translate(new Vector3d(pos.X - center.X, pos.Y - center.Y, 0));
      offShape = CreateBuffer(shape, floor_height * floor_num);

      overlapArea = 0;
      if(area_limit < AreaMassProperties.Compute(shape).Area){
        alimit = false;
      }
      else{alimit = true;}
      if(floor_limit < floor_num){
        flimit = false;
      }
      else{flimit = true;}
      rand = new Random();

    }

    //计算图形几何中心
    private Point3d GetCenter(Curve c){
      Point3d center = AreaMassProperties.Compute(c).Centroid;
      return center;
    }

    //清空各智能体的存储数据——>不符合要求的面积总和
    public void ClearOverlapArea(){
      overlapArea = 0;
    }

    //计算各智能体楼层数&&创建缓冲
    public void CalculateHeight(){
      offShape = CreateBuffer(shape, floor_height * floor_num);
    }
    //创建缓冲
    private Curve CreateBuffer(Curve x, double y)
    {

      List<Point3d> points_o = new List<Point3d>();
      List<Point3d> points_c = new List<Point3d>();
      int points_num = x.ToNurbsCurve().Points.Count;
      for (int i = 0;i < points_num;i++)
      {
        Point3d temp = new Point3d();
        x.ToNurbsCurve().Points.GetPoint(i, out temp);
        points_o.Add(temp);
        points_c.Add(temp);
      }
      //计算东南西北侧方向上的缓冲距离
      double distance_N,distance_E,distance_S,distance_W;
      if(0.3 * 30 + y - 30 * 0.1 < 6)
      {
        distance_E = distance_W = 6;
      }
      else
      {
        distance_E = distance_W = 0.3 * 30 + y - 30 * 0.1;
      }
      /*
      if(0.8 * 30 + y - 30 * 0.5 < 8)
      {
        distance_S = 8;
      }
      else
      {
        distance_S = 0.8 * 30 + y - 30 * 0.5;
      }
      */
      distance_S = 0;
      double sinHs = Math.Sin(Math.PI / 180 * 23) * Math.Sin(Math.PI / 180 * -23.5) + Math.Cos(Math.PI / 180 * 23) * Math.Cos(Math.PI / 180 * -23.5) * Math.Cos(0);
      double L = Math.Sqrt((y / sinHs) * (y / sinHs) - y * y);
      distance_N = L;
      //图形均基于顺时针构建，因而可根据两点所形成的矢量方向，判断需要构建哪一方向的缓冲，最后用两点位置的移动进行缓冲的构建
      for (int i = 0;i < points_num - 1;i++)
      {
        Point3d temp = new Point3d();
        //南北侧
        if(Math.Abs(points_o[i + 1].X - points_o[i].X) > Math.Abs(points_o[i + 1].Y - points_o[i].Y))
        {
          //北侧
          if((points_o[i + 1].X - points_o[i].X) > 0)
          {
            temp = new Point3d(points_c[i].X, points_c[i].Y + distance_N, points_c[i].Z);
            points_c.RemoveAt(i);
            points_c.Insert(i, temp);
            temp = new Point3d(points_c[i + 1].X, points_c[i + 1].Y + distance_N, points_c[i + 1].Z);
            points_c.RemoveAt(i + 1);
            points_c.Insert(i + 1, temp);
          }
            //南侧
          else
          {
            temp = new Point3d(points_c[i].X, points_c[i].Y - distance_S, points_c[i].Z);
            points_c.RemoveAt(i);
            points_c.Insert(i, temp);
            temp = new Point3d(points_c[i + 1].X, points_c[i + 1].Y - distance_S, points_c[i + 1].Z);
            points_c.RemoveAt(i + 1);
            points_c.Insert(i + 1, temp);
          }
        }
          //东西侧
        else
        {
          if((points_o[i + 1].Y - points_o[i].Y) < 0)
          {
            //东侧
            temp = new Point3d(points_c[i].X + distance_E, points_c[i].Y, points_c[i].Z);
            points_c.RemoveAt(i);
            points_c.Insert(i, temp);
            temp = new Point3d(points_c[i + 1].X + distance_E, points_c[i + 1].Y, points_c[i + 1].Z);
            points_c.RemoveAt(i + 1);
            points_c.Insert(i + 1, temp);
          }
          else
          {
            //西侧
            temp = new Point3d(points_c[i].X - distance_W, points_c[i].Y, points_c[i].Z);
            points_c.RemoveAt(i);
            points_c.Insert(i, temp);
            temp = new Point3d(points_c[i + 1].X - distance_W, points_c[i + 1].Y, points_c[i + 1].Z);
            points_c.RemoveAt(i + 1);
            points_c.Insert(i + 1, temp);
          }
        }
      }
      //计算一个新的重合点，因为建筑轮廓上第一个点与最后一个点重合，构建缓冲后不重合
      double temp_x,temp_y;
      if(points_o[0].X == points_c[0].X)
      {
        temp_x = points_c[points_num - 1].X;
        temp_y = points_c[0].Y;
      }
      else
      {
        temp_x = points_c[0].X;
        temp_y = points_c[points_num - 1].Y;
      }
      Point3d point_orignal = new Point3d(temp_x, temp_y, points_c[0].Z);
      //重合点替换第一点
      points_c.RemoveAt(0);
      points_c.Insert(0, point_orignal);
      //重合点替换最后一点
      points_c.RemoveAt(points_num - 1);
      points_c.Insert(points_num - 1, point_orignal);
      Polyline buffer = new Polyline(points_c);
      return buffer.ToNurbsCurve();
    }

    //避免中心点重叠
    public void Overlap(List<Building> buildings){
      Vector3d randMove = new Vector3d(0, 0, 0);
      for(int i = 0; i < buildings.Count; i++){
        Building b = buildings[i];
        if(b != this && pos == b.pos){
          double randDir = Math.PI * rand.NextDouble();
          double bArea = AreaMassProperties.Compute(b.offShape).Area; //面积越大移动越远
          randMove = new Vector3d(Math.Cos(randDir) * bArea * 0.005, Math.Sin(randDir) * bArea * 0.005, 0);
          break;
        }
      }
      pos = Point3d.Add(pos, randMove);
      shape.Translate(randMove);
      offShape.Translate(randMove);
    }

    //计算场地边界对出界智能体的动量
    public void CheckEdge(){
      Curve[] differC = Curve.CreateBooleanDifference(shape, boundary, 0.000001);
      if(differC.Length != 0){
        Vector3d pushBack = new Vector3d();
        for (int i = 0; i < differC.Length; i++){
          overlapArea += AreaMassProperties.Compute(differC[i]).Area;
          Point3d subCenter = GetCenter(differC[i]);
          Vector3d push = Point3d.Subtract(siteCenter, subCenter);
          pushBack = Vector3d.Add(pushBack, push);
        }
        pushBack = Vector3d.Multiply(pushBack, 2.5 / pushBack.Length);
        move += pushBack;
      }
    }

    //判断该智能体是否与某智能体缓冲区内重叠，若有则两智能体都增加动量
    public void Seperate (Building b){
      double overlap = 0;
      Curve[] intersecs = Curve.CreateBooleanIntersection(shape, b.offShape, 0.000001);
      if(intersecs.Length != 0){
        for (int j = 0; j < intersecs.Length; j++){
          overlap += AreaMassProperties.Compute(intersecs[j]).Area;
          Point3d interCenter = GetCenter(intersecs[j]);
          Vector3d pi = Point3d.Subtract(pos, interCenter);
          Vector3d pj = Point3d.Subtract(GetCenter(b.offShape), interCenter);
          if(pi.Length == 0){
            pi = Point3d.Subtract(pos, b.pos);
            pj = Point3d.Subtract(b.pos, pos);
          }

          double dist = pos.DistanceTo(GetCenter(b.offShape));
          pi = Vector3d.Multiply(pi, 4 / dist);
          pj = Vector3d.Multiply(pj, 4 / dist);
          move = Vector3d.Add(move, Vector3d.Multiply(pi, 0.5));
          b.move = Vector3d.Add(b.move, Vector3d.Multiply(pj, 0.5));
        }
      }
    }

    //根据动量更新智能体位置
    public void Update (){
      pos = Point3d.Add(pos, move);
      shape.Translate(move);
      offShape.Translate(move);
      move = Vector3d.Multiply(move, 0);
    }

    //缩小
    public bool Narrow (double scale_factor){
      if(alimit == false)
      {
        shape.Transform(Transform.Scale(pos, scale_factor));
        offShape = CreateBuffer(shape, floor_height * floor_num);
        if(AreaMassProperties.Compute(shape).Area < area_limit)
        {
          alimit = true;
          //还原
          shape.Transform(Transform.Scale(pos, 1 / scale_factor));
          offShape = CreateBuffer(shape, floor_height * floor_num);
        }
      }
      if(alimit == false)
        return true;
      else
        return false;
    }
    public bool Lowerfloor()
    {
      if(floor_num > floor_limit){
        floor_num -= 1;
        offShape = CreateBuffer(shape, floor_height * floor_num);
      }
      else{flimit = true;}

      return(!flimit);
    }

    //计算各智能体不符合要求面积——>逾越场地边界的面积与其他智能体缓冲区内的重叠面积
    public void UpdateOverlap (List<Building> buildings){
      overlapArea = 0;
      for(int i = 0; i < buildings.Count; i++){
        Building b = buildings[i];
        Curve[] intersecs = Curve.CreateBooleanIntersection(shape, b.offShape, 0.000001);
        if(intersecs.Length != 0){
          for (int j = 0; j < intersecs.Length; j++){
            overlapArea += AreaMassProperties.Compute(intersecs[j]).Area;
          }
        }
      }
      Curve[] differC = Curve.CreateBooleanDifference(shape, boundary, 0.000001);
      if(differC.Length != 0){
        for (int i = 0; i < differC.Length; i++){
          overlapArea += AreaMassProperties.Compute(differC[i]).Area;
        }
      }
    }
  }


  //常用方法
  public class Common_void{
    public Common_void(){}

    //计算所有智能体不符合要求面积总和——>逾越场地边界的面积与其他智能体缓冲区内的重叠面积
    public double CheckOverlap_bs (List<Building> bs){
      double totalOverlap = 0;
      for(int i = 0; i < bs.Count; i++){
        for(int j = 0; j < bs.Count; j++){
          if(i != j)
          {
            Curve[] intersecs = Curve.CreateBooleanIntersection(bs[i].shape, bs[j].offShape, 0.000001);
            if(intersecs.Length != 0){
              for (int k = 0; k < intersecs.Length; k++){
                totalOverlap += AreaMassProperties.Compute(intersecs[k]).Area;
              }
            }
          }
        }
        Curve[] differC = Curve.CreateBooleanDifference(bs[i].shape, bs[i].boundary, 0.000001);
        if(differC.Length != 0){
          for (int j = 0; j < differC.Length; j++){
            totalOverlap += AreaMassProperties.Compute(differC[j]).Area;
          }
        }
      }
      return totalOverlap;
    }


    public int GetScaleANum(List<Building> bs)
    {
      int result = 0;
      for(int i = 0;i < bs.Count;i++)
      {
        if(bs[i].alimit == true)
        {
          result += 1;
        }
      }
      return result;
    }

    public int GetScaleFNum(List<Building> bs)
    {
      int result = 0;
      for(int i = 0;i < bs.Count;i++)
      {
        if(bs[i].flimit == true)
        {
          result += 1;
        }
      }
      return result;
    }
    //Calculate total area of curves
    public double CalculateTotalArea(List<Curve> curve)
    {
      double result = 0;
      for(int i = 0; i < curve.Count; i++)
      {
        result += AreaMassProperties.Compute(curve[i]).Area;
      }
      return result;
    }

    public List<Point3d>GetRandomPoints(int i, Curve curve)
    {
      var func_info = Rhino.NodeInCode.Components.FindComponent("PopulateGeometry");
      var func = func_info.Delegate as dynamic;
      List<Curve> curves = new List<Curve>();
      curves.Add(curve);
      var result = func(Brep.CreatePlanarBreps(curves), i, 1, null);
      List<Point3d> points = new List<Point3d>();
      foreach (var temp in result)
      {
        points.Add((Point3d) temp);
      }
      return points;
    }
    public List<Curve>RepeatCurve(int i, Curve curve)
    {
      var func_info = Rhino.NodeInCode.Components.FindComponent("RepeatData");
      var func = func_info.Delegate as dynamic;
      var result = func(curve, i);

      List<Curve> curves = new List<Curve>();
      foreach (var temp in result)
      {
        curves.Add((Curve) temp);
      }
      return curves;
    }

  }
# ---------- end buildinggenerator_2 ----------
panel_4 = Panel(buildinggenerator_2.w)
area = Area(Geometry=scale.Geometry)  # -> Area, Centroid
buildinggenerator_3 = CSharpScript(
    boundary=边界范围,
    shape_type=scale.Geometry,
    floor_height=楼高,
    floor_num=层数,
    density_min=建筑密度下限,
    density_max=建筑密度上限,
    plotRatio_min=容积率下限,
    plotRatio_max=容积率上限,
    threashold=容错阈值,
    scale_factor=缩放因子,
    area_limit=最小建筑面积,
    floor_min=层数_2,
    floor_max=层数_3)  # -> out, position, buildings, offShape, w; inputs boundary: Curve, shape_type: Curve, floor_height: Double, floor_num: Int32, density_min: Double, density_max: Double, plotRatio_min: Double, plotRatio_max: Double, threashold: Double, scale_factor: Double, area_limit: Double, floor_min: Int32, floor_max: Int32; disabled
# ---------- buildinggenerator_3: C# ----------
    //======初始化======
    com_void = new Common_void();
    string warning = "拟合";
    //计算场地面积
    double boundaryArea = AreaMassProperties.Compute(boundary).Area;
    double shape_area = AreaMassProperties.Compute(shape_type).Area;

    //建筑密度计算智能体个数范围
    double area_scale = shape_area;
    int scale_dnum = 0;
    while(area_scale >= area_limit){
      area_scale = area_scale * scale_factor * scale_factor;
      scale_dnum += 1;
    }
    double area_min = area_scale * 1 / (scale_factor * scale_factor);
    scale_dnum -= 1;

    int build_num_dmin = (int) Math.Ceiling(boundaryArea * density_min / shape_area);
    int build_num_dmax = (int) (boundaryArea * density_max / (area_min));
    //容积率计算智能体个数范围
    int build_num_pmin = (int) Math.Ceiling(plotRatio_min * boundaryArea / (shape_area * floor_max));
    int build_num_pmax = (int) (plotRatio_max * boundaryArea / (area_min * floor_min));
    //综合计算智能体个数范围
    int build_num_min,build_num_max = 0;
    if(build_num_dmin > build_num_pmin){
      build_num_min = build_num_dmin;}
    else{
      build_num_min = build_num_pmin;
    }
    if(build_num_dmax > build_num_pmax){
      build_num_max = build_num_pmax;}
    else{
      build_num_max = build_num_dmax;
    }
    //生成随机智能体个数
    Random rd = new Random();
    int build_num = rd.Next(build_num_min, build_num_max);
    List<double> tt = new List<double>();
    //tt.Add(shape_area);
    //tt.Add(area_min);
    //tt.Add(build_num);
    //生成相应个数的随机点与基于模板的建筑图形
    List<Point3d> randomPoints = com_void.GetRandomPoints(build_num, boundary);
    List< Curve> shape_types = new List<Curve>();
    shape_types = com_void.RepeatCurve(build_num, shape_type);
    //创建智能体
    bs = new List<Building>();
    for(int i = 0; i < build_num; i++){
      Building b = new Building(boundary, randomPoints[i], shape_types[i], floor_height, floor_num, scale_dnum);
      bs.Add(b);
    }

    double density = double.MinValue;
    double plotRatio = double.MinValue;
    bool ifChangeScale = true;
    bool ifLimitCount = false;
    double count = 0;
    double totalOverlap = double.MaxValue;
    double scale_anum = 0;
    List<int> seq = new List<int>();
    //======运行======
    //跳出循环条件
    //totalOverlap <= shape_area * threashold
    //density_min<=density <= density_max
    //plotRatio_min<=plotRatio <= plotRatio_max
    while(!(totalOverlap <= shape_area * threashold && density >= density_min && density <= density_max && plotRatio >= plotRatio_min && plotRatio <= plotRatio_max)){
      totalOverlap = 0;
      //迭代次数大于100时，迭代次数为智能体个数时对最不符合要求的建筑缩小
      if(ifChangeScale){
        if(count > 50 && count % bs.Count == 0){
          //索引
          seq.Clear();
          seq = new List<int>();
          for(int i = 0;i < bs.Count ;i++){
            //计算各智能体不符合要求的面积总和——>逾越场地边界的面积及其与其他智能体缓冲区内的总重叠面积
            bs[i].UpdateOverlap(bs);
            //获取缩小未完全达到限制的智能体索引
            if(bs[i].alimit != true){
              seq.Add(i);
            }
          }
          //获取总面积从大到小的相应索引
          int temp = 0;
          for(int i = 0;i < seq.Count - 1;i++){
            for(int j = 0;j < seq.Count - i - 1;j++){
              if(bs[seq[j]].overlapArea < bs[seq[j + 1]].overlapArea){
                temp = seq[j];
                seq[j] = seq[j + 1];
                seq[j + 1] = temp;
              }
            }
          }
          //缩小直至碰到一个可缩小的智能体，则退出循环
          for(int i = 0;i < seq.Count;i++){
            bool bool_atemp = bs[seq[i]].Narrow(scale_factor);
            if(bool_atemp)
              break;
          }
          //清空各智能体的存储数据——>不符合要求的面积总和
          for(int i = 0;i < bs.Count ;i++){
            bs[i].ClearOverlapArea();
          }
        }
      }

      for(int i = 0;i < bs.Count;i++){
        //计算场地边界对出界智能体的动量
        bs[i].CheckEdge();
        //根据该智能体与其他智能体的缓冲边界内的重叠情况，计算动量
        for(int j = 0; j < bs.Count; j++){
          if(i != j){
            bs[i].Seperate(bs[j]);
          }
        }
        //根据动量更新智能体位置
        bs[i].Update();
        //清空各智能体的存储数据——>不符合要求的面积总和
        bs[i].ClearOverlapArea();
      }
      if(scale_dnum > 0)
        scale_anum = com_void.GetScaleANum(bs);
      else
        scale_anum = 0;
      totalOverlap = com_void.CheckOverlap_bs(bs);
      count++;

      if(count == 100 && totalOverlap > shape_area * threashold && ifLimitCount){
        build_num = bs.Count - 1;
        bs.Clear();
        shape_types.Clear();
        randomPoints.Clear();
        randomPoints = com_void.GetRandomPoints(build_num, boundary);
        shape_types = com_void.RepeatCurve(build_num, shape_type);
        for(int i = 0; i < build_num; i++){
          Building b = new Building(boundary, randomPoints[i], shape_types[i], floor_height, floor_num, scale_dnum);
          bs.Add(b);
        }
        //直接进入下一次循环
        ifChangeScale = true;
        ifLimitCount = false;
        totalOverlap = double.MaxValue;
        scale_anum = 0;
        count = 0;
        continue;
      }
      //计算建筑密度与容积率
      double value_atemp = 0;
      double value_ftemp = 0;
      for(int i = 0;i < bs.Count;i++)
      {
        value_atemp += AreaMassProperties.Compute(bs[i].shape).Area;
        value_ftemp += bs[i].floor_num * AreaMassProperties.Compute(bs[i].shape).Area;
      }
      density = value_atemp / boundaryArea;
      plotRatio = value_ftemp / boundaryArea;

      //拟合失败，并所有已缩小至极致
      if(totalOverlap > shape_area * threashold && scale_anum == bs.Count && count % bs.Count == 0){
        build_num = bs.Count - 1;
      }
      //拟合成功,但建筑密度小于下限
      if(totalOverlap <= shape_area * threashold && density < density_min){
        build_num = bs.Count + 1;
      }
      //超出范围，退出循环
      if(build_num > build_num_max || build_num < build_num_min){
        warning = "拟合失败，原因可能是参数无法满足拟合，请适当放宽参数";
        break;
      }
        //在范围内，且智能体个数需要改变
      else if(build_num != bs.Count){
        bs.Clear();
        shape_types.Clear();
        randomPoints.Clear();
        randomPoints = com_void.GetRandomPoints(build_num, boundary);
        shape_types = com_void.RepeatCurve(build_num, shape_type);
        for(int i = 0; i < build_num; i++){
          Building b = new Building(boundary, randomPoints[i], shape_types[i], floor_height, floor_num, scale_dnum);
          bs.Add(b);
        }
        ifChangeScale = true;
        ifLimitCount = false;
        totalOverlap = double.MaxValue;
        scale_anum = 0;
        count = 0;
        continue;
      }
        //在范围内，且智能体个数不需要改变，则进行容积率的拟合
      else{
        if(totalOverlap <= shape_area * threashold){
          //容积率不在范围内
          if(plotRatio > plotRatio_max || plotRatio < plotRatio_max){
            seq.Clear();
            seq = new List<int>();
            for(int i = 0;i < bs.Count ;i++){
              seq.Add(i);
            }
            //获取从北到南的相应索引
            int temp = 0;
            for(int i = 0;i < seq.Count - 1;i++){
              for(int j = 0;j < seq.Count - i - 1;j++){
                if(bs[seq[j]].pos.Y < bs[seq[j + 1]].pos.Y){
                  temp = seq[j];
                  seq[j] = seq[j + 1];
                  seq[j + 1] = temp;
                }
              }
            }
            //容积率大于上限
            if(plotRatio > plotRatio_max){
              for(int i = floor_num;i > floor_min;i--){
                for(int j = 0;j < bs.Count;j++){
                  bs[seq[bs.Count - j - 1]].floor_num -= 1;
                  value_ftemp -= AreaMassProperties.Compute(bs[seq[bs.Count - j - 1]].shape).Area;
                  if (value_ftemp <= plotRatio_max * boundaryArea){
                    break;
                  }
                }
                if (value_ftemp <= plotRatio_max * boundaryArea){
                  break;
                }
              }
              //在范围内对楼层向下调整后，可使容积率拟合
              if(value_ftemp <= plotRatio_max * boundaryArea){
                ifChangeScale = false;
                ifLimitCount = false;
                totalOverlap = double.MaxValue;
                scale_anum = 0;
                count = 0;
                continue;
              }
                //楼层调至最低仍无法拟合容积率
              else{
                //减少智能体个数
                build_num = bs.Count - 1;
              }
            }
              //容积率小于下限
            else if(plotRatio < plotRatio_min){
              for(int i = floor_num;i < floor_max;i++){
                for(int j = 0;j < bs.Count;j++){
                  bs[seq[j]].floor_num += 1;
                  value_ftemp += AreaMassProperties.Compute(bs[seq[j]].shape).Area;
                  if (value_ftemp >= plotRatio_min * boundaryArea){
                    break;
                  }
                }
                if (value_ftemp >= plotRatio_min * boundaryArea){
                  break;
                }
              }
              //在范围内对楼层向上调整后，可使容积率拟合
              if(value_ftemp >= plotRatio_min * boundaryArea){
                ifChangeScale = false;
                ifLimitCount = true;
                totalOverlap = double.MaxValue;
                scale_anum = 0;
                count = 0;
                for(int i = 0;i < bs.Count;i++){
                  bs[i].offShape = bs[i].CreateBuffer(bs[i].shape, bs[i].floor_height * bs[i].floor_num);
                }
                continue;
              }
                //楼层调至最低仍无法拟合容积率
              else{
                //增加智能体个数
                build_num = bs.Count - 1;
              }
            }
              //容积率在范围内
            else{warning = "拟合成功";}
            //超出范围，退出循环
            if(build_num > build_num_max || build_num < build_num_min){
              warning = "拟合失败，原因可能是参数无法满足拟合，请适当放宽参数";
              break;
            }
              //在范围内，且智能体个数需要改变
            else if(build_num != bs.Count){
              bs.Clear();
              shape_types.Clear();
              randomPoints.Clear();
              randomPoints = com_void.GetRandomPoints(build_num, boundary);
              shape_types = com_void.RepeatCurve(build_num, shape_type);
              for(int i = 0; i < build_num; i++){
                Building b = new Building(boundary, randomPoints[i], shape_types[i], floor_height, floor_num, scale_dnum);
                bs.Add(b);
              }
              //直接进入下一次循环
              ifChangeScale = true;
              ifLimitCount = false;
              totalOverlap = double.MaxValue;
              scale_anum = 0;
              count = 0;
              continue;
            }
          }
        }
      }
    }

    //====输出=====
    pos_list = new List<Point3d>();
    footPrint = new List<Curve>();
    offSet = new List<Curve>();


    for(int i = 0; i < bs.Count; i++){
      pos_list.Add(bs[i].pos);
      footPrint.Add(bs[i].shape);
      offSet.Add(bs[i].offShape);
      tt.Add(AreaMassProperties.Compute(bs[i].shape).Area);
      tt.Add(bs[i].floor_num);
    }
    //tt.Add(com_void.CheckOverlap_bs(bs));
    //tt.Add(bs.Count);
    //tt.Add(build_num);
    //tt.Add(count);
    position = pos_list;
    buildings = footPrint;
    offShape = offSet;
    //w = tt;
    w = warning;
# ---------- buildinggenerator_3: C# additional code ----------
  //全局变量
  List<Building> bs;
  Common_void com_void;
  List<Point3d> pos_list;
  List<Curve> footPrint;
  List<Curve> offSet;


  //以下为构建建筑单体智能体代码
  public class Building{
    public Curve boundary;
    public Point3d pos;
    public Curve shape;
    public double floor_height;
    public int floor_num;
    public int scale_dnum;

    public Point3d siteCenter;
    public Curve offShape;
    public Vector3d move;

    public double overlapArea;
    public bool alimit;
    public Random rand;

    public Building(Curve boundary_, Point3d pos_, Curve shape_, double floor_height_, int floor_num_, int scale_dnum_){

      pos = new Point3d();
      floor_height = new double();
      floor_num = new int();
      scale_dnum = new int();
      boundary = boundary_;
      pos = pos_;
      shape = shape_;
      floor_height = floor_height_;
      floor_num = floor_num_;
      scale_dnum = scale_dnum_;

      siteCenter = GetCenter(boundary);
      Point3d center = AreaMassProperties.Compute(shape).Centroid;
      shape.Translate(new Vector3d(pos.X - center.X, pos.Y - center.Y, 0));
      offShape = CreateBuffer(shape, floor_height * floor_num);

      overlapArea = 0;
      if(scale_dnum > 0){
        alimit = false;
      }
      else{alimit = true;}
      rand = new Random();

    }

    //计算图形几何中心
    private Point3d GetCenter(Curve c){
      Point3d center = AreaMassProperties.Compute(c).Centroid;
      return center;
    }

    //清空各智能体的存储数据——>不符合要求的面积总和
    public void ClearOverlapArea(){
      overlapArea = 0;
    }

    //计算各智能体楼层数&&创建缓冲
    public void CalculateHeight(){
      offShape = CreateBuffer(shape, floor_height * floor_num);
    }
    //创建缓冲
    public Curve CreateBuffer(Curve x, double y)
    {

      List<Point3d> points_o = new List<Point3d>();
      List<Point3d> points_c = new List<Point3d>();
      int points_num = x.ToNurbsCurve().Points.Count;
      for (int i = 0;i < points_num;i++)
      {
        Point3d temp = new Point3d();
        x.ToNurbsCurve().Points.GetPoint(i, out temp);
        points_o.Add(temp);
        points_c.Add(temp);
      }
      //计算东南西北侧方向上的缓冲距离
      double distance_N,distance_E,distance_S,distance_W;
      if(0.3 * 30 + y - 30 * 0.1 < 6)
      {
        distance_E = distance_W = 6;
      }
      else
      {
        distance_E = distance_W = 0.3 * 30 + y - 30 * 0.1;
      }
      /*
      if(0.8 * 30 + y - 30 * 0.5 < 8)
      {
        distance_S = 8;
      }
      else
      {
        distance_S = 0.8 * 30 + y - 30 * 0.5;
      }
      */
      distance_S = 0;
      double sinHs = Math.Sin(Math.PI / 180 * 23) * Math.Sin(Math.PI / 180 * -23.5) + Math.Cos(Math.PI / 180 * 23) * Math.Cos(Math.PI / 180 * -23.5) * Math.Cos(0);
      double L = Math.Sqrt((y / sinHs) * (y / sinHs) - y * y);
      distance_N = L;
      //找出最北面的边的长度
      double distance_N_len = 0;
      for (int i = 0;i < points_num - 1;i++){
        Point3d temp = new Point3d();
        //南北侧
        if(Math.Abs(points_o[i + 1].X - points_o[i].X) > Math.Abs(points_o[i + 1].Y - points_o[i].Y))
        {
          //北侧
          if((points_o[i + 1].X - points_o[i].X) > 0)
          {
            if(points_o[i + 1].X - points_o[i].X > distance_N_len){
              distance_N_len = points_o[i + 1].X - points_o[i].X;
            }
          }
        }
      }
      //图形均基于顺时针构建，因而可根据两点所形成的矢量方向，判断需要构建哪一方向的缓冲，最后用两点位置的移动进行缓冲的构建
      for (int i = 0;i < points_num - 1;i++){
        Point3d temp = new Point3d();
        //南北侧
        if(Math.Abs(points_o[i + 1].X - points_o[i].X) > Math.Abs(points_o[i + 1].Y - points_o[i].Y))
        {
          //北侧
          if((points_o[i + 1].X - points_o[i].X) > 0)
          {
            if(points_o[i + 1].X - points_o[i].X == distance_N_len){
              distance_N = L;
            }
            else{
              distance_N = 0;
            }
            temp = new Point3d(points_c[i].X, points_c[i].Y + distance_N, points_c[i].Z);
            points_c.RemoveAt(i);
            points_c.Insert(i, temp);
            temp = new Point3d(points_c[i + 1].X, points_c[i + 1].Y + distance_N, points_c[i + 1].Z);
            points_c.RemoveAt(i + 1);
            points_c.Insert(i + 1, temp);
          }
            //南侧
          else
          {
            temp = new Point3d(points_c[i].X, points_c[i].Y - distance_S, points_c[i].Z);
            points_c.RemoveAt(i);
            points_c.Insert(i, temp);
            temp = new Point3d(points_c[i + 1].X, points_c[i + 1].Y - distance_S, points_c[i + 1].Z);
            points_c.RemoveAt(i + 1);
            points_c.Insert(i + 1, temp);
          }
        }
          //东西侧
        else
        {
          if((points_o[i + 1].Y - points_o[i].Y) < 0)
          {
            //东侧
            temp = new Point3d(points_c[i].X + distance_E, points_c[i].Y, points_c[i].Z);
            points_c.RemoveAt(i);
            points_c.Insert(i, temp);
            temp = new Point3d(points_c[i + 1].X + distance_E, points_c[i + 1].Y, points_c[i + 1].Z);
            points_c.RemoveAt(i + 1);
            points_c.Insert(i + 1, temp);
          }
          else
          {
            //西侧
            temp = new Point3d(points_c[i].X - distance_W, points_c[i].Y, points_c[i].Z);
            points_c.RemoveAt(i);
            points_c.Insert(i, temp);
            temp = new Point3d(points_c[i + 1].X - distance_W, points_c[i + 1].Y, points_c[i + 1].Z);
            points_c.RemoveAt(i + 1);
            points_c.Insert(i + 1, temp);
          }
        }
      }
      //计算一个新的重合点，因为建筑轮廓上第一个点与最后一个点重合，构建缓冲后不重合
      double temp_x,temp_y;
      if(points_o[0].X == points_c[0].X)
      {
        temp_x = points_c[points_num - 1].X;
        temp_y = points_c[0].Y;
      }
      else
      {
        temp_x = points_c[0].X;
        temp_y = points_c[points_num - 1].Y;
      }
      Point3d point_orignal = new Point3d(temp_x, temp_y, points_c[0].Z);
      //重合点替换第一点
      points_c.RemoveAt(0);
      points_c.Insert(0, point_orignal);
      //重合点替换最后一点
      points_c.RemoveAt(points_num - 1);
      points_c.Insert(points_num - 1, point_orignal);
      Polyline buffer = new Polyline(points_c);
      return buffer.ToNurbsCurve();
    }

    //避免中心点重叠
    public void Overlap(List<Building> buildings){
      Vector3d randMove = new Vector3d(0, 0, 0);
      for(int i = 0; i < buildings.Count; i++){
        Building b = buildings[i];
        if(b != this && pos == b.pos){
          double randDir = Math.PI * rand.NextDouble();
          double bArea = AreaMassProperties.Compute(b.offShape).Area; //面积越大移动越远
          randMove = new Vector3d(Math.Cos(randDir) * bArea * 0.005, Math.Sin(randDir) * bArea * 0.005, 0);
          break;
        }
      }
      pos = Point3d.Add(pos, randMove);
      shape.Translate(randMove);
      offShape.Translate(randMove);
    }

    //计算场地边界对出界智能体的动量
    public void CheckEdge(){
      Curve[] differC = Curve.CreateBooleanDifference(shape, boundary, 0.000001);
      if(differC.Length != 0){
        Vector3d pushBack = new Vector3d();
        for (int i = 0; i < differC.Length; i++){
          overlapArea += AreaMassProperties.Compute(differC[i]).Area;
          Point3d subCenter = GetCenter(differC[i]);
          Vector3d push = Point3d.Subtract(siteCenter, subCenter);
          pushBack = Vector3d.Add(pushBack, push);
        }
        pushBack = Vector3d.Multiply(pushBack, 2.5 / pushBack.Length);
        move += pushBack;
      }
    }

    //判断该智能体是否与某智能体缓冲区内重叠，若有则两智能体都增加动量
    public void Seperate (Building b){
      double overlap = 0;
      Curve[] intersecs = Curve.CreateBooleanIntersection(shape, b.offShape, 0.000001);
      if(intersecs.Length != 0){
        for (int j = 0; j < intersecs.Length; j++){
          overlap += AreaMassProperties.Compute(intersecs[j]).Area;
          Point3d interCenter = GetCenter(intersecs[j]);
          Vector3d pi = Point3d.Subtract(pos, interCenter);
          Vector3d pj = Point3d.Subtract(GetCenter(b.offShape), interCenter);
          if(pi.Length == 0){
            pi = Point3d.Subtract(pos, b.pos);
            pj = Point3d.Subtract(b.pos, pos);
          }

          double dist = pos.DistanceTo(GetCenter(b.offShape));
          pi = Vector3d.Multiply(pi, 4 / dist);
          pj = Vector3d.Multiply(pj, 4 / dist);
          move = Vector3d.Add(move, Vector3d.Multiply(pi, 0.5));
          b.move = Vector3d.Add(b.move, Vector3d.Multiply(pj, 0.5));
        }
      }
    }

    //根据动量更新智能体位置
    public void Update (){
      pos = Point3d.Add(pos, move);
      shape.Translate(move);
      offShape.Translate(move);
      move = Vector3d.Multiply(move, 0);
    }

    //缩小
    public bool Narrow (double scale_factor){
      if(scale_dnum > 0)
      {
        shape.Transform(Transform.Scale(pos, scale_factor));
        offShape = CreateBuffer(shape, floor_height * floor_num);
        scale_dnum -= 1;
      }
      if(scale_dnum == 0)
      {
        alimit = true;
      }
      return(!alimit);
    }

    //计算各智能体不符合要求面积——>逾越场地边界的面积与其他智能体缓冲区内的重叠面积
    public void UpdateOverlap (List<Building> buildings){
      overlapArea = 0;
      for(int i = 0; i < buildings.Count; i++){
        Building b = buildings[i];
        Curve[] intersecs = Curve.CreateBooleanIntersection(shape, b.offShape, 0.000001);
        if(intersecs.Length != 0){
          for (int j = 0; j < intersecs.Length; j++){
            overlapArea += AreaMassProperties.Compute(intersecs[j]).Area;
          }
        }
      }
      Curve[] differC = Curve.CreateBooleanDifference(shape, boundary, 0.000001);
      if(differC.Length != 0){
        for (int i = 0; i < differC.Length; i++){
          overlapArea += AreaMassProperties.Compute(differC[i]).Area;
        }
      }
    }
  }


  //常用方法
  public class Common_void{
    public Common_void(){}

    //计算所有智能体不符合要求面积总和——>逾越场地边界的面积与其他智能体缓冲区内的重叠面积
    public double CheckOverlap_bs (List<Building> bs){
      double totalOverlap = 0;
      for(int i = 0; i < bs.Count; i++){
        for(int j = 0; j < bs.Count; j++){
          if(i != j)
          {
            Curve[] intersecs = Curve.CreateBooleanIntersection(bs[i].shape, bs[j].offShape, 0.000001);
            if(intersecs.Length != 0){
              for (int k = 0; k < intersecs.Length; k++){
                totalOverlap += AreaMassProperties.Compute(intersecs[k]).Area;
              }
            }
          }
        }
        Curve[] differC = Curve.CreateBooleanDifference(bs[i].shape, bs[i].boundary, 0.000001);
        if(differC.Length != 0){
          for (int j = 0; j < differC.Length; j++){
            totalOverlap += AreaMassProperties.Compute(differC[j]).Area;
          }
        }
      }
      return totalOverlap;
    }


    public int GetScaleANum(List<Building> bs)
    {
      int result = 0;
      for(int i = 0;i < bs.Count;i++)
      {
        if(bs[i].alimit == true)
        {
          result += 1;
        }
      }
      return result;
    }
    //Calculate total area of curves
    public double CalculateTotalArea(List<Curve> curve)
    {
      double result = 0;
      for(int i = 0; i < curve.Count; i++)
      {
        result += AreaMassProperties.Compute(curve[i]).Area;
      }
      return result;
    }

    public List<Point3d>GetRandomPoints(int i, Curve curve)
    {
      var func_info = Rhino.NodeInCode.Components.FindComponent("PopulateGeometry");
      var func = func_info.Delegate as dynamic;
      List<Curve> curves = new List<Curve>();
      curves.Add(curve);
      var result = func(Brep.CreatePlanarBreps(curves), i, 1, null);
      List<Point3d> points = new List<Point3d>();
      foreach (var temp in result)
      {
        points.Add((Point3d) temp);
      }
      return points;
    }
    public List<Curve>RepeatCurve(int i, Curve curve)
    {
      var func_info = Rhino.NodeInCode.Components.FindComponent("RepeatData");
      var func = func_info.Delegate as dynamic;
      var result = func(curve, i);

      List<Curve> curves = new List<Curve>();
      foreach (var temp in result)
      {
        curves.Add((Curve) temp);
      }
      return curves;
    }

  }
# ---------- end buildinggenerator_3 ----------

# ----
# 建筑类型
pt_6 = Point([Point(0, 0, 0), Point(0, 13.75, 0), Point(29.2, 13.75, 0), Point(29.2, 0, 0), Point(0, 0, 0)])
pt_7 = Point([Point(5.4, 0, 0), Point(5.4, 17, 0), Point(0, 17, 0), Point(0, 27.2, 0), Point(28.6, 27.2, 0), Point(28.6, 17, 0), Point(23.2, 17, 0), Point(23.2, 0, 0), Point(5.4, 0, 0)])
pt_8 = Point([Point(0, 0, 0), Point(0, 46.8, 0), Point(45.97, 46.8, 0), Point(45.97, 26.8, 0), Point(21.8, 26.8, 0), Point(21.8, 0, 0), Point(0, 0, 0)])
pt_9 = Point([Point(0, 0, 0), Point(0, 70, 0), Point(80, 70, 0), Point(80, 50, 0), Point(20, 50, 0), Point(20, 20, 0), Point(80, 20, 0), Point(80, 0, 0), Point(0, 0, 0)])
pt_10 = Point([Point(1.6, 0, 0), Point(1.6, 10, 0), Point(8.45, 10, 0), Point(8.45, 13.5, 0), Point(0, 13.5, 0), Point(0, 23.5, 0), Point(26.1, 23.5, 0), Point(26.1, 13.5, 0), Point(17.65, 13.5, 0), Point(17.65, 10, 0), Point(24.5, 10, 0), Point(24.5, 0, 0), Point(1.6, 0, 0)])
t形 = PolyLine(Vertices=pt_7, Closed=False)
矩形_2 = PolyLine(Vertices=pt_6, Closed=False)
l型_2 = PolyLine(Vertices=pt_8, Closed=False)
u型_2 = PolyLine(Vertices=pt_9, Closed=False)
工型_2 = PolyLine(Vertices=pt_10, Closed=False)

panel_5 = Panel(buildinggenerator_3.w)
geo_3 = Geometry(buildinggenerator_3.buildings)

# ----
# 三维拉伸
vec = VectorXYZ(XComponent=0, YComponent=0, ZComponent=20)  # -> Vector, Length
extr = Extrude(Base=buildinggenerator_3.buildings, Direction=vec.Vector)
brep = Brep(extr)
cap = CapHoles(Brep=brep)
drawbrep = CSharpScript(B=cap, C=ColourSwatch(SwatchColor=RGB(96, 96, 96)))  # -> out; inputs B: Brep, C: Color; disabled
# ---------- drawbrep: C# usings ----------
using System.IO;
using System.Linq;
using System.Data;
using System.Drawing;
using System.Reflection;
using System.Windows.Forms;
using System.Xml;
using System.Xml.Linq;
using System.Runtime.InteropServices;

using Rhino.DocObjects;
using Rhino.Collections;
using GH_IO;
using GH_IO.Serialization;
# ---------- drawbrep: C# ----------
    if (B == null) return;
    if (C.A == 0) return;

    _breps.Add(B);
    _materials.Add(new Rhino.Display.DisplayMaterial(C));
# ---------- drawbrep: C# additional code ----------
  private readonly List<Brep> _breps = new List<Brep>();
  private readonly List<Rhino.Display.DisplayMaterial> _materials = new List<Rhino.Display.DisplayMaterial>();
  private BoundingBox _box;

  /// <summary>
  /// This method will be called once every solution, before any calls to RunScript.
  /// </summary>
  public override void BeforeRunScript()
  {
    _box = BoundingBox.Empty;
    _breps.Clear();
    _materials.Clear();
  }

  public override BoundingBox ClippingBox
  {
    get { return _box; }
  }
  public override void DrawViewportMeshes(IGH_PreviewArgs args)
  {
    for (int i = 0; i < _breps.Count; i++)
      args.Display.DrawBrepWires(_breps[i], _materials[i].Diffuse, 0);
  }
  public override void DrawViewportWires(IGH_PreviewArgs args)
  {
    for (int i = 0; i < _breps.Count; i++)
      args.Display.DrawBrepShaded(_breps[i], _materials[i]);
  }
# ---------- end drawbrep ----------

geo_4 = Geometry(buildinggenerator_3.offShape)

panel_6 = Panel([Slider(0.01, range=0..1), Slider(0.98, range=0..1), Slider(0.99, range=0..1), Slider(0.34, range=0..1), Slider(0.68, range=0..1), Slider(0.01, range=0..1), Slider(0.99, range=0..1), Slider(0.71, range=0..1), Slider(0.35, range=0..1), Slider(0.02, range=0..1), Slider(0.98, range=0..1), Slider(0, range=0..1), Slider(0.52, range=0..1), Slider(0.03, range=0..1), Slider(0.98, range=0..1)])
c_script_2 = CSharpScript(Genes=panel_6)  # -> Out, PosXList, PosYList, RatioList, RotationList; disabled

# ----
# 曲线渲染
toggle = BooleanToggle(True)  # disabled
crv_2 = Curve(buildinggenerator_3.offShape)
宽度 = Slider(3, range=0..20)
c_script_3 = CSharpScript(curve=crv_2, thickness=宽度, ifSolidLine=toggle, color=ColourSwatch(SwatchColor=RGB(85, 170, 81)))  # -> out, A; inputs curve: list of Curve, thickness: Int32, ifSolidLine: Boolean, color: Color; disabled
# ---------- c_script_3: C# usings ----------
using System.Drawing;
# ---------- c_script_3: C# ----------
    if (curve == null) return;
    if (color.A == 0) return;
    for (int i = 0; i < curve.Count; i++)
    {
      _curves.Add(curve[i]);
    }
    _color = color;
    _thickness = thickness;
# ---------- c_script_3: C# additional code ----------
  private BoundingBox _box;
  private readonly List<Curve> _curves = new List<Curve>();
  private readonly List<Rhino.Display.DisplayMaterial> _materials = new List<Rhino.Display.DisplayMaterial>();
  public Color _color;
  public int _thickness;
  //private BoundingBox _box;

  /// <summary>
  /// This method will be called once every solution, before any calls to RunScript.
  /// </summary>
  public override void BeforeRunScript()
  {
    _box = BoundingBox.Empty;
    _curves.Clear();
  }

  public override BoundingBox ClippingBox
  {
    get { return _box; }
  }

  public override void DrawViewportWires(IGH_PreviewArgs args)
  {
    for (int i = 0; i < _curves.Count; i++)
    {
      args.Display.DrawCurve(_curves[i], _color, _thickness);
    }
  }
# ---------- end c_script_3 ----------
