# Grasshopper definition 布局v3.gh (Grasshopper 1.0.7)

# ----
# 建筑类型
pt = Point([Point(1.6, 0, 0), Point(1.6, 10, 0), Point(8.45, 10, 0), Point(8.45, 13.5, 0), Point(0, 13.5, 0), Point(0, 23.5, 0), Point(26.1, 23.5, 0), Point(26.1, 13.5, 0), Point(17.65, 13.5, 0), Point(17.65, 10, 0), Point(24.5, 10, 0), Point(24.5, 0, 0), Point(1.6, 0, 0)])
pt_2 = Point([Point(0, 0, 0), Point(0, 70, 0), Point(80, 70, 0), Point(80, 50, 0), Point(20, 50, 0), Point(20, 20, 0), Point(80, 20, 0), Point(80, 0, 0), Point(0, 0, 0)])
pt_3 = Point([Point(0, 0, 0), Point(0, 46.8, 0), Point(45.97, 46.8, 0), Point(45.97, 26.8, 0), Point(21.8, 26.8, 0), Point(21.8, 0, 0), Point(0, 0, 0)])
pt_4 = Point([Point(0, 0, 0), Point(0, 13.75, 0), Point(29.2, 13.75, 0), Point(29.2, 0, 0), Point(0, 0, 0)])
pt_5 = Point([Point(5.4, 0, 0), Point(5.4, 17, 0), Point(0, 17, 0), Point(0, 27.2, 0), Point(28.6, 27.2, 0), Point(28.6, 17, 0), Point(23.2, 17, 0), Point(23.2, 0, 0), Point(5.4, 0, 0)])
工型 = PolyLine(Vertices=pt, Closed=False)
l型 = PolyLine(Vertices=pt_3, Closed=False)
u型 = PolyLine(Vertices=pt_2, Closed=False)
t形 = PolyLine(Vertices=pt_5, Closed=False)
矩形 = PolyLine(Vertices=pt_4, Closed=False)
list = ValueList({"原型": 0, "一梯两户": 500, "一梯三户": 700, "两梯四户": 1800}, selected="一梯两户")
输入建筑 = Curve(矩形)
outbuilding = CSharpScript(houseType=list, buildings_ori=输入建筑)  # -> minArea, buildings; inputs houseType: Int32, buildings_ori: Curve
# ---------- outbuilding: C# ----------
    double minarea = AreaMassProperties.Compute(buildings_ori).Area;
    minArea = minarea;
    if(houseType != 0){
      buildings_ori.Transform(Transform.Scale(AreaMassProperties.Compute(buildings_ori).Centroid, Math.Sqrt(houseType / minarea)));
    }
      buildings = buildings_ori;
# ---------- end outbuilding ----------

pt_6 = Point([Point(32381.66342, 39659.86118, 0), Point(32380.90346, 39663.78832, 0), Point(32375.40508, 39662.7243, 0), Point(32375.69006, 39661.25162, 0), Point(32372.25343, 39660.58659, 0), Point(32371.96845, 39662.05926, 0)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])
pline = PolyLine(Vertices=pt_6, Closed=False)
curve = Curve(<curve referenced from the Rhino model>)
point = Point([Point(17954.84042, 7480.436958, 0), Point(17954.84042, 7481.729502, 0), Point(17960.85083, 7481.729502, 0), Point(17960.87232, 7480.537208, 0), Point(17964.14677, 7480.591632, 0), Point(17964.19403, 7477.748026, 0)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])
pcen = PolygonCenter(Polyline=pline)  # -> CenterV, CenterE, CenterA
polyline = PolyLine(Vertices=point, Closed=True)
area = Area(Geometry=polyline)  # -> Area, Centroid
pln = Plane(pcen.CenterA)
rec = Rectangle([{Plane=PlaneXY(32732.3004, 39594.35953, 0), Size=Domain2(u=-8.619532137..8.619532137, v=-9.850893871..9.850893871)}, {Plane=PlaneXY(32801.25666, 39642.79309, 0), Size=Domain2(u=-10.26134778..10.26134778, v=-9.029986048..9.029986048)}, {Plane=PlaneXY(32888.2694, 39850.94421, 0), Size=Domain2(u=-15.18331026..15.18331026, v=-8.670511821..8.670511821)}])
rotate = Rotate(Geometry=pline, Angle=-0.17, Plane=pln)  # -> Geometry, Transform

# ----
# 控制性约束条件
限高 = Slider(108, range=0..210)
退线距离 = Slider(0.1, range=0..10)
边界范围 = Curve(curve)
建筑密度 = CSharpScript(min=Slider(0.15, range=0..1), max=Slider(0.3, range=0..1))  # -> density; inputs min: Double, max: Double
# ---------- 建筑密度: C# ----------
    if(max >= min){
      List<double> temp = new List<double>();
      temp.Add(min);
      temp.Add(max);
      density = temp;
    }
# ---------- end 建筑密度 ----------
容积率 = CSharpScript(min=Slider(2.8, range=0..6), max=Slider(3.5, range=0..6))  # -> plotRatio; inputs min: Double, max: Double
# ---------- 容积率: C# ----------
    if(max >= min){
      List<double> temp = new List<double>();
      temp.Add(min);
      temp.Add(max);
      plotRatio = temp;
    }
# ---------- end 容积率 ----------

crv = Curve(rotate.Geometry)

# ----
# 运行
boolean_toggle = BooleanToggle(True)
c_script = CSharpScript(ACTIVE=boolean_toggle)  # -> X; inputs ACTIVE: Boolean
# ---------- c_script: C# ----------
    _active = ACTIVE;
    string message = "";
    GrasshopperDocument.ScheduleSolution(5, Callback);
    if(ACTIVE){
      message = "\r\n程序处于运行状态，请稍等。提示：文件保存前，请勿必双击按钮恢复为停止状态！";
    }
    else{
      message = "\r\n程序处于停止状态。提示：可修改参数后，双击按钮运行程序！";
    }
    X = message;
# ---------- c_script: C# additional code ----------
  private bool _active;
  private void Callback(GH_Document doc)
  {
    foreach(var obj in GrasshopperDocument.ActiveObjects())
      if("buildingGenerator" == obj.NickName)
      {
        obj.Locked = !_active;
        obj.ExpireSolution(false);
      }
  }
# ---------- end c_script ----------
panel = Panel(c_script)

cp = ControlPoints(Curve=crv)  # -> Points, Weights, Knots
area_2 = Area(Geometry=crv)  # -> Area, Centroid

# ----
# 个性化设置
list_2 = ValueList({"随机化": strategy1, "建筑密度最大化": strategy2, "容积率最大化": strategy3}, selected="随机化")
楼高 = Slider(3, range=0..5)
朝向 = Slider(0, range=-45..45)
日照比例 = Slider(0.6, range=0.5..1)
缩放因子 = Slider(1, range=0..1)
静态建筑 = Curve(<curve referenced from the Rhino model>)
建筑轮廓 = Curve(outbuilding.buildings)
最小建筑面积 = Number(outbuilding.minArea)

buildinggenerator = CSharpScript(
    strategy=list_2,
    boundary=边界范围,
    offDist=退线距离,
    build_steady=静态建筑,
    shape_type=建筑轮廓,
    floor_height=楼高,
    direction=朝向,
    shadow_ratio=日照比例,
    density=建筑密度,
    plotRatio=容积率,
    height_limit=限高,
    area_limit=最小建筑面积,
    scale_factor=缩放因子,
    active=c_script)  # -> X, buildings, offShape, height, message, tips; inputs strategy: String, boundary: Curve, offDist: Double, build_steady: list of Curve, shape_type: Curve, floor_height: Double, direction: Int32, shadow_ratio: Double, density: list of Double, plotRatio: list of Double, height_limit: Double, area_limit: Double, scale_factor: Double, active: String; disabled
# ---------- buildinggenerator: C# ----------
    //======初始化======
    com_void = new Common_void();
    string warning = "";

    double density_min = density_[0];
    double density_max = density_[1];
    double plotRatio_min = plotRatio_[0];
    double plotRatio_max = plotRatio_[1];
    int floor_num;
    int floor_max = (int) (height_limit / floor_height);
    bool run = false;
    //计算场地面积
    if(offDist > 0){
      boundary = boundary.Offset(Plane.WorldXY, -1 * offDist, 0.000001, Rhino.Geometry.CurveOffsetCornerStyle.Sharp)[0];
    }
    double boundaryArea = AreaMassProperties.Compute(boundary).Area;
    double shape_area = AreaMassProperties.Compute(shape_type).Area;

    //建筑密度计算智能体个数范围
    double area_scale = shape_area;
    double area_min = shape_area;
    int scale_dnum = 0;
    if(scale_factor != 1){
      while(area_scale >= area_limit){
        area_scale = area_scale * scale_factor * scale_factor;
        scale_dnum += 1;
      }
      area_min = area_scale * 1 / (scale_factor * scale_factor);
      scale_dnum -= 1;
    }


    int build_num_dmin = (int) Math.Ceiling(boundaryArea * density_min / shape_area);
    int build_num_dmax = (int) (boundaryArea * density_max / (area_min));
    //容积率计算智能体个数范围
    int build_num_pmin = (int) Math.Ceiling(plotRatio_min * boundaryArea / (shape_area * floor_max));
    //int build_num_pmax = (int) (plotRatio_max * boundaryArea / (area_min * floor_min));
    //综合计算智能体个数范围
    int build_num_min,build_num_max = 0;
    if(build_num_dmin > build_num_pmin){
      build_num_min = build_num_dmin;}
    else{
      build_num_min = build_num_pmin;
    }
    build_num_max = build_num_dmax;
    //if(build_num_dmax > build_num_pmax){
    //build_num_max = build_num_pmax;}
    //else{
    //build_num_max = build_num_dmax;
    //}
    //生成随机智能体个数
    Random rd = new Random();
    int build_num;
    if(strategy == "strategy1"){
      build_num = rd.Next(build_num_min, build_num_max);
      floor_num = rd.Next((int) (plotRatio_min * boundaryArea / (shape_area * build_num)), floor_max);
    }
    else if(strategy == "strategy2"){
      build_num = build_num_max;
      floor_num = floor_max;
    }
    else{
      build_num = build_num_min;
      floor_num = floor_max;
    }

    //int build_num = build_num_dmax;
    //floor_num = (int) plotRatio_max * boundaryArea / (shape_area * build_num);
    //if(floor_num * floor_height > floor_limit){
    //floor_num = (int) (floor_limit / floor_height);
    //}

    List<double> tt = new List<double>();
    //生成相应个数的随机点与基于模板的建筑图形
    List<Point3d> randomPoints = com_void.GetRandomPoints(build_num, boundary);
    List< Curve> shape_types = new List<Curve>();
    shape_types = com_void.RepeatCurve(build_num, shape_type);
    //创建智能体
    bs = new List<Building>();
    for(int i = 0; i < build_num; i++){
      Building b = new Building(boundary, build_steady, randomPoints[i], shape_types[i], floor_height, floor_num, scale_dnum, direction, shadow_ratio);
      bs.Add(b);
    }
    int sign = bs.Count - 1;
    double density = double.MinValue;
    double plotRatio = double.MinValue;
    double count = 0;
    double totalOverlap = double.MaxValue;
    bool ifFloorLimit = false;
    bool ifLimit = false;
    bool ifChangeScale,ifScaleLimit;
    List<int> seq = new List<int>();
    List<int> seq_F = new List<int>();
    if (scale_dnum == 0){
      ifChangeScale = false;
      ifScaleLimit = true;
    }
    else{
      ifChangeScale = true;
      ifScaleLimit = false;
    }
    List<double> kk = new List<double>();
    //======运行======
    while(!(totalOverlap <= 0 && density >= density_min && density <= density_max && plotRatio >= plotRatio_min && plotRatio <= plotRatio_max)){
      totalOverlap = 0;
      //迭代次数大于100时，迭代次数为智能体个数时对最不符合要求的建筑缩小
      if(ifChangeScale && ifScaleLimit == false){
        if(count > 50 && count % 15 == 0){
          //索引
          seq.Clear();
          seq = new List<int>();
          for(int i = 0;i < bs.Count ;i++){
            //计算各智能体不符合要求的面积总和——>逾越场地边界的面积及其与其他智能体缓冲区内的总重叠面积
            bs[i].UpdateOverlap(bs);
            //获取缩小未完全达到限制的智能体索引
            if(bs[i].alimit != true){
              seq.Add(i);
            }
          }
          if(seq.Count == 0){
            ifScaleLimit = true;
          }
          else{
            //获取总面积从大到小的相应索引
            int temp = 0;
            for(int i = 0;i < seq.Count - 1;i++){
              for(int j = 0;j < seq.Count - i - 1;j++){
                if(bs[seq[j]].overlapArea < bs[seq[j + 1]].overlapArea){
                  temp = seq[j];
                  seq[j] = seq[j + 1];
                  seq[j + 1] = temp;
                }
              }
            }
            //缩小直至碰到一个可缩小的智能体，则退出循环
            for(int i = 0;i < seq.Count;i++){
              bool bool_atemp = bs[seq[i]].Narrow(scale_factor);
              if(bool_atemp)
                break;
            }
            //清空各智能体的存储数据——>不符合要求的面积总和
            for(int i = 0;i < bs.Count ;i++){
              bs[i].ClearOverlapArea();
            }
          }
        }
      }
      //统一降低楼层
      if(ifScaleLimit == true && ifFloorLimit == false){
        if(count > 50 && count % 15 == 0){
          if( bs[0].floor_num - 1 >= (int) (plotRatio_min * boundaryArea / (AreaMassProperties.Compute(bs[0].shape).Area * build_num))){
            for(int i = 0;i < bs.Count;i++){
              bs[i].floor_num -= 1;
              bs[i].offShape = bs[i].CreateBuffer(bs[i].shape, bs[i].floor_height * bs[i].floor_num);
            }
          }
          else{
            ifFloorLimit = true;
          }
        }
      }
      for(int i = 0;i < bs.Count;i++){
        //计算场地边界对出界智能体的动量
        bs[i].CheckEdge();
        //根据该智能体与其他智能体的缓冲边界内的重叠情况，计算动量
        for(int j = i+1; j < bs.Count; j++){
          if(i != j){
            bs[i].Seperate(bs[j]);
          }
        }
        //根据动量更新智能体位置
        bs[i].Update();
        //清空各智能体的存储数据——>不符合要求的面积总和
        bs[i].ClearOverlapArea();
      }

      totalOverlap = com_void.CheckOverlap_bs(bs);
      count++;
      if(count == 100 && totalOverlap > 0 && ifLimit){
        build_num = bs.Count - 1;
        bs.Clear();
        shape_types.Clear();
        randomPoints.Clear();
        randomPoints = com_void.GetRandomPoints(build_num, boundary);
        shape_types = com_void.RepeatCurve(build_num, shape_type);
        for(int i = 0; i < build_num; i++){
          Building b = new Building(boundary, build_steady, randomPoints[i], shape_types[i], floor_height, floor_num, scale_dnum, direction, shadow_ratio);
          bs.Add(b);
        }
        //直接进入下一次循环
        ifScaleLimit = !ifChangeScale;
        ifFloorLimit = false;
        totalOverlap = double.MaxValue;
        count = 0;
        tt.Add(77);
        continue;
        //break;
      }
      //计算建筑密度与容积率
      double value_atemp = 0;
      double value_ftemp = 0;
      for(int i = 0;i < bs.Count;i++)
      {
        value_atemp += AreaMassProperties.Compute(bs[i].shape).Area;
        value_ftemp += bs[i].floor_num * AreaMassProperties.Compute(bs[i].shape).Area;
      }
      density = value_atemp / boundaryArea;
      plotRatio = value_ftemp / boundaryArea;

      //缩小到极致以及最低楼层仍无法拟合
      if(totalOverlap > 0 && ifScaleLimit == true && ifFloorLimit == true){
        build_num = bs.Count - 1;
        tt.Add(bs[0].floor_num);
        bs.Clear();
        shape_types.Clear();
        randomPoints.Clear();
        randomPoints = com_void.GetRandomPoints(build_num, boundary);
        shape_types = com_void.RepeatCurve(build_num, shape_type);
        for(int i = 0; i < build_num; i++){
          Building b = new Building(boundary, build_steady, randomPoints[i], shape_types[i], floor_height, floor_num, scale_dnum, direction, shadow_ratio);
          bs.Add(b);
        }
        //直接进入下一次循环
        ifScaleLimit = !ifChangeScale;
        ifFloorLimit = false;
        totalOverlap = double.MaxValue;
        tt.Add(count);
        count = 0;
        tt.Add(11);
        continue;
        //break;
      }

      //拟合失败，且面积与楼层缩小到极致
      if(totalOverlap > 0 && ifScaleLimit == true && ifFloorLimit == true){
        build_num = bs.Count - 1;
        //超出范围，退出循环
        if(build_num > build_num_max || build_num < build_num_min){
          run = false;
          warning = "拟合失败1，原因可能是参数无法满足拟合，请适当放宽参数";
          break;
        }
        bs.Clear();
        shape_types.Clear();
        randomPoints.Clear();
        randomPoints = com_void.GetRandomPoints(build_num, boundary);
        shape_types = com_void.RepeatCurve(build_num, shape_type);
        for(int i = 0; i < build_num; i++){
          Building b = new Building(boundary, build_steady, randomPoints[i], shape_types[i], floor_height, floor_num, scale_dnum, direction, shadow_ratio);
          bs.Add(b);
        }
        //直接进入下一次循环
        ifScaleLimit = !ifChangeScale;
        ifFloorLimit = false;
        ifLimit = false;
        totalOverlap = double.MaxValue;
        count = 0;
        tt.Add(22);
        continue;
        //break;
      }
        //拟合成功
      else if(totalOverlap <= 0){
        //建筑密度小于下限
        if(density < density_min){
          build_num = bs.Count + 1;
          //超出范围，退出循环
          if(build_num > build_num_max || build_num < build_num_min){
            run = false;
            warning = "拟合失败2，原因可能是参数无法满足拟合，请适当放宽参数";
            break;
          }
          bs.Clear();
          shape_types.Clear();
          randomPoints.Clear();
          randomPoints = com_void.GetRandomPoints(build_num, boundary);
          shape_types = com_void.RepeatCurve(build_num, shape_type);
          for(int i = 0; i < build_num; i++){
            Building b = new Building(boundary, build_steady, randomPoints[i], shape_types[i], floor_height, floor_num, scale_dnum, direction, shadow_ratio);
            bs.Add(b);
          }
          //直接进入下一次循环
          ifScaleLimit = !ifChangeScale;
          ifFloorLimit = false;
          ifLimit = false;
          totalOverlap = double.MaxValue;
          count = 0;
          tt.Add(33);
          continue;
          //break;
        }
          //建筑密度符合要求，则对容积率开始拟合
        else{
          //容积率不在范围内
          if(plotRatio > plotRatio_max || plotRatio < plotRatio_min){
            seq.Clear();
            seq = new List<int>();
            for(int i = 0;i < bs.Count ;i++){
              seq.Add(i);
            }
            //获取从北到南的相应索引
            int temp = 0;
            for(int i = 0;i < seq.Count - 1;i++){
              for(int j = 0;j < seq.Count - i - 1;j++){
                if(bs[seq[j]].pos.Y < bs[seq[j + 1]].pos.Y){
                  temp = seq[j];
                  seq[j] = seq[j + 1];
                  seq[j + 1] = temp;
                }
              }
            }
            //容积率大于上限
            if(plotRatio > plotRatio_max){
              tt.Add(bs[0].floor_num);
              int j = bs.Count - 1;
              while(value_ftemp > plotRatio_max * boundaryArea){
                if (bs[seq[j]].floor_num - 1 == 0){
                  break;
                }
                bs[seq[j]].floor_num -= 1;
                value_ftemp -= AreaMassProperties.Compute(bs[seq[j]].shape).Area;
                j--;
                if(j == -1){
                  j += bs.Count;
                }
              }
              //在范围内对楼层向下调整后，可使容积率拟合
              if(value_ftemp <= plotRatio_max * boundaryArea){
                ifScaleLimit = true;
                ifFloorLimit = true;
                totalOverlap = double.MaxValue;
                count = 0;
                for(int i = 0;i < bs.Count;i++){
                  bs[i].offShape = bs[i].CreateBuffer(bs[i].shape, bs[i].floor_height * bs[i].floor_num);
                }
                tt.Add(44);
                continue;
                //break;
              }
                //楼层调至最低仍无法拟合容积率
              else{
                //减少智能体个数
                build_num = bs.Count - 1;
              }
            }
              //容积率小于下限
            else{
              int j = 0;
              tt.Add(bs[0].floor_num);
              tt.Add(value_ftemp);
              while(value_ftemp < plotRatio_min * boundaryArea){
                if(bs[seq[j]].floor_num + 1 > floor_max){
                  break;
                }
                bs[seq[j]].floor_num += 1;
                value_ftemp += AreaMassProperties.Compute(bs[seq[j]].shape).Area;
                j++;
                if(j == bs.Count){
                  j -= bs.Count;
                }
              }
              //在范围内对楼层向上调整后，可使容积率拟合
              tt.Add(value_ftemp);
              tt.Add(plotRatio_min * boundaryArea);
              if(value_ftemp >= plotRatio_min * boundaryArea){
                if(ifScaleLimit == true){
                  build_num = bs.Count - 1;
                }
                else{
                  ifFloorLimit = true;
                  ifLimit = true;
                  totalOverlap = double.MaxValue;
                  count = 0;
                  for(int i = 0;i < bs.Count;i++){
                    bs[i].offShape = bs[i].CreateBuffer(bs[i].shape, bs[i].floor_height * bs[i].floor_num);
                  }
                  tt.Add(55);
                  continue;
                  //break;
                }
              }
                //楼层调至最高仍无法拟合容积率
              else{
                //增加智能体个数
                build_num = bs.Count + 1;
              }
            }
          }
            //容积率在范围内
          else{
            tt.Add(99);
            run = true;
            warning = "拟合成功";
            break;
          }
          //超出范围，退出循环
          if(build_num > build_num_max || build_num < build_num_min){
            run = false;
            warning = "拟合失败3，原因可能是参数无法满足拟合，请适当放宽参数";
            break;
          }
            //在范围内，且智能体个数需要改变
          else if(build_num != bs.Count){
            bs.Clear();
            shape_types.Clear();
            randomPoints.Clear();
            randomPoints = com_void.GetRandomPoints(build_num, boundary);
            shape_types = com_void.RepeatCurve(build_num, shape_type);
            for(int i = 0; i < build_num; i++){
              Building b = new Building(boundary, build_steady, randomPoints[i], shape_types[i], floor_height, floor_num, scale_dnum, direction, shadow_ratio);
              bs.Add(b);
            }
            //直接进入下一次循环
            ifScaleLimit = !ifChangeScale;
            ifFloorLimit = false;
            ifLimit = false;
            totalOverlap = double.MaxValue;
            count = 0;
            tt.Add(66);
            continue;
            //break;
          }
        }
      }
    }

    //====输出=====
    footPrint = new List<Curve>();
    offSet = new List<Curve>();
    height_list = new List<double>();




    for(int i = 0; i < bs.Count; i++){
      footPrint.Add(bs[i].shape);
      offSet.Add(bs[i].offShape);
      tt.Add(AreaMassProperties.Compute(bs[i].shape).Area);
      tt.Add(bs[i].floor_num);
      height_list.Add(floor_height * bs[i].floor_num);
    }
    buildings = footPrint;
    offShape = offSet;
    height = height_list;

    //计算建筑密度与容积率
    double value_atemp1 = 0;
    double value_ftemp1 = 0;
    for(int i = 0;i < bs.Count;i++)
    {
      value_atemp1 += AreaMassProperties.Compute(bs[i].shape).Area;
      value_ftemp1 += bs[i].floor_num * AreaMassProperties.Compute(bs[i].shape).Area;
    }
    density = value_atemp1 / boundaryArea;
    plotRatio = value_ftemp1 / boundaryArea;
    tt.Add(build_num);
    tt.Add(density);
    tt.Add(plotRatio);
    tt.Add(com_void.CheckOverlap_bs(bs));
    message = tt;
    tips = warning;

    other = new List<double>();
    other.Add(floor_height);
    other.Add(direction);
    other.Add(shadow_ratio);
    X = other;
# ---------- buildinggenerator: C# additional code ----------
  //全局变量
  List<Building> bs;
  Common_void com_void;
  List<Curve> footPrint;
  List<Curve> offSet;
  List<double> height_list;
  List<double> other;


  //以下为构建建筑单体智能体代码
  public class Building{
    public Curve boundary;
    public List<Curve> build_steady;
    public Point3d pos;
    public Curve shape;
    public double floor_height;
    public int floor_num;
    public int scale_dnum;
    public double shadow_ratio;

    public int direction;
    public Point3d siteCenter;
    public Curve offShape;
    public Vector3d move;

    public double overlapArea;
    public bool alimit;
    public Random rand;

    public Building(Curve boundary_, List<Curve> build_steady_, Point3d pos_, Curve shape_, double floor_height_, int floor_num_, int scale_dnum_, int direction_, double shadow_ratio_){

      pos = new Point3d();
      floor_height = new double();
      floor_num = new int();
      scale_dnum = new int();
      boundary = boundary_;
      build_steady = build_steady_;
      pos = pos_;
      shape = shape_;
      floor_height = floor_height_;
      floor_num = floor_num_;
      scale_dnum = scale_dnum_;
      direction = direction_;
      shadow_ratio = shadow_ratio_;


      siteCenter = GetCenter(boundary);
      Point3d center = AreaMassProperties.Compute(shape).Centroid;
      shape.Translate(new Vector3d(pos.X - center.X, pos.Y - center.Y, 0));
      //旋转图形
      shape = RotateCurve(shape, -1 * direction * Math.PI / 180, new Plane(AreaMassProperties.Compute(shape).Centroid, new Vector3d(0, 0, 1)));
      offShape = CreateBuffer(shape, floor_height * floor_num);

      overlapArea = 0;
      if(scale_dnum > 0){
        alimit = false;
      }
      else{alimit = true;}
      rand = new Random();

    }

    //计算图形几何中心
    private Point3d GetCenter(Curve c){
      Point3d center = AreaMassProperties.Compute(c).Centroid;
      return center;
    }

    //清空各智能体的存储数据——>不符合要求的面积总和
    public void ClearOverlapArea(){
      overlapArea = 0;
    }

    //计算各智能体楼层数&&创建缓冲
    public void CalculateHeight(){
      offShape = CreateBuffer(shape, floor_height * floor_num);
    }


    //创建缓冲
    public Curve CreateBuffer(Curve x, double y)
    {
      //摆正图形
      x = RotateCurve(x, direction * Math.PI / 180, new Plane(AreaMassProperties.Compute(x).Centroid, new Vector3d(0, 0, 1)));
      List<Point3d> points_o = new List<Point3d>();
      List<Point3d> points_c1 = new List<Point3d>();
      List<Point3d> points_c2 = new List<Point3d>();
      int points_num = x.ToNurbsCurve().Points.Count;
      for (int i = 0;i < points_num;i++)
      {
        Point3d temp = new Point3d();
        x.ToNurbsCurve().Points.GetPoint(i, out temp);
        points_o.Add(temp);
        points_c1.Add(temp);
        points_c2.Add(temp);
      }
      Point3d point_judge = AreaMassProperties.Compute(x).Centroid;
      //计算东南西北侧方向上的缓冲距离
      double distance_N,distance_E,distance_W,distance;
      //if(0.3 * (y+20)< 6){
      //distance_E = distance_W = 6;
      //}
      //else{
      //distance_E = distance_W = 0.3 * 30 + 0.1 * y - 30 * 0.1;
      //}
      distance_E = distance_W = 0.3 * (y + 20);
      double sinHs = Math.Sin(Math.PI / 180 * 23) * Math.Sin(Math.PI / 180 * -23.5) + Math.Cos(Math.PI / 180 * 23) * Math.Cos(Math.PI / 180 * -23.5) * Math.Cos(0);
      double L = Math.Sqrt((y / sinHs) * (y / sinHs) - y * y);
      distance_N = L;
      distance_N = shadow_ratio * y;
      /*
      //找出最北面的边的长度
      List<Point3d> point_n = new List<Point3d>();
      point_n.Add(points_o[0]);
      point_n.Add(points_o[1]);
      for (int i = 0;i < points_num - 1;i++){
        //南北侧
        if(Math.Abs(points_o[i + 1].X - points_o[i].X) > Math.Abs(points_o[i + 1].Y - points_o[i].Y))
        {
          //北侧
          if((points_o[i + 1].X - points_o[i].X) > 0)
          {
            if((points_o[i + 1].Y + points_o[i].Y) > (point_n[0].Y + point_n[1].Y))
            {
              point_n.RemoveAt(1);
              point_n.RemoveAt(0);
              point_n.Add(points_o[i]);
              point_n.Add(points_o[i + 1]);
            }
          }
        }
      }
      */
      //图形均基于顺时针构建，因而可根据两点所形成的矢量方向，判断需要构建哪一方向的缓冲，最后用两点位置的移动进行缓冲的构建
      for (int i = 0;i < points_num - 1;i++){
        int[] i_list = new int[6];
        int temp_0 = i - 2;
        for(int j = 0;j < 6;j++){
          i_list[j] = temp_0;
          temp_0 += 1;
        }
        for(int j = 0;j < 6;j++){
          if(i_list[j] < 0){
            i_list[j] = i_list[j] + points_num - 1;
          }
          if(i_list[j] >= points_num - 1){
            i_list[j] = i_list[j] - points_num + 1;
          }
        }
        distance = 0;
        if(JudgeDirection(points_o[i_list[3]], points_o[i_list[2]]) == "西"){
          if((points_o[i_list[2]].X + points_o[i_list[3]].X) / 2 < pos.X){
            distance = distance_W;/*
            if(JudgeDirection(points_o[i_list[4]], points_o[i_list[3]]) == "南"){
            if(JudgeDirection(points_o[i_list[5]], points_o[i_list[4]]) == "东"){
            distance = 0;
            }
            }
            if(JudgeDirection(points_o[i_list[2]], points_o[i_list[1]]) == "北"){
            if(JudgeDirection(points_o[i_list[1]], points_o[i_list[0]]) == "东"){
            distance = 0;
            }
            }
            */
          }

        }
        else if(JudgeDirection(points_o[i_list[3]], points_o[i_list[2]]) == "东"){
          if((points_o[i_list[2]].X + points_o[i_list[3]].X) / 2 > pos.X){
            distance = distance_E;
            /*
            if(JudgeDirection(points_o[i_list[4]], points_o[i_list[3]]) == "北"){
              if(JudgeDirection(points_o[i_list[5]], points_o[i_list[4]]) == "西"){
                distance = 0;
              }
            }
            if(JudgeDirection(points_o[i_list[2]], points_o[i_list[1]]) == "南"){
              if(JudgeDirection(points_o[i_list[1]], points_o[i_list[0]]) == "西"){
                distance = 0;
              }
            }
      */
          }
        }
        else if(JudgeDirection(points_o[i_list[3]], points_o[i_list[2]]) == "南"){
          if((points_o[i_list[2]].Y + points_o[i_list[3]].Y) / 2 < pos.Y){
            distance = 8;
          }
        }
        else if(JudgeDirection(points_o[i_list[3]], points_o[i_list[2]]) == "北"){
          if((points_o[i_list[2]].Y + points_o[i_list[3]].Y) / 2 > pos.Y){
            distance = distance_N;
          }
        }
        //线中心
        Point3d line_center = new Point3d((points_o[i + 1].X + points_o[i].X) / 2, (points_o[i + 1].Y + points_o[i].Y) / 2, 0);
        //两点成线
        List<Point3d> line_p = new List<Point3d>();
        line_p.Add(points_o[i]);
        line_p.Add(points_o[i + 1]);
        Curve line = new Polyline(line_p).ToNurbsCurve();
        //旋转90度
        Curve line_cz = RotateCurve(line, 0.5 * Math.PI, new Plane(line_center, new Vector3d(0, 0, 1)));
        //单位化
        Vector3d vec = Point3d.Subtract(line_cz.PointAtEnd, line_cz.PointAtStart);
        vec.Unitize();
        //移动
        line.Translate(distance * vec);
        Point3d temp;
        //写入点
        if(JudgeDirection(points_o[i_list[3]], points_o[i_list[2]]) == "西" || JudgeDirection(points_o[i_list[3]], points_o[i_list[2]]) == "东"){
          //东西侧
          temp = new Point3d(line.PointAtStart.X, points_c1[i].Y, points_c1[i].Z);
          points_c1.RemoveAt(i);
          points_c1.Insert(i, temp);
          temp = new Point3d(line.PointAtEnd.X, points_c1[i + 1].Y, points_c1[i + 1].Z);
          points_c1.RemoveAt(i + 1);
          points_c1.Insert(i + 1, temp);

        }
        else if(JudgeDirection(points_o[i_list[3]], points_o[i_list[2]]) == "南"){
          //南侧
          temp = new Point3d(points_c1[i].X, line.PointAtStart.Y, points_c1[i].Z);
          points_c1.RemoveAt(i);
          points_c1.Insert(i, temp);
          temp = new Point3d(points_c1[i + 1].X, line.PointAtEnd.Y, points_c1[i + 1].Z);
          points_c1.RemoveAt(i + 1);
          points_c1.Insert(i + 1, temp);
        }
        else if(JudgeDirection(points_o[i_list[3]], points_o[i_list[2]]) == "北"){
          //北侧
          temp = new Point3d(points_c2[i].X, line.PointAtStart.Y, points_c2[i].Z);
          points_c2.RemoveAt(i);
          points_c2.Insert(i, temp);
          temp = new Point3d(points_c2[i + 1].X, line.PointAtEnd.Y, points_c2[i + 1].Z);
          points_c2.RemoveAt(i + 1);
          points_c2.Insert(i + 1, temp);
        }
      }
      //计算一个新的重合点，因为建筑轮廓上第一个点与最后一个点重合，构建缓冲后不重合
      double temp_x,temp_y;
      if(points_o[0].X == points_c1[0].X)
      {
        temp_x = points_c1[points_num - 1].X;
        temp_y = points_c1[0].Y;
      }
      else
      {
        temp_x = points_c1[0].X;
        temp_y = points_c1[points_num - 1].Y;
      }
      Point3d point_orignal = new Point3d(temp_x, temp_y, points_c1[0].Z);
      //重合点替换第一点
      points_c1.RemoveAt(0);
      points_c1.Insert(0, point_orignal);
      //重合点替换最后一点
      points_c1.RemoveAt(points_num - 1);
      points_c1.Insert(points_num - 1, point_orignal);
      Curve buffer1 = new Polyline(points_c1).ToNurbsCurve();
      /*
      if(points_o[0].X == points_c2[0].X)
      {
        temp_x = points_c2[points_num - 1].X;
        temp_y = points_c2[0].Y;
      }
      else
      {
        temp_x = points_c2[0].X;
        temp_y = points_c2[points_num - 1].Y;
      }
      */
      temp_x = points_c2[0].X;
      if(points_c2[0].Y > points_c2[points_num - 1].Y){
        temp_y = points_c2[0].Y;
      }
      else{
        temp_y = points_c2[points_num - 1].Y;
      }
      point_orignal = new Point3d(temp_x, temp_y, points_c2[0].Z);
      points_c2.RemoveAt(0);
      points_c2.Insert(0, point_orignal);
      points_c2.RemoveAt(points_num - 1);
      points_c2.Insert(points_num - 1, point_orignal);
      Curve buffer2 = new Polyline(points_c2).ToNurbsCurve();
      List<Curve> buffer0 = new List<Curve>();
      buffer0.Add(buffer1);
      buffer0.Add(buffer2);
      Curve buffer = Curve.CreateBooleanUnion(buffer0)[0];
      //旋转图形
      buffer = RotateCurve(buffer, -1 * direction * Math.PI / 180, new Plane(AreaMassProperties.Compute(buffer).Centroid, new Vector3d(0, 0, 1)));
      return buffer;
    }
    public Curve RotateCurve(Curve x, double angle, Plane p){
      var func_info = Rhino.NodeInCode.Components.FindComponent("Rotate");
      var func = func_info.Delegate as dynamic;
      var result = func(x, angle, p);
      List<Curve> curve_return = new List<Curve>();
      foreach (var temppp in result[0])
      {
        curve_return.Add((Curve) temppp);
      }
      return curve_return[0];
    }

    public string JudgeDirection(Point3d x1, Point3d x0){
      string direction = "";
      if(Math.Abs(x1.X - x0.X) > Math.Abs(x1.Y - x0.Y)){
        //北侧
        if((x1.X - x0.X) > 0){
          direction = "北";
        }
          //南侧
        else{
          direction = "南";
        }
      }
      else
      {
        //东侧
        if((x1.Y - x0.Y) < 0){
          direction = "东";
        }
          //西侧
        else{
          direction = "西";
        }
      }
      return direction;
    }

    //避免中心点重叠
    public void Overlap(List < Building > buildings){
      Vector3d randMove = new Vector3d(0, 0, 0);
      for(int i = 0; i < buildings.Count; i++){
        Building b = buildings[i];
        if(b != this && pos == b.pos){
          double randDir = Math.PI * rand.NextDouble();
          double bArea = AreaMassProperties.Compute(b.offShape).Area; //面积越大移动越远
          randMove = new Vector3d(Math.Cos(randDir) * bArea * 0.005, Math.Sin(randDir) * bArea * 0.005, 0);
          break;
        }
      }
      pos = Point3d.Add(pos, randMove);
      shape.Translate(randMove);
      offShape.Translate(randMove);
    }

    //计算场地边界对出界智能体的动量,以及静止建筑对重合智能体的动量
    public void CheckEdge(){
      Curve[] differC = Curve.CreateBooleanDifference(shape, boundary, 0.000001);
      if(differC.Length != 0){
        Vector3d pushBack = new Vector3d();
        for (int i = 0; i < differC.Length; i++){
          overlapArea += AreaMassProperties.Compute(differC[i]).Area;
          Point3d subCenter = GetCenter(differC[i]);
          Vector3d push = Point3d.Subtract(siteCenter, subCenter);
          pushBack = Vector3d.Add(pushBack, push);
        }
        pushBack = Vector3d.Multiply(pushBack, 2.5 / pushBack.Length);
        move += pushBack;
      }
      for(int i = 0;i < build_steady.Count;i++){
        Curve[] intersecs = Curve.CreateBooleanIntersection(shape, build_steady[i], 0.000001);
        double overlap = 0;
        if(intersecs.Length != 0){
          for (int j = 0; j < intersecs.Length; j++){
            overlap += AreaMassProperties.Compute(intersecs[j]).Area;
            Point3d interCenter = GetCenter(intersecs[j]);
            Vector3d pi = Point3d.Subtract(pos, interCenter);
            if(pi.Length == 0){
              pi = Point3d.Subtract(pos, GetCenter(build_steady[i]));
            }
            double dist = pos.DistanceTo(GetCenter(build_steady[i]));
            pi = Vector3d.Multiply(pi, 4 / dist);
            move = Vector3d.Add(move, Vector3d.Multiply(pi, 0.5));
          }
        }
      }
    }
    //计算静止建筑对重合智能体的动量
    public void CheckSteadyBuild(){
      for(int i = 0;i < build_steady.Count;i++){
        Curve[] intersecs = Curve.CreateBooleanIntersection(shape, build_steady[i], 0.000001);
        double overlap = 0;
        if(intersecs.Length != 0){
          for (int j = 0; j < intersecs.Length; j++){
            overlap += AreaMassProperties.Compute(intersecs[j]).Area;
            Point3d interCenter = GetCenter(intersecs[j]);
            Vector3d pi = Point3d.Subtract(pos, interCenter);
            if(pi.Length == 0){
              pi = Point3d.Subtract(pos, GetCenter(build_steady[i]));
            }
            double dist = pos.DistanceTo(GetCenter(build_steady[i]));
            pi = Vector3d.Multiply(pi, 4 / dist);
            move = Vector3d.Add(move, Vector3d.Multiply(pi, 0.5));
          }
        }
      }
    }

    //判断该智能体是否与某智能体缓冲区内重叠，若有则两智能体都增加动量
    public void Seperate (Building b){
      double overlap = 0;
      Curve[] intersecs = Curve.CreateBooleanIntersection(shape, b.offShape, 0.000001);
      if(intersecs.Length != 0){
        for (int j = 0; j < intersecs.Length; j++){
          overlap += AreaMassProperties.Compute(intersecs[j]).Area;
          Point3d interCenter = GetCenter(intersecs[j]);
          Vector3d pi = Point3d.Subtract(pos, interCenter);
          Vector3d pj = Point3d.Subtract(GetCenter(b.offShape), interCenter);
          if(pi.Length == 0){
            pi = Point3d.Subtract(pos, b.pos);
            pj = Point3d.Subtract(b.pos, pos);
          }

          double dist = pos.DistanceTo(GetCenter(b.offShape));
          pi = Vector3d.Multiply(pi, 4 / dist);
          pj = Vector3d.Multiply(pj, 4 / dist);
          move = Vector3d.Add(move, Vector3d.Multiply(pi, 0.5));
          b.move = Vector3d.Add(b.move, Vector3d.Multiply(pj, 0.5));
        }
      }
    }

    //根据动量更新智能体位置
    public void Update (){
      pos = Point3d.Add(pos, move);
      shape.Translate(move);
      offShape.Translate(move);
      move = Vector3d.Multiply(move, 0);
    }

    //缩小
    public bool Narrow (double scale_factor){
      if(scale_dnum > 0)
      {
        shape.Transform(Transform.Scale(pos, scale_factor));
        offShape = CreateBuffer(shape, floor_height * floor_num);
        scale_dnum -= 1;
      }
      if(scale_dnum == 0)
      {
        alimit = true;
      }
      return(!alimit);
    }

    //计算各智能体不符合要求面积——>逾越场地边界的面积与其他智能体缓冲区内的重叠面积
    public void UpdateOverlap (List < Building > buildings){
      overlapArea = 0;
      for(int i = 0; i < buildings.Count; i++){
        Building b = buildings[i];
        Curve[] intersecs = Curve.CreateBooleanIntersection(shape, b.offShape, 0.000001);
        if(intersecs.Length != 0){
          for (int j = 0; j < intersecs.Length; j++){
            overlapArea += AreaMassProperties.Compute(intersecs[j]).Area;
          }
        }
      }
      Curve[] differC = Curve.CreateBooleanDifference(shape, boundary, 0.000001);
      if(differC.Length != 0){
        for (int i = 0; i < differC.Length; i++){
          overlapArea += AreaMassProperties.Compute(differC[i]).Area;
        }
      }
      for(int i = 0;i < build_steady.Count;i++){
        Curve[] intersecs = Curve.CreateBooleanIntersection(shape, build_steady[i], 0.000001);
        if(intersecs.Length != 0){
          for (int j = 0; j < intersecs.Length; j++){
            overlapArea += AreaMassProperties.Compute(intersecs[j]).Area;
          }
        }
      }

    }
  }


  //常用方法
  public class Common_void{
    public Common_void(){}

    //计算所有智能体不符合要求面积总和——>逾越场地边界的面积与其他智能体缓冲区内的重叠面积
    public double CheckOverlap_bs (List < Building > bs){
      double totalOverlap = 0;
      for(int i = 0; i < bs.Count; i++){
        for(int j = 0; j < bs.Count; j++){
          if(i != j)
          {
            Curve[] intersecs = Curve.CreateBooleanIntersection(bs[i].shape, bs[j].offShape, 0.000001);
            if(intersecs.Length != 0){
              for (int k = 0; k < intersecs.Length; k++){
                totalOverlap += AreaMassProperties.Compute(intersecs[k]).Area;
              }
            }
          }
        }
        Curve[] differC = Curve.CreateBooleanDifference(bs[i].shape, bs[i].boundary, 0.000001);
        if(differC.Length != 0){
          for (int j = 0; j < differC.Length; j++){
            totalOverlap += AreaMassProperties.Compute(differC[j]).Area;
          }
        }
        for(int j = 0;j < bs[i].build_steady.Count;j++){
          Curve[] intersecs = Curve.CreateBooleanIntersection(bs[i].shape, bs[i].build_steady[j], 0.000001);
          if(intersecs.Length != 0){
            for (int k = 0; k < intersecs.Length; k++){
              totalOverlap += AreaMassProperties.Compute(intersecs[k]).Area;
            }
          }
        }
      }

      return totalOverlap;
    }


    public int GetScaleANum(List < Building > bs)
    {
      int result = 0;
      for(int i = 0;i < bs.Count;i++)
      {
        if(bs[i].alimit == true)
        {
          result += 1;
        }
      }
      return result;
    }
    //Calculate total area of curves
    public double CalculateTotalArea(List < Curve > curve)
    {
      double result = 0;
      for(int i = 0; i < curve.Count; i++)
      {
        result += AreaMassProperties.Compute(curve[i]).Area;
      }
      return result;
    }

    public List<Point3d> GetRandomPoints(int i, Curve curve)
    {
      var func_info = Rhino.NodeInCode.Components.FindComponent("PopulateGeometry");
      var func = func_info.Delegate as dynamic;
      List<Curve> curves = new List<Curve>();
      curves.Add(curve);
      var result = func(Brep.CreatePlanarBreps(curves), i, 1, null);
      List<Point3d> points = new List<Point3d>();
      foreach (var temp in result)
      {
        points.Add((Point3d) temp);
      }
      return points;
    }
    public List<Curve> RepeatCurve(int i, Curve curve)
    {
      var func_info = Rhino.NodeInCode.Components.FindComponent("RepeatData");
      var func = func_info.Delegate as dynamic;
      var result = func(curve, i);

      List<Curve> curves = new List<Curve>();
      foreach (var temp in result)
      {
        curves.Add((Curve) temp);
      }
      return curves;
    }

  }
# ---------- end buildinggenerator ----------
panel_2 = Panel(buildinggenerator.message)
panel_3 = Panel(buildinggenerator.tips)

# ----
# 楼层随机化
boolean_toggle_2 = BooleanToggle(False)
层数 = CSharpScript(min=Slider(1, range=0..50), max=Slider(38, range=0..100))  # -> floor; inputs min: Int32, max: Int32
# ---------- 层数: C# ----------
    if(min<max){
      List<int> temp = new List<int>();
      temp.Add(min);
      temp.Add(max);
      floor = temp;
    }
# ---------- end 层数 ----------
c_script_2 = CSharpScript(
    active=boolean_toggle_2,
    floor=层数,
    boundary=边界范围,
    build_steady=静态建筑,
    X=buildinggenerator.X,
    buildings=buildinggenerator.buildings,
    height=buildinggenerator.height)  # -> B, O, H; inputs active: Boolean, floor: list of Int32, boundary: Curve, build_steady: list of Curve, X: list of Double, buildings: list of Curve, height: list of Double
# ---------- c_script_2: C# ----------
    com_void = new Common_void();
    int floor_min = floor[0];
    int floor_max = floor[1];
    bs = new List<Building>();
    //other.Add(floor_height);
    //other.Add(direction);
    //other.Add(shadow_ratio);
    double floor_height = X[0];
    double direction = X[1];
    double shadow_ratio = X[2];
    for(int i = 0; i < buildings.Count; i++){
      Building b = new Building(boundary, build_steady, AreaMassProperties.Compute(buildings[i]).Centroid, buildings[i], floor_height, (int) (height[i] / floor_height), (int) direction, shadow_ratio);
      bs.Add(b);
    }

    List<int> seqq = new List<int>();
    List<int> seqqq = new List<int>();
    if(active == true){
      //计算平均楼层数量
      int floor_all = 0;
      double area_all = 0;
      for(int i = 0;i < bs.Count;i++){
        floor_all += bs[i].floor_num;
        area_all += bs[i].floor_num * AreaMassProperties.Compute(bs[i].shape).Area;
      }
      if(floor_max >= Math.Ceiling((double) (floor_all / bs.Count))){
        Random rdd = new Random();
        int[] array = new int[bs.Count];
        for(int i = 0;i < bs.Count;i++){
          array[i] = floor_min;
        }
        //随机分配
        int random_value;
        for(int i = 0;i < floor_all - floor_min * bs.Count;i++){
          random_value = rdd.Next(0, bs.Count);
          if(array[random_value] + 1 < floor_max){
            array[random_value] += 1;
          }
          else{
            i--;
          }
        }
        Array.Sort(array);
        Array.Reverse(array);

        for(int i = 0;i < bs.Count ;i++){
          seqq.Add(i);
          seqqq.Add(i);
        }
        //获取从北到南的相应索引
        int temp = 0;
        for(int i = 0;i < seqq.Count - 1;i++){
          for(int j = 0;j < seqq.Count - i - 1;j++){
            if(bs[seqq[j]].pos.Y < bs[seqq[j + 1]].pos.Y){
              temp = seqq[j];
              seqq[j] = seqq[j + 1];
              seqq[j + 1] = temp;
            }
          }
        }
        //分配楼层数量
        for(int i = 0;i < bs.Count;i++){
          bs[seqq[i]].floor_num = array[i];
          bs[i].offShape = bs[i].CreateBuffer(bs[i].shape, bs[i].floor_height * bs[i].floor_num);
        }
        double totalOverlap = double.MaxValue;
        double count = 0;
        while(totalOverlap <= 0){
          totalOverlap = 0;
          for(int i = 0;i < bs.Count;i++){
            //计算场地边界对出界智能体的动量
            bs[i].CheckEdge();
            //根据该智能体与其他智能体的缓冲边界内的重叠情况，计算动量
            for(int j = 0; j < bs.Count; j++){
              if(i != j){
                bs[i].Seperate(bs[j]);
              }
            }
            //根据动量更新智能体位置
            bs[i].Update();
            //清空各智能体的存储数据——>不符合要求的面积总和
            bs[i].ClearOverlapArea();
          }
          totalOverlap = com_void.CheckOverlap_bs(bs);
          count++;

          if(totalOverlap <= 0 || count % 10 == 0){
            //获取从北到南的相应索引
            temp = 0;
            for(int i = 0;i < seqqq.Count - 1;i++){
              for(int j = 0;j < seqqq.Count - i - 1;j++){
                if(bs[seqqq[j]].pos.Y < bs[seqqq[j + 1]].pos.Y){
                  temp = seqqq[j];
                  seqqq[j] = seqqq[j + 1];
                  seqqq[j + 1] = temp;
                }
              }
            }
            //与原索引比较
            bool same = true;
            for(int i = 0;i < bs.Count - 1;i++){
              if(seqq[i] != seqqq[i]){
                same = false;
              }
              seqq[i] = seqqq[i];
            }
            if(same == false){
              for(int i = 0;i < bs.Count;i++){
                bs[seqq[i]].floor_num = array[i];
                bs[i].offShape = bs[i].CreateBuffer(bs[i].shape, bs[i].floor_height * bs[i].floor_num);
              }
              totalOverlap = double.MaxValue;
            }
          }

        }
      }

    }
    //====输出=====
    footPrint = new List<Curve>();
    offSet = new List<Curve>();
    height_list = new List<double>();

    for(int i = 0; i < bs.Count; i++){
      footPrint.Add(bs[i].shape);
      offSet.Add(bs[i].offShape);
      height_list.Add(floor_height * bs[i].floor_num);
    }
    B = footPrint;
    O = offSet;
    H = height_list;
# ---------- c_script_2: C# additional code ----------
  //全局变量
  List<Building> bs;
  Common_void com_void;
  List<Curve> footPrint;
  List<Curve> offSet;
  List<double> height_list;


  //以下为构建建筑单体智能体代码
  public class Building{
    public Curve boundary;
    public List<Curve> build_steady;
    public Point3d pos;
    public Curve shape;
    public double floor_height;
    public int floor_num;
    public double shadow_ratio;

    public int direction;
    public Point3d siteCenter;
    public Curve offShape;
    public Vector3d move;

    public double overlapArea;
    public Random rand;

    public Building(Curve boundary_, List<Curve> build_steady_, Point3d pos_, Curve shape_, double floor_height_, int floor_num_, int direction_, double shadow_ratio_){

      pos = new Point3d();
      floor_height = new double();
      floor_num = new int();
      boundary = boundary_;
      build_steady = build_steady_;
      pos = pos_;
      shape = shape_;
      floor_height = floor_height_;
      floor_num = floor_num_;
      direction = direction_;
      shadow_ratio = shadow_ratio_;


      siteCenter = GetCenter(boundary);
      Point3d center = AreaMassProperties.Compute(shape).Centroid;
      shape.Translate(new Vector3d(pos.X - center.X, pos.Y - center.Y, 0));
      //旋转图形
      shape = RotateCurve(shape, -1 * direction * Math.PI / 180, new Plane(AreaMassProperties.Compute(shape).Centroid, new Vector3d(0, 0, 1)));
      offShape = CreateBuffer(shape, floor_height * floor_num);

      overlapArea = 0;
    }

    //计算图形几何中心
    private Point3d GetCenter(Curve c){
      Point3d center = AreaMassProperties.Compute(c).Centroid;
      return center;
    }

    //清空各智能体的存储数据——>不符合要求的面积总和
    public void ClearOverlapArea(){
      overlapArea = 0;
    }

    //计算各智能体楼层数&&创建缓冲
    public void CalculateHeight(){
      offShape = CreateBuffer(shape, floor_height * floor_num);
    }

    //创建缓冲
    public Curve CreateBuffer(Curve x, double y)
    {
      //摆正图形
      x = RotateCurve(x, direction * Math.PI / 180, new Plane(AreaMassProperties.Compute(x).Centroid, new Vector3d(0, 0, 1)));
      List<Point3d> points_o = new List<Point3d>();
      List<Point3d> points_c1 = new List<Point3d>();
      List<Point3d> points_c2 = new List<Point3d>();
      int points_num = x.ToNurbsCurve().Points.Count;
      for (int i = 0;i < points_num;i++)
      {
        Point3d temp = new Point3d();
        x.ToNurbsCurve().Points.GetPoint(i, out temp);
        points_o.Add(temp);
        points_c1.Add(temp);
        points_c2.Add(temp);
      }
      Point3d point_judge = AreaMassProperties.Compute(x).Centroid;
      //计算东南西北侧方向上的缓冲距离
      double distance_N,distance_E,distance_W,distance;
      //if(0.3 * (y+20)< 6){
      //distance_E = distance_W = 6;
      //}
      //else{
      //distance_E = distance_W = 0.3 * 30 + 0.1 * y - 30 * 0.1;
      //}
      distance_E = distance_W = 0.3 * (y + 20);
      double sinHs = Math.Sin(Math.PI / 180 * 23) * Math.Sin(Math.PI / 180 * -23.5) + Math.Cos(Math.PI / 180 * 23) * Math.Cos(Math.PI / 180 * -23.5) * Math.Cos(0);
      double L = Math.Sqrt((y / sinHs) * (y / sinHs) - y * y);
      distance_N = L;
      distance_N = shadow_ratio * y;
      /*
      //找出最北面的边的长度
      List<Point3d> point_n = new List<Point3d>();
      point_n.Add(points_o[0]);
      point_n.Add(points_o[1]);
      for (int i = 0;i < points_num - 1;i++){
        //南北侧
        if(Math.Abs(points_o[i + 1].X - points_o[i].X) > Math.Abs(points_o[i + 1].Y - points_o[i].Y))
        {
          //北侧
          if((points_o[i + 1].X - points_o[i].X) > 0)
          {
            if((points_o[i + 1].Y + points_o[i].Y) > (point_n[0].Y + point_n[1].Y))
            {
              point_n.RemoveAt(1);
              point_n.RemoveAt(0);
              point_n.Add(points_o[i]);
              point_n.Add(points_o[i + 1]);
            }
          }
        }
      }
      */
      //图形均基于顺时针构建，因而可根据两点所形成的矢量方向，判断需要构建哪一方向的缓冲，最后用两点位置的移动进行缓冲的构建
      for (int i = 0;i < points_num - 1;i++){
        int[] i_list = new int[6];
        int temp_0 = i - 2;
        for(int j = 0;j < 6;j++){
          i_list[j] = temp_0;
          temp_0 += 1;
        }
        for(int j = 0;j < 6;j++){
          if(i_list[j] < 0){
            i_list[j] = i_list[j] + points_num - 1;
          }
          if(i_list[j] >= points_num - 1){
            i_list[j] = i_list[j] - points_num + 1;
          }
        }
        distance = 0;
        if(JudgeDirection(points_o[i_list[3]], points_o[i_list[2]]) == "西"){
          if((points_o[i_list[2]].X + points_o[i_list[3]].X) / 2 < pos.X){
            distance = distance_W;/*
            if(JudgeDirection(points_o[i_list[4]], points_o[i_list[3]]) == "南"){
            if(JudgeDirection(points_o[i_list[5]], points_o[i_list[4]]) == "东"){
            distance = 0;
            }
            }
            if(JudgeDirection(points_o[i_list[2]], points_o[i_list[1]]) == "北"){
            if(JudgeDirection(points_o[i_list[1]], points_o[i_list[0]]) == "东"){
            distance = 0;
            }
            }
            */
          }

        }
        else if(JudgeDirection(points_o[i_list[3]], points_o[i_list[2]]) == "东"){
          if((points_o[i_list[2]].X + points_o[i_list[3]].X) / 2 > pos.X){
            distance = distance_E;
            /*
            if(JudgeDirection(points_o[i_list[4]], points_o[i_list[3]]) == "北"){
              if(JudgeDirection(points_o[i_list[5]], points_o[i_list[4]]) == "西"){
                distance = 0;
              }
            }
            if(JudgeDirection(points_o[i_list[2]], points_o[i_list[1]]) == "南"){
              if(JudgeDirection(points_o[i_list[1]], points_o[i_list[0]]) == "西"){
                distance = 0;
              }
            }
      */
          }
        }
        else if(JudgeDirection(points_o[i_list[3]], points_o[i_list[2]]) == "南"){
          if((points_o[i_list[2]].Y + points_o[i_list[3]].Y) / 2 < pos.Y){
            distance = 8;
          }
        }
        else if(JudgeDirection(points_o[i_list[3]], points_o[i_list[2]]) == "北"){
          if((points_o[i_list[2]].Y + points_o[i_list[3]].Y) / 2 > pos.Y){
            distance = distance_N;
          }
        }
        //线中心
        Point3d line_center = new Point3d((points_o[i + 1].X + points_o[i].X) / 2, (points_o[i + 1].Y + points_o[i].Y) / 2, 0);
        //两点成线
        List<Point3d> line_p = new List<Point3d>();
        line_p.Add(points_o[i]);
        line_p.Add(points_o[i + 1]);
        Curve line = new Polyline(line_p).ToNurbsCurve();
        //旋转90度
        Curve line_cz = RotateCurve(line, 0.5 * Math.PI, new Plane(line_center, new Vector3d(0, 0, 1)));
        //单位化
        Vector3d vec = Point3d.Subtract(line_cz.PointAtEnd, line_cz.PointAtStart);
        vec.Unitize();
        //移动
        line.Translate(distance * vec);
        Point3d temp;
        //写入点
        if(JudgeDirection(points_o[i_list[3]], points_o[i_list[2]]) == "西" || JudgeDirection(points_o[i_list[3]], points_o[i_list[2]]) == "东"){
          //东西侧
          temp = new Point3d(line.PointAtStart.X, points_c1[i].Y, points_c1[i].Z);
          points_c1.RemoveAt(i);
          points_c1.Insert(i, temp);
          temp = new Point3d(line.PointAtEnd.X, points_c1[i + 1].Y, points_c1[i + 1].Z);
          points_c1.RemoveAt(i + 1);
          points_c1.Insert(i + 1, temp);

        }
        else if(JudgeDirection(points_o[i_list[3]], points_o[i_list[2]]) == "南"){
          //南侧
          temp = new Point3d(points_c1[i].X, line.PointAtStart.Y, points_c1[i].Z);
          points_c1.RemoveAt(i);
          points_c1.Insert(i, temp);
          temp = new Point3d(points_c1[i + 1].X, line.PointAtEnd.Y, points_c1[i + 1].Z);
          points_c1.RemoveAt(i + 1);
          points_c1.Insert(i + 1, temp);
        }
        else if(JudgeDirection(points_o[i_list[3]], points_o[i_list[2]]) == "北"){
          //北侧
          temp = new Point3d(points_c2[i].X, line.PointAtStart.Y, points_c2[i].Z);
          points_c2.RemoveAt(i);
          points_c2.Insert(i, temp);
          temp = new Point3d(points_c2[i + 1].X, line.PointAtEnd.Y, points_c2[i + 1].Z);
          points_c2.RemoveAt(i + 1);
          points_c2.Insert(i + 1, temp);
        }
      }
      //计算一个新的重合点，因为建筑轮廓上第一个点与最后一个点重合，构建缓冲后不重合
      double temp_x,temp_y;
      if(points_o[0].X == points_c1[0].X)
      {
        temp_x = points_c1[points_num - 1].X;
        temp_y = points_c1[0].Y;
      }
      else
      {
        temp_x = points_c1[0].X;
        temp_y = points_c1[points_num - 1].Y;
      }
      Point3d point_orignal = new Point3d(temp_x, temp_y, points_c1[0].Z);
      //重合点替换第一点
      points_c1.RemoveAt(0);
      points_c1.Insert(0, point_orignal);
      //重合点替换最后一点
      points_c1.RemoveAt(points_num - 1);
      points_c1.Insert(points_num - 1, point_orignal);
      Curve buffer1 = new Polyline(points_c1).ToNurbsCurve();
      /*
      if(points_o[0].X == points_c2[0].X)
      {
        temp_x = points_c2[points_num - 1].X;
        temp_y = points_c2[0].Y;
      }
      else
      {
        temp_x = points_c2[0].X;
        temp_y = points_c2[points_num - 1].Y;
      }
      */
      temp_x = points_c2[0].X;
      if(points_c2[0].Y > points_c2[points_num - 1].Y){
        temp_y = points_c2[0].Y;
      }
      else{
        temp_y = points_c2[points_num - 1].Y;
      }
      point_orignal = new Point3d(temp_x, temp_y, points_c2[0].Z);
      points_c2.RemoveAt(0);
      points_c2.Insert(0, point_orignal);
      points_c2.RemoveAt(points_num - 1);
      points_c2.Insert(points_num - 1, point_orignal);
      Curve buffer2 = new Polyline(points_c2).ToNurbsCurve();
      List<Curve> buffer0 = new List<Curve>();
      buffer0.Add(buffer1);
      buffer0.Add(buffer2);
      Curve buffer = Curve.CreateBooleanUnion(buffer0)[0];
      //旋转图形
      buffer = RotateCurve(buffer, -1 * direction * Math.PI / 180, new Plane(AreaMassProperties.Compute(buffer).Centroid, new Vector3d(0, 0, 1)));
      return buffer;
    
    }
    public Curve RotateCurve(Curve x, double angle, Plane p){
      var func_info = Rhino.NodeInCode.Components.FindComponent("Rotate");
      var func = func_info.Delegate as dynamic;
      var result = func(x, angle, p);
      List<Curve> curve_return = new List<Curve>();
      foreach (var temppp in result[0])
      {
        curve_return.Add((Curve) temppp);
      }
      return curve_return[0];
    }

    public string JudgeDirection(Point3d x1, Point3d x0){
      string direction = "";
      if(Math.Abs(x1.X - x0.X) > Math.Abs(x1.Y - x0.Y)){
        //北侧
        if((x1.X - x0.X) > 0){
          direction = "北";
        }
          //南侧
        else{
          direction = "南";
        }
      }
      else
      {
        //东侧
        if((x1.Y - x0.Y) < 0){
          direction = "东";
        }
          //西侧
        else{
          direction = "西";
        }
      }
      return direction;
    }

    //避免中心点重叠
    public void Overlap(List < Building > buildings){
      Vector3d randMove = new Vector3d(0, 0, 0);
      for(int i = 0; i < buildings.Count; i++){
        Building b = buildings[i];
        if(b != this && pos == b.pos){
          double randDir = Math.PI * rand.NextDouble();
          double bArea = AreaMassProperties.Compute(b.offShape).Area; //面积越大移动越远
          randMove = new Vector3d(Math.Cos(randDir) * bArea * 0.005, Math.Sin(randDir) * bArea * 0.005, 0);
          break;
        }
      }
      pos = Point3d.Add(pos, randMove);
      shape.Translate(randMove);
      offShape.Translate(randMove);
    }

    //计算场地边界对出界智能体的动量,以及静止建筑对重合智能体的动量
    public void CheckEdge(){
      Curve[] differC = Curve.CreateBooleanDifference(shape, boundary, 0.000001);
      if(differC.Length != 0){
        Vector3d pushBack = new Vector3d();
        for (int i = 0; i < differC.Length; i++){
          overlapArea += AreaMassProperties.Compute(differC[i]).Area;
          Point3d subCenter = GetCenter(differC[i]);
          Vector3d push = Point3d.Subtract(siteCenter, subCenter);
          pushBack = Vector3d.Add(pushBack, push);
        }
        pushBack = Vector3d.Multiply(pushBack, 2.5 / pushBack.Length);
        move += pushBack;
      }
      for(int i = 0;i < build_steady.Count;i++){
        Curve[] intersecs = Curve.CreateBooleanIntersection(shape, build_steady[i], 0.000001);
        double overlap = 0;
        if(intersecs.Length != 0){
          for (int j = 0; j < intersecs.Length; j++){
            overlap += AreaMassProperties.Compute(intersecs[j]).Area;
            Point3d interCenter = GetCenter(intersecs[j]);
            Vector3d pi = Point3d.Subtract(pos, interCenter);
            if(pi.Length == 0){
              pi = Point3d.Subtract(pos, GetCenter(build_steady[i]));
            }
            double dist = pos.DistanceTo(GetCenter(build_steady[i]));
            pi = Vector3d.Multiply(pi, 4 / dist);
            move = Vector3d.Add(move, Vector3d.Multiply(pi, 0.5));
          }
        }
      }
    }
    //计算静止建筑对重合智能体的动量
    public void CheckSteadyBuild(){
      for(int i = 0;i < build_steady.Count;i++){
        Curve[] intersecs = Curve.CreateBooleanIntersection(shape, build_steady[i], 0.000001);
        double overlap = 0;
        if(intersecs.Length != 0){
          for (int j = 0; j < intersecs.Length; j++){
            overlap += AreaMassProperties.Compute(intersecs[j]).Area;
            Point3d interCenter = GetCenter(intersecs[j]);
            Vector3d pi = Point3d.Subtract(pos, interCenter);
            if(pi.Length == 0){
              pi = Point3d.Subtract(pos, GetCenter(build_steady[i]));
            }
            double dist = pos.DistanceTo(GetCenter(build_steady[i]));
            pi = Vector3d.Multiply(pi, 4 / dist);
            move = Vector3d.Add(move, Vector3d.Multiply(pi, 0.5));
          }
        }
      }
    }

    //判断该智能体是否与某智能体缓冲区内重叠，若有则两智能体都增加动量
    public void Seperate (Building b){
      double overlap = 0;
      Curve[] intersecs = Curve.CreateBooleanIntersection(shape, b.offShape, 0.000001);
      if(intersecs.Length != 0){
        for (int j = 0; j < intersecs.Length; j++){
          overlap += AreaMassProperties.Compute(intersecs[j]).Area;
          Point3d interCenter = GetCenter(intersecs[j]);
          Vector3d pi = Point3d.Subtract(pos, interCenter);
          Vector3d pj = Point3d.Subtract(GetCenter(b.offShape), interCenter);
          if(pi.Length == 0){
            pi = Point3d.Subtract(pos, b.pos);
            pj = Point3d.Subtract(b.pos, pos);
          }

          double dist = pos.DistanceTo(GetCenter(b.offShape));
          pi = Vector3d.Multiply(pi, 4 / dist);
          pj = Vector3d.Multiply(pj, 4 / dist);
          move = Vector3d.Add(move, Vector3d.Multiply(pi, 0.5));
          b.move = Vector3d.Add(b.move, Vector3d.Multiply(pj, 0.5));
        }
      }
    }

    //根据动量更新智能体位置
    public void Update (){
      pos = Point3d.Add(pos, move);
      shape.Translate(move);
      offShape.Translate(move);
      move = Vector3d.Multiply(move, 0);
    }

    //计算各智能体不符合要求面积——>逾越场地边界的面积与其他智能体缓冲区内的重叠面积
    public void UpdateOverlap (List < Building > buildings){
      overlapArea = 0;
      for(int i = 0; i < buildings.Count; i++){
        Building b = buildings[i];
        Curve[] intersecs = Curve.CreateBooleanIntersection(shape, b.offShape, 0.000001);
        if(intersecs.Length != 0){
          for (int j = 0; j < intersecs.Length; j++){
            overlapArea += AreaMassProperties.Compute(intersecs[j]).Area;
          }
        }
      }
      Curve[] differC = Curve.CreateBooleanDifference(shape, boundary, 0.000001);
      if(differC.Length != 0){
        for (int i = 0; i < differC.Length; i++){
          overlapArea += AreaMassProperties.Compute(differC[i]).Area;
        }
      }
      for(int i = 0;i < build_steady.Count;i++){
        Curve[] intersecs = Curve.CreateBooleanIntersection(shape, build_steady[i], 0.000001);
        if(intersecs.Length != 0){
          for (int j = 0; j < intersecs.Length; j++){
            overlapArea += AreaMassProperties.Compute(intersecs[j]).Area;
          }
        }
      }

    }
  }


  //常用方法
  public class Common_void{
    public Common_void(){}

    //计算所有智能体不符合要求面积总和——>逾越场地边界的面积与其他智能体缓冲区内的重叠面积
    public double CheckOverlap_bs (List < Building > bs){
      double totalOverlap = 0;
      for(int i = 0; i < bs.Count; i++){
        for(int j = 0; j < bs.Count; j++){
          if(i != j)
          {
            Curve[] intersecs = Curve.CreateBooleanIntersection(bs[i].shape, bs[j].offShape, 0.000001);
            if(intersecs.Length != 0){
              for (int k = 0; k < intersecs.Length; k++){
                totalOverlap += AreaMassProperties.Compute(intersecs[k]).Area;
              }
            }
          }
        }
        Curve[] differC = Curve.CreateBooleanDifference(bs[i].shape, bs[i].boundary, 0.000001);
        if(differC.Length != 0){
          for (int j = 0; j < differC.Length; j++){
            totalOverlap += AreaMassProperties.Compute(differC[j]).Area;
          }
        }
      }
      return totalOverlap;
    }

    //Calculate total area of curves
    public double CalculateTotalArea(List < Curve > curve)
    {
      double result = 0;
      for(int i = 0; i < curve.Count; i++)
      {
        result += AreaMassProperties.Compute(curve[i]).Area;
      }
      return result;
    }

    public List<Point3d> GetRandomPoints(int i, Curve curve)
    {
      var func_info = Rhino.NodeInCode.Components.FindComponent("PopulateGeometry");
      var func = func_info.Delegate as dynamic;
      List<Curve> curves = new List<Curve>();
      curves.Add(curve);
      var result = func(Brep.CreatePlanarBreps(curves), i, 1, null);
      List<Point3d> points = new List<Point3d>();
      foreach (var temp in result)
      {
        points.Add((Point3d) temp);
      }
      return points;
    }
    public List<Curve> RepeatCurve(int i, Curve curve)
    {
      var func_info = Rhino.NodeInCode.Components.FindComponent("RepeatData");
      var func = func_info.Delegate as dynamic;
      var result = func(curve, i);

      List<Curve> curves = new List<Curve>();
      foreach (var temp in result)
      {
        curves.Add((Curve) temp);
      }
      return curves;
    }

  }
# ---------- end c_script_2 ----------
building = Geometry(c_script_2.B)
offshape = Geometry(c_script_2.O)

geo = Geometry(buildinggenerator.buildings)
geo_2 = Geometry(buildinggenerator.offShape)
data = Data(buildinggenerator.height)
panel_4 = Panel(c_script_2.H)

# ----
# 三维拉伸
vec = VectorXYZ(XComponent=0, YComponent=0, ZComponent=c_script_2.H)  # -> Vector, Length
extr = Extrude(Base=building, Direction=vec.Vector)
brep = Brep(extr)
cap = CapHoles(Brep=brep)
drawbrep = CSharpScript(B=cap, C=ColourSwatch(SwatchColor=RGB(192, 192, 192)))  # -> out; inputs B: Brep, C: Color
# ---------- drawbrep: C# usings ----------
using System.IO;
using System.Linq;
using System.Data;
using System.Drawing;
using System.Reflection;
using System.Windows.Forms;
using System.Xml;
using System.Xml.Linq;
using System.Runtime.InteropServices;

using Rhino.DocObjects;
using Rhino.Collections;
using GH_IO;
using GH_IO.Serialization;
# ---------- drawbrep: C# ----------
    if (B == null) return;
    if (C.A == 0) return;

    _breps.Add(B);
    _materials.Add(new Rhino.Display.DisplayMaterial(C));
# ---------- drawbrep: C# additional code ----------
  private readonly List<Brep> _breps = new List<Brep>();
  private readonly List<Rhino.Display.DisplayMaterial> _materials = new List<Rhino.Display.DisplayMaterial>();
  private BoundingBox _box;

  /// <summary>
  /// This method will be called once every solution, before any calls to RunScript.
  /// </summary>
  public override void BeforeRunScript()
  {
    _box = BoundingBox.Empty;
    _breps.Clear();
    _materials.Clear();
  }

  public override BoundingBox ClippingBox
  {
    get { return _box; }
  }
  public override void DrawViewportMeshes(IGH_PreviewArgs args)
  {
    for (int i = 0; i < _breps.Count; i++)
      args.Display.DrawBrepWires(_breps[i], _materials[i].Diffuse, 0);
  }
  public override void DrawViewportWires(IGH_PreviewArgs args)
  {
    for (int i = 0; i < _breps.Count; i++)
      args.Display.DrawBrepShaded(_breps[i], _materials[i]);
  }
# ---------- end drawbrep ----------

# ----
# 曲线渲染
toggle = BooleanToggle(True)  # disabled
宽度 = Slider(3, range=0..20)
crv_2 = Curve()
c_script_3 = CSharpScript(curve=crv_2, thickness=宽度, ifSolidLine=toggle, color=ColourSwatch(SwatchColor=RGB(67, 46, 83)))  # -> out, A; inputs curve: list of Curve, thickness: Int32, ifSolidLine: Boolean, color: Color
# ---------- c_script_3: C# usings ----------
using System.Drawing;
# ---------- c_script_3: C# ----------
    if (curve == null) return;
    if (color.A == 0) return;
    for (int i = 0; i < curve.Count; i++)
    {
      _curves.Add(curve[i]);
    }
    _color = color;
    _thickness = thickness;
# ---------- c_script_3: C# additional code ----------
  private BoundingBox _box;
  private readonly List<Curve> _curves = new List<Curve>();
  private readonly List<Rhino.Display.DisplayMaterial> _materials = new List<Rhino.Display.DisplayMaterial>();
  public Color _color;
  public int _thickness;
  //private BoundingBox _box;

  /// <summary>
  /// This method will be called once every solution, before any calls to RunScript.
  /// </summary>
  public override void BeforeRunScript()
  {
    _box = BoundingBox.Empty;
    _curves.Clear();
  }

  public override BoundingBox ClippingBox
  {
    get { return _box; }
  }

  public override void DrawViewportWires(IGH_PreviewArgs args)
  {
    for (int i = 0; i < _curves.Count; i++)
    {
      args.Display.DrawCurve(_curves[i], _color, _thickness);
    }
  }
# ---------- end c_script_3 ----------

# ----
# 数据导出
toggle_2 = BooleanToggle(False)
path = FilePath("C:\Users\panker98\Desktop\八北车辆段\")
c_script_4 = CSharpScript(filename="samplea.3dm", directory=path, export=toggle_2)  # inputs geometries: tree of GeometryBase, filename: String, directory: String, export: Boolean
# ---------- c_script_4: C# usings ----------
using System.IO;
# ---------- c_script_4: C# ----------
    if(export){

      var guids = new List<Guid>();

      for(int i = 0; i < geometries.BranchCount; i++){
        for(int n = 0; n < geometries.Branches[i].Count; n++){
          var geom = geometries.Branches[i][n];
          var guid = Rhino.RhinoDoc.ActiveDoc.Objects.Add(geom);
          guids.Add(guid);
        }
      }

      Rhino.RhinoDoc.ActiveDoc.Objects.Select(guids);

      string filepath = Path.Combine(directory, filename);
      string cmd = "_-Export " + "\"" + filepath + "\"" + " _Enter _Enter";

      Rhino.RhinoApp.RunScript(cmd, false);

      Rhino.RhinoDoc.ActiveDoc.Objects.Delete(guids, true);
    }
# ---------- end c_script_4 ----------

buildinggenerator_2 = CSharpScript(
    strategy=list_2,
    boundary=边界范围,
    offDist=退线距离,
    build_steady=静态建筑,
    shape_type=建筑轮廓,
    floor_height=楼高,
    direction=朝向,
    shadow_ratio=日照比例,
    density=建筑密度,
    plotRatio=容积率,
    height_limit=限高,
    area_limit=最小建筑面积,
    scale_factor=缩放因子,
    active=c_script)  # -> X, buildings, offShape, height, message, tips; inputs strategy: String, boundary: Curve, offDist: Double, build_steady: list of Curve, shape_type: Curve, floor_height: Double, direction: Int32, shadow_ratio: Double, density: list of Double, plotRatio: list of Double, height_limit: Double, area_limit: Double, scale_factor: Double, active: String
# ---------- buildinggenerator_2: C# ----------
    //======初始化======
    com_void = new Common_void();
    string warning = "";

    double density_min = density_[0];
    double density_max = density_[1];
    double plotRatio_min = plotRatio_[0];
    double plotRatio_max = plotRatio_[1];
    int floor_num;
    int floor_max = (int) (height_limit / floor_height);
    bool run = false;
    //计算场地面积
    if(offDist > 0){
      boundary = boundary.Offset(Plane.WorldXY, -1 * offDist, 0.000001, Rhino.Geometry.CurveOffsetCornerStyle.Sharp)[0];
    }
    double boundaryArea = AreaMassProperties.Compute(boundary).Area;
    double shape_area = AreaMassProperties.Compute(shape_type).Area;

    //建筑密度计算智能体个数范围
    double area_scale = shape_area;
    double area_min = shape_area;
    int scale_dnum = 0;
    if(scale_factor != 1){
      while(area_scale >= area_limit){
        area_scale = area_scale * scale_factor * scale_factor;
        scale_dnum += 1;
      }
      area_min = area_scale * 1 / (scale_factor * scale_factor);
      scale_dnum -= 1;
    }


    int build_num_dmin = (int) Math.Ceiling(boundaryArea * density_min / shape_area);
    int build_num_dmax = (int) (boundaryArea * density_max / (area_min));
    //容积率计算智能体个数范围
    int build_num_pmin = (int) Math.Ceiling(plotRatio_min * boundaryArea / (shape_area * floor_max));
    //int build_num_pmax = (int) (plotRatio_max * boundaryArea / (area_min * floor_min));
    //综合计算智能体个数范围
    int build_num_min,build_num_max = 0;
    if(build_num_dmin > build_num_pmin){
      build_num_min = build_num_dmin;}
    else{
      build_num_min = build_num_pmin;
    }
    build_num_max = build_num_dmax;
    Random rd = new Random();
    int build_num;
    if(strategy == "strategy1"){
      build_num = rd.Next(build_num_min, build_num_max);
      floor_num = rd.Next((int) (plotRatio_min * boundaryArea / (shape_area * build_num)), floor_max);
    }
    else if(strategy == "strategy2"){
      build_num = build_num_max;
      floor_num = floor_max;
    }
    else{
      build_num = build_num_min;
      floor_num = floor_max;
    }

    //int build_num = build_num_dmax;
    //floor_num = (int) plotRatio_max * boundaryArea / (shape_area * build_num);
    //if(floor_num * floor_height > floor_limit){
    //floor_num = (int) (floor_limit / floor_height);
    //}

    List<double> tt = new List<double>();
    //生成相应个数的随机点与基于模板的建筑图形
    List<Point3d> randomPoints = com_void.GetRandomPoints(build_num, boundary);
    List< Curve> shape_types = new List<Curve>();
    shape_types = com_void.RepeatCurve(build_num, shape_type);
    //创建智能体
    bs = new List<Building>();
    for(int i = 0; i < build_num; i++){
      Building b = new Building(boundary, build_steady, randomPoints[i], shape_types[i], floor_height, floor_num, scale_dnum, direction, shadow_ratio);
      bs.Add(b);
    }
    tt.Add(build_num_dmin);
    tt.Add(build_num_dmax);
    //====输出=====
    footPrint = new List<Curve>();
    offSet = new List<Curve>();
    height_list = new List<double>();




    for(int i = 0; i < bs.Count; i++){
      footPrint.Add(bs[i].shape);
      offSet.Add(bs[i].offShape);
      height_list.Add(floor_height * bs[i].floor_num);
    }
    buildings = footPrint;
    offShape = offSet;
    height = height_list;
    message = tt;
# ---------- buildinggenerator_2: C# additional code ----------
  //全局变量
  List<Building> bs;
  Common_void com_void;
  List<Curve> footPrint;
  List<Curve> offSet;
  List<double> height_list;
  List<double> other;


  //以下为构建建筑单体智能体代码
  public class Building{
    public Curve boundary;
    public List<Curve> build_steady;
    public Point3d pos;
    public Curve shape;
    public double floor_height;
    public int floor_num;
    public int scale_dnum;
    public double shadow_ratio;

    public int direction;
    public Point3d siteCenter;
    public Curve offShape;
    public Vector3d move;

    public double overlapArea;
    public bool alimit;
    public Random rand;

    public Building(Curve boundary_, List<Curve> build_steady_, Point3d pos_, Curve shape_, double floor_height_, int floor_num_, int scale_dnum_, int direction_, double shadow_ratio_){

      pos = new Point3d();
      floor_height = new double();
      floor_num = new int();
      scale_dnum = new int();
      boundary = boundary_;
      build_steady = build_steady_;
      pos = pos_;
      shape = shape_;
      floor_height = floor_height_;
      floor_num = floor_num_;
      scale_dnum = scale_dnum_;
      direction = direction_;
      shadow_ratio = shadow_ratio_;


      siteCenter = GetCenter(boundary);
      Point3d center = AreaMassProperties.Compute(shape).Centroid;
      shape.Translate(new Vector3d(pos.X - center.X, pos.Y - center.Y, 0));
      //旋转图形
      shape = RotateCurve(shape, -1 * direction * Math.PI / 180, new Plane(AreaMassProperties.Compute(shape).Centroid, new Vector3d(0, 0, 1)));
      offShape = CreateBuffer(shape, floor_height * floor_num);

      overlapArea = 0;
      if(scale_dnum > 0){
        alimit = false;
      }
      else{alimit = true;}
      rand = new Random();

    }

    //计算图形几何中心
    private Point3d GetCenter(Curve c){
      Point3d center = AreaMassProperties.Compute(c).Centroid;
      return center;
    }

    //清空各智能体的存储数据——>不符合要求的面积总和
    public void ClearOverlapArea(){
      overlapArea = 0;
    }

    //计算各智能体楼层数&&创建缓冲
    public void CalculateHeight(){
      offShape = CreateBuffer(shape, floor_height * floor_num);
    }

    //创建缓冲
    public Curve CreateBuffer(Curve x, double y)
    {
      //摆正图形
      x = RotateCurve(x, direction * Math.PI / 180, new Plane(AreaMassProperties.Compute(x).Centroid, new Vector3d(0, 0, 1)));
      List<Point3d> points_o = new List<Point3d>();
      List<Point3d> points_c1 = new List<Point3d>();
      List<Point3d> points_c2 = new List<Point3d>();
      int points_num = x.ToNurbsCurve().Points.Count;
      for (int i = 0;i < points_num;i++)
      {
        Point3d temp = new Point3d();
        x.ToNurbsCurve().Points.GetPoint(i, out temp);
        points_o.Add(temp);
        points_c1.Add(temp);
        points_c2.Add(temp);
      }
      Point3d point_judge = AreaMassProperties.Compute(x).Centroid;
      //计算东南西北侧方向上的缓冲距离
      double distance_N,distance_E,distance_W,distance;
      //if(0.3 * (y+20)< 6){
      //distance_E = distance_W = 6;
      //}
      //else{
      //distance_E = distance_W = 0.3 * 30 + 0.1 * y - 30 * 0.1;
      //}
      distance_E = distance_W = 0.3 * (y + 20);
      double sinHs = Math.Sin(Math.PI / 180 * 23) * Math.Sin(Math.PI / 180 * -23.5) + Math.Cos(Math.PI / 180 * 23) * Math.Cos(Math.PI / 180 * -23.5) * Math.Cos(0);
      double L = Math.Sqrt((y / sinHs) * (y / sinHs) - y * y);
      distance_N = L;
      distance_N = shadow_ratio * y;
      /*
      //找出最北面的边的长度
      List<Point3d> point_n = new List<Point3d>();
      point_n.Add(points_o[0]);
      point_n.Add(points_o[1]);
      for (int i = 0;i < points_num - 1;i++){
        //南北侧
        if(Math.Abs(points_o[i + 1].X - points_o[i].X) > Math.Abs(points_o[i + 1].Y - points_o[i].Y))
        {
          //北侧
          if((points_o[i + 1].X - points_o[i].X) > 0)
          {
            if((points_o[i + 1].Y + points_o[i].Y) > (point_n[0].Y + point_n[1].Y))
            {
              point_n.RemoveAt(1);
              point_n.RemoveAt(0);
              point_n.Add(points_o[i]);
              point_n.Add(points_o[i + 1]);
            }
          }
        }
      }
      */
      //图形均基于顺时针构建，因而可根据两点所形成的矢量方向，判断需要构建哪一方向的缓冲，最后用两点位置的移动进行缓冲的构建
      for (int i = 0;i < points_num - 1;i++){
        int[] i_list = new int[6];
        int temp_0 = i - 2;
        for(int j = 0;j < 6;j++){
          i_list[j] = temp_0;
          temp_0 += 1;
        }
        for(int j = 0;j < 6;j++){
          if(i_list[j] < 0){
            i_list[j] = i_list[j] + points_num - 1;
          }
          if(i_list[j] >= points_num - 1){
            i_list[j] = i_list[j] - points_num + 1;
          }
        }
        distance = 0;
        if(JudgeDirection(points_o[i_list[3]], points_o[i_list[2]]) == "西"){
          if((points_o[i_list[2]].X + points_o[i_list[3]].X) / 2 < pos.X){
            distance = distance_W;/*
            if(JudgeDirection(points_o[i_list[4]], points_o[i_list[3]]) == "南"){
            if(JudgeDirection(points_o[i_list[5]], points_o[i_list[4]]) == "东"){
            distance = 0;
            }
            }
            if(JudgeDirection(points_o[i_list[2]], points_o[i_list[1]]) == "北"){
            if(JudgeDirection(points_o[i_list[1]], points_o[i_list[0]]) == "东"){
            distance = 0;
            }
            }
            */
          }

        }
        else if(JudgeDirection(points_o[i_list[3]], points_o[i_list[2]]) == "东"){
          if((points_o[i_list[2]].X + points_o[i_list[3]].X) / 2 > pos.X){
            distance = distance_E;
            /*
            if(JudgeDirection(points_o[i_list[4]], points_o[i_list[3]]) == "北"){
              if(JudgeDirection(points_o[i_list[5]], points_o[i_list[4]]) == "西"){
                distance = 0;
              }
            }
            if(JudgeDirection(points_o[i_list[2]], points_o[i_list[1]]) == "南"){
              if(JudgeDirection(points_o[i_list[1]], points_o[i_list[0]]) == "西"){
                distance = 0;
              }
            }
      */
          }
        }
        else if(JudgeDirection(points_o[i_list[3]], points_o[i_list[2]]) == "南"){
          if((points_o[i_list[2]].Y + points_o[i_list[3]].Y) / 2 < pos.Y){
            distance = 8;
          }
        }
        else if(JudgeDirection(points_o[i_list[3]], points_o[i_list[2]]) == "北"){
          if((points_o[i_list[2]].Y + points_o[i_list[3]].Y) / 2 > pos.Y){
            distance = distance_N;
          }
        }
        //线中心
        Point3d line_center = new Point3d((points_o[i + 1].X + points_o[i].X) / 2, (points_o[i + 1].Y + points_o[i].Y) / 2, 0);
        //两点成线
        List<Point3d> line_p = new List<Point3d>();
        line_p.Add(points_o[i]);
        line_p.Add(points_o[i + 1]);
        Curve line = new Polyline(line_p).ToNurbsCurve();
        //旋转90度
        Curve line_cz = RotateCurve(line, 0.5 * Math.PI, new Plane(line_center, new Vector3d(0, 0, 1)));
        //单位化
        Vector3d vec = Point3d.Subtract(line_cz.PointAtEnd, line_cz.PointAtStart);
        vec.Unitize();
        //移动
        line.Translate(distance * vec);
        Point3d temp;
        //写入点
        if(JudgeDirection(points_o[i_list[3]], points_o[i_list[2]]) == "西" || JudgeDirection(points_o[i_list[3]], points_o[i_list[2]]) == "东"){
          //东西侧
          temp = new Point3d(line.PointAtStart.X, points_c1[i].Y, points_c1[i].Z);
          points_c1.RemoveAt(i);
          points_c1.Insert(i, temp);
          temp = new Point3d(line.PointAtEnd.X, points_c1[i + 1].Y, points_c1[i + 1].Z);
          points_c1.RemoveAt(i + 1);
          points_c1.Insert(i + 1, temp);

        }
        else if(JudgeDirection(points_o[i_list[3]], points_o[i_list[2]]) == "南"){
          //南侧
          temp = new Point3d(points_c1[i].X, line.PointAtStart.Y, points_c1[i].Z);
          points_c1.RemoveAt(i);
          points_c1.Insert(i, temp);
          temp = new Point3d(points_c1[i + 1].X, line.PointAtEnd.Y, points_c1[i + 1].Z);
          points_c1.RemoveAt(i + 1);
          points_c1.Insert(i + 1, temp);
        }
        else if(JudgeDirection(points_o[i_list[3]], points_o[i_list[2]]) == "北"){
          //北侧
          temp = new Point3d(points_c2[i].X, line.PointAtStart.Y, points_c2[i].Z);
          points_c2.RemoveAt(i);
          points_c2.Insert(i, temp);
          temp = new Point3d(points_c2[i + 1].X, line.PointAtEnd.Y, points_c2[i + 1].Z);
          points_c2.RemoveAt(i + 1);
          points_c2.Insert(i + 1, temp);
        }
      }
      //计算一个新的重合点，因为建筑轮廓上第一个点与最后一个点重合，构建缓冲后不重合
      double temp_x,temp_y;
      if(points_o[0].X == points_c1[0].X)
      {
        temp_x = points_c1[points_num - 1].X;
        temp_y = points_c1[0].Y;
      }
      else
      {
        temp_x = points_c1[0].X;
        temp_y = points_c1[points_num - 1].Y;
      }
      Point3d point_orignal = new Point3d(temp_x, temp_y, points_c1[0].Z);
      //重合点替换第一点
      points_c1.RemoveAt(0);
      points_c1.Insert(0, point_orignal);
      //重合点替换最后一点
      points_c1.RemoveAt(points_num - 1);
      points_c1.Insert(points_num - 1, point_orignal);
      Curve buffer1 = new Polyline(points_c1).ToNurbsCurve();
      /*
      if(points_o[0].X == points_c2[0].X)
      {
        temp_x = points_c2[points_num - 1].X;
        temp_y = points_c2[0].Y;
      }
      else
      {
        temp_x = points_c2[0].X;
        temp_y = points_c2[points_num - 1].Y;
      }
      */
      temp_x = points_c2[0].X;
      if(points_c2[0].Y > points_c2[points_num - 1].Y){
        temp_y = points_c2[0].Y;
      }
      else{
        temp_y = points_c2[points_num - 1].Y;
      }
      point_orignal = new Point3d(temp_x, temp_y, points_c2[0].Z);
      points_c2.RemoveAt(0);
      points_c2.Insert(0, point_orignal);
      points_c2.RemoveAt(points_num - 1);
      points_c2.Insert(points_num - 1, point_orignal);
      Curve buffer2 = new Polyline(points_c2).ToNurbsCurve();
      List<Curve> buffer0 = new List<Curve>();
      buffer0.Add(buffer1);
      buffer0.Add(buffer2);
      Curve buffer = Curve.CreateBooleanUnion(buffer0)[0];
      //旋转图形
      buffer = RotateCurve(buffer, -1 * direction * Math.PI / 180, new Plane(AreaMassProperties.Compute(buffer).Centroid, new Vector3d(0, 0, 1)));
      return buffer;
    }
    public Curve RotateCurve(Curve x, double angle, Plane p){
      var func_info = Rhino.NodeInCode.Components.FindComponent("Rotate");
      var func = func_info.Delegate as dynamic;
      var result = func(x, angle, p);
      List<Curve> curve_return = new List<Curve>();
      foreach (var temppp in result[0])
      {
        curve_return.Add((Curve) temppp);
      }
      return curve_return[0];
    }

    public string JudgeDirection(Point3d x1, Point3d x0){
      string direction = "";
      if(Math.Abs(x1.X - x0.X) > Math.Abs(x1.Y - x0.Y)){
        //北侧
        if((x1.X - x0.X) > 0){
          direction = "北";
        }
          //南侧
        else{
          direction = "南";
        }
      }
      else
      {
        //东侧
        if((x1.Y - x0.Y) < 0){
          direction = "东";
        }
          //西侧
        else{
          direction = "西";
        }
      }
      return direction;
    }

    //避免中心点重叠
    public void Overlap(List < Building > buildings){
      Vector3d randMove = new Vector3d(0, 0, 0);
      for(int i = 0; i < buildings.Count; i++){
        Building b = buildings[i];
        if(b != this && pos == b.pos){
          double randDir = Math.PI * rand.NextDouble();
          double bArea = AreaMassProperties.Compute(b.offShape).Area; //面积越大移动越远
          randMove = new Vector3d(Math.Cos(randDir) * bArea * 0.005, Math.Sin(randDir) * bArea * 0.005, 0);
          break;
        }
      }
      pos = Point3d.Add(pos, randMove);
      shape.Translate(randMove);
      offShape.Translate(randMove);
    }

    //计算场地边界对出界智能体的动量,以及静止建筑对重合智能体的动量
    public void CheckEdge(){
      Curve[] differC = Curve.CreateBooleanDifference(shape, boundary, 0.000001);
      if(differC.Length != 0){
        Vector3d pushBack = new Vector3d();
        for (int i = 0; i < differC.Length; i++){
          overlapArea += AreaMassProperties.Compute(differC[i]).Area;
          Point3d subCenter = GetCenter(differC[i]);
          Vector3d push = Point3d.Subtract(siteCenter, subCenter);
          pushBack = Vector3d.Add(pushBack, push);
        }
        pushBack = Vector3d.Multiply(pushBack, 2.5 / pushBack.Length);
        move += pushBack;
      }
      for(int i = 0;i < build_steady.Count;i++){
        Curve[] intersecs = Curve.CreateBooleanIntersection(shape, build_steady[i], 0.000001);
        double overlap = 0;
        if(intersecs.Length != 0){
          for (int j = 0; j < intersecs.Length; j++){
            overlap += AreaMassProperties.Compute(intersecs[j]).Area;
            Point3d interCenter = GetCenter(intersecs[j]);
            Vector3d pi = Point3d.Subtract(pos, interCenter);
            if(pi.Length == 0){
              pi = Point3d.Subtract(pos, GetCenter(build_steady[i]));
            }
            double dist = pos.DistanceTo(GetCenter(build_steady[i]));
            pi = Vector3d.Multiply(pi, 4 / dist);
            move = Vector3d.Add(move, Vector3d.Multiply(pi, 0.5));
          }
        }
      }
    }
    //计算静止建筑对重合智能体的动量
    public void CheckSteadyBuild(){
      for(int i = 0;i < build_steady.Count;i++){
        Curve[] intersecs = Curve.CreateBooleanIntersection(shape, build_steady[i], 0.000001);
        double overlap = 0;
        if(intersecs.Length != 0){
          for (int j = 0; j < intersecs.Length; j++){
            overlap += AreaMassProperties.Compute(intersecs[j]).Area;
            Point3d interCenter = GetCenter(intersecs[j]);
            Vector3d pi = Point3d.Subtract(pos, interCenter);
            if(pi.Length == 0){
              pi = Point3d.Subtract(pos, GetCenter(build_steady[i]));
            }
            double dist = pos.DistanceTo(GetCenter(build_steady[i]));
            pi = Vector3d.Multiply(pi, 4 / dist);
            move = Vector3d.Add(move, Vector3d.Multiply(pi, 0.5));
          }
        }
      }
    }

    //判断该智能体是否与某智能体缓冲区内重叠，若有则两智能体都增加动量
    public void Seperate (Building b){
      double overlap = 0;
      Curve[] intersecs = Curve.CreateBooleanIntersection(shape, b.offShape, 0.000001);
      if(intersecs.Length != 0){
        for (int j = 0; j < intersecs.Length; j++){
          overlap += AreaMassProperties.Compute(intersecs[j]).Area;
          Point3d interCenter = GetCenter(intersecs[j]);
          Vector3d pi = Point3d.Subtract(pos, interCenter);
          Vector3d pj = Point3d.Subtract(GetCenter(b.offShape), interCenter);
          if(pi.Length == 0){
            pi = Point3d.Subtract(pos, b.pos);
            pj = Point3d.Subtract(b.pos, pos);
          }

          double dist = pos.DistanceTo(GetCenter(b.offShape));
          pi = Vector3d.Multiply(pi, 4 / dist);
          pj = Vector3d.Multiply(pj, 4 / dist);
          move = Vector3d.Add(move, Vector3d.Multiply(pi, 0.5));
          b.move = Vector3d.Add(b.move, Vector3d.Multiply(pj, 0.5));
        }
      }
    }

    //根据动量更新智能体位置
    public void Update (){
      pos = Point3d.Add(pos, move);
      shape.Translate(move);
      offShape.Translate(move);
      move = Vector3d.Multiply(move, 0);
    }

    //缩小
    public bool Narrow (double scale_factor){
      if(scale_dnum > 0)
      {
        shape.Transform(Transform.Scale(pos, scale_factor));
        offShape = CreateBuffer(shape, floor_height * floor_num);
        scale_dnum -= 1;
      }
      if(scale_dnum == 0)
      {
        alimit = true;
      }
      return(!alimit);
    }

    //计算各智能体不符合要求面积——>逾越场地边界的面积与其他智能体缓冲区内的重叠面积
    public void UpdateOverlap (List < Building > buildings){
      overlapArea = 0;
      for(int i = 0; i < buildings.Count; i++){
        Building b = buildings[i];
        Curve[] intersecs = Curve.CreateBooleanIntersection(shape, b.offShape, 0.000001);
        if(intersecs.Length != 0){
          for (int j = 0; j < intersecs.Length; j++){
            overlapArea += AreaMassProperties.Compute(intersecs[j]).Area;
          }
        }
      }
      Curve[] differC = Curve.CreateBooleanDifference(shape, boundary, 0.000001);
      if(differC.Length != 0){
        for (int i = 0; i < differC.Length; i++){
          overlapArea += AreaMassProperties.Compute(differC[i]).Area;
        }
      }
      for(int i = 0;i < build_steady.Count;i++){
        Curve[] intersecs = Curve.CreateBooleanIntersection(shape, build_steady[i], 0.000001);
        if(intersecs.Length != 0){
          for (int j = 0; j < intersecs.Length; j++){
            overlapArea += AreaMassProperties.Compute(intersecs[j]).Area;
          }
        }
      }

    }
  }


  //常用方法
  public class Common_void{
    public Common_void(){}

    //计算所有智能体不符合要求面积总和——>逾越场地边界的面积与其他智能体缓冲区内的重叠面积
    public double CheckOverlap_bs (List < Building > bs){
      double totalOverlap = 0;
      for(int i = 0; i < bs.Count; i++){
        for(int j = 0; j < bs.Count; j++){
          if(i != j)
          {
            Curve[] intersecs = Curve.CreateBooleanIntersection(bs[i].shape, bs[j].offShape, 0.000001);
            if(intersecs.Length != 0){
              for (int k = 0; k < intersecs.Length; k++){
                totalOverlap += AreaMassProperties.Compute(intersecs[k]).Area;
              }
            }
          }
        }
        Curve[] differC = Curve.CreateBooleanDifference(bs[i].shape, bs[i].boundary, 0.000001);
        if(differC.Length != 0){
          for (int j = 0; j < differC.Length; j++){
            totalOverlap += AreaMassProperties.Compute(differC[j]).Area;
          }
        }
        for(int j = 0;j < bs[i].build_steady.Count;j++){
          Curve[] intersecs = Curve.CreateBooleanIntersection(bs[i].shape, bs[i].build_steady[j], 0.000001);
          if(intersecs.Length != 0){
            for (int k = 0; k < intersecs.Length; k++){
              totalOverlap += AreaMassProperties.Compute(intersecs[k]).Area;
            }
          }
        }
      }

      return totalOverlap;
    }


    public int GetScaleANum(List < Building > bs)
    {
      int result = 0;
      for(int i = 0;i < bs.Count;i++)
      {
        if(bs[i].alimit == true)
        {
          result += 1;
        }
      }
      return result;
    }
    //Calculate total area of curves
    public double CalculateTotalArea(List < Curve > curve)
    {
      double result = 0;
      for(int i = 0; i < curve.Count; i++)
      {
        result += AreaMassProperties.Compute(curve[i]).Area;
      }
      return result;
    }

    public List<Point3d> GetRandomPoints(int i, Curve curve)
    {
      var func_info = Rhino.NodeInCode.Components.FindComponent("PopulateGeometry");
      var func = func_info.Delegate as dynamic;
      List<Curve> curves = new List<Curve>();
      curves.Add(curve);
      var result = func(Brep.CreatePlanarBreps(curves), i, 1, null);
      List<Point3d> points = new List<Point3d>();
      foreach (var temp in result)
      {
        points.Add((Point3d) temp);
      }
      return points;
    }
    public List<Curve> RepeatCurve(int i, Curve curve)
    {
      var func_info = Rhino.NodeInCode.Components.FindComponent("RepeatData");
      var func = func_info.Delegate as dynamic;
      var result = func(curve, i);

      List<Curve> curves = new List<Curve>();
      foreach (var temp in result)
      {
        curves.Add((Curve) temp);
      }
      return curves;
    }

  }
# ---------- end buildinggenerator_2 ----------
panel_5 = Panel(buildinggenerator_2.message)
geometry = Geometry(buildinggenerator_2.offShape)
geometry_2 = Geometry(buildinggenerator_2.buildings)
