# Grasshopper definition 布局v4.gh (Grasshopper 1.0.7)
# Copyright: 版权归NCFZ数字设计平台所有，引用或修改请与本站联系。
# Copyright: Skywoolf

rectangle = Rectangle({Plane=PlaneXY(133.4218875, 41.25378648, 0), Size=Domain2(u=-136.4553477..136.4553477, v=-82.7002107..82.7002107)})
rectangle_2 = Rectangle({Plane=PlaneXY(-1.666463618, -30.79555974, 0), Size=Domain2(u=-0.4947526237..0.4947526237, v=-8.245877061..8.245877061)})

# ----
# 控制性约束条件
限高 = Slider(108, range=0..210)
退线距离 = Slider(0.1, range=0..10)
容积率 = CSharpScript(min=Slider(3.2, range=0..6), max=Slider(3.6, range=0..6))  # -> plotRatio; inputs min: Double, max: Double
# ---------- 容积率: C# ----------
    if(max >= min){
      List<double> temp = new List<double>();
      temp.Add(min);
      temp.Add(max);
      plotRatio = temp;
    }
# ---------- end 容积率 ----------
密度 = CSharpScript(min=Slider(0.1, range=0..1), max=Slider(0.15, range=0..1))  # -> density; inputs min: Double, max: Double
# ---------- 密度: C# ----------
    if(max >= min){
      List<double> temp = new List<double>();
      temp.Add(min);
      temp.Add(max);
      density = temp;
    }
# ---------- end 密度 ----------

静态建筑 = Curve(rectangle_2)

# ----
# 建                筑                类                型                库
pt = Point([Point(1.6, 0, 0), Point(1.6, 10, 0), Point(8.45, 10, 0), Point(8.45, 13.5, 0), Point(0, 13.5, 0), Point(0, 23.5, 0), Point(26.1, 23.5, 0), Point(26.1, 13.5, 0), Point(17.65, 13.5, 0), Point(17.65, 10, 0), Point(24.5, 10, 0), Point(24.5, 0, 0), Point(1.6, 0, 0)])
pt_2 = Point([Point(0, 0, 0), Point(0, 70, 0), Point(80, 70, 0), Point(80, 50, 0), Point(20, 50, 0), Point(20, 20, 0), Point(80, 20, 0), Point(80, 0, 0), Point(0, 0, 0)])
pt_3 = Point([Point(0, 0, 0), Point(0, 13.75, 0), Point(29.2, 13.75, 0), Point(29.2, 0, 0), Point(0, 0, 0)])
pt_4 = Point([Point(0, 0, 0), Point(0, 46.8, 0), Point(45.97, 46.8, 0), Point(45.97, 26.8, 0), Point(21.8, 26.8, 0), Point(21.8, 0, 0), Point(0, 0, 0)])
pt_5 = Point([Point(5.4, 0, 0), Point(5.4, 17, 0), Point(0, 17, 0), Point(0, 27.2, 0), Point(28.6, 27.2, 0), Point(28.6, 17, 0), Point(23.2, 17, 0), Point(23.2, 0, 0), Point(5.4, 0, 0)])
工型 = PolyLine(Vertices=pt, Closed=False)
l型 = PolyLine(Vertices=pt_4, Closed=False)
u型 = PolyLine(Vertices=pt_2, Closed=False)
t形 = PolyLine(Vertices=pt_5, Closed=False)
矩形 = PolyLine(Vertices=pt_3, Closed=False)

construct_point = ConstructPoint(XCoordinate="0", YCoordinate="0", ZCoordinate="0")
建筑基底面积 = Panel("9729")
边界面积 = Panel("98242.307849")
居住面积 = Panel("350257")
八北车辆段边界 = Curve(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)
边界范围 = Curve(八北车辆段边界)
十字型 = Curve(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)
凸型 = Curve(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)

# ----
# 个性化设置
朝向 = Slider(-10, range=-45..45)
日照比例 = Slider(0.6, range=0.5..1)
list = ValueList({"原型": 0, "一梯两户": 500, "一梯三户": 700, "两梯四户": 1800}, selected="原型")
楼高 = Slider(3, range=0..5)
最小建筑面积 = Number(570.784928)
缩放因子 = Slider(1, range=0..1)
建筑轮廓 = Curve(十字型)
基底 = CSharpScript(buildings_ori=建筑轮廓, houseType=list)  # -> buildings, minArea; inputs buildings_ori: Curve, houseType: Int32
# ---------- 基底: C# ----------
    double minarea = AreaMassProperties.Compute(buildings_ori).Area;
    minArea = minarea;
    if(houseType != 0){
      buildings_ori.Transform(Transform.Scale(AreaMassProperties.Compute(buildings_ori).Centroid, Math.Sqrt(houseType / minarea)));
    }
      buildings = buildings_ori;
# ---------- end 基底 ----------

c_script = CSharpScript(y=construct_point)  # -> out, A; inputs x: Curve, y: Point3d
# ---------- c_script: C# ----------
    //建筑原型中心
    Point3d center = AreaMassProperties.Compute(x).Centroid;
    //移动到随机位置
    x.Translate(new Vector3d(y.X - center.X, y.Y - center.Y, 0));
    A = x;
# ---------- end c_script ----------
建筑密度 = Panel("0.09903")
容积率_2 = Panel("3.5652")
control_points = ControlPoints(Curve=c_script.A)  # -> Points, Weights, Knots
polyline = PolyLine(Vertices=control_points.Points, Closed=True)

# ----
# 程序主运行
list_2 = ValueList({"随机化": "strategy1", "建筑密度最大化": "strategy2", "容积率最大化": "strategy3"}, selected="容积率最大化")
c_script_2 = CSharpScript(ACTIVE=Toggle(True))  # -> X; inputs ACTIVE: Boolean
# ---------- c_script_2: C# ----------
    _active = ACTIVE;
    string message = "";
    GrasshopperDocument.ScheduleSolution(5, Callback);
    if(ACTIVE){
      message = "\r\n程序处于运行状态，请稍等。提示：文件保存前，请勿必双击按钮恢复为停止状态！";
    }
    else{
      message = "\r\n程序处于停止状态。提示：可修改参数后，双击按钮运行程序！";
    }
    X = message;
# ---------- c_script_2: C# additional code ----------
  private bool _active;
  private void Callback(GH_Document doc)
  {
    foreach(var obj in GrasshopperDocument.ActiveObjects())
      if("生成建筑" == obj.NickName)
      {
        obj.Locked = !_active;
        obj.ExpireSolution(false);
      }
  }
# ---------- end c_script_2 ----------
生成建筑 = CSharpScript(
    strategy=list_2,
    boundary=边界范围,
    offDist=退线距离,
    build_steady=静态建筑,
    shape_type=基底.buildings,
    floor_height=楼高,
    direction=朝向,
    shadow_ratio=日照比例,
    density=密度,
    plotRatio=容积率,
    height_limit=限高,
    area_limit=最小建筑面积,
    scale_factor=缩放因子,
    active=c_script_2)  # -> X, Boundary, Build_steady, Buildings, Height, OffShape, Message, Tips; inputs strategy: String, boundary: Curve, offDist: Double, build_steady: list of Curve, shape_type: Curve, floor_height: Double, direction: Int32, shadow_ratio: Double, density: list of Double, plotRatio: list of Double, height_limit: Double, area_limit: Double, scale_factor: Double, active: String
# ---------- 生成建筑: C# ----------
    //======初始化======

    double boundaryArea = AreaMassProperties.Compute(boundary).Area;
    Build_steady = build_steady;
    com_void = new Common_void();
    string warning = "";

    double density_min = density_[0];
    double density_max = density_[1];
    double plotRatio_min = plotRatio_[0];
    double plotRatio_max = plotRatio_[1];
    int floor_num;
    int floor_max = (int) (height_limit / floor_height);
    bool run = false;
    //计算场地面积
    if(offDist > 0){
      boundary = boundary.Offset(Plane.WorldXY, -1 * offDist, 0.000001, Rhino.Geometry.CurveOffsetCornerStyle.Sharp)[0];
    }
    Boundary = boundary;
    double shape_area = AreaMassProperties.Compute(shape_type).Area;

    //建筑密度计算智能体个数范围
    double area_min = shape_area;
    int scale_dnum = 0;
    if(scale_factor != 1 && shape_area > area_limit){
      while(area_min >= area_limit){
        area_min = area_min * scale_factor * scale_factor;
        scale_dnum += 1;
      }
      area_min = area_min * 1 / (scale_factor * scale_factor);
      scale_dnum -= 1;
    }

    //建筑密度对应个数范围
    //int build_num_dmin = (int) Math.Ceiling(boundaryArea * density_min / shape_area);
    int build_num_dmin = (int) (boundaryArea * density_min / shape_area);
    int build_num_dmax = (int) (boundaryArea * density_max / (area_min));
    int build_num_min = build_num_dmin;
    int build_num_max = build_num_dmax;

    //生成随机智能体个数
    Random rd = new Random();
    int build_num;
    if(strategy == "strategy1"){
      build_num = rd.Next(build_num_min, build_num_max);
      if(floor_max > (int) (plotRatio_max * boundaryArea / (build_num * shape_area)))
      {
        floor_num = rd.Next((int) (plotRatio_min * boundaryArea / (shape_area * build_num)), (int) (plotRatio_max * boundaryArea / (build_num * shape_area)));
      }
      else{
        floor_num = rd.Next((int) (plotRatio_min * boundaryArea / (shape_area * build_num)), floor_max);
      }
    }
    else if(strategy == "strategy2"){
      build_num = build_num_max;
      if(floor_max > (int) (plotRatio_max * boundaryArea / (build_num * shape_area)))
      {
        floor_num = (int) (plotRatio_max * boundaryArea / (build_num * shape_area));
      }
      else{
        floor_num = floor_max;
      }
    }
    else{
      build_num = build_num_min;
      if(floor_max > (int) (plotRatio_max * boundaryArea / (build_num * shape_area)))
      {
        floor_num = (int) (plotRatio_max * boundaryArea / (build_num * shape_area));
      }
      else{
        floor_num = floor_max;
      }
    }



    //生成相应个数的随机点与基于模板的建筑图形
    List<Point3d> randomPoints = com_void.GetRandomPoints(build_num, boundary);
    List< Curve> shape_types = new List<Curve>();
    shape_types = com_void.RepeatCurve(build_num, shape_type);
    //创建智能体
    bs = new List<Building>();
    for(int i = 0; i < build_num; i++){
      Building b = new Building(boundary, build_steady, randomPoints[i], shape_types[i], floor_height, floor_num, scale_dnum, direction, shadow_ratio);
      bs.Add(b);
    }

    double density = double.MinValue;
    double plotRatio = double.MinValue;
    double count = 0;
    double totalOverlap = double.MaxValue;
    bool ifFloorLimit = false;
    bool ifChangeScale,ifScaleLimit;
    bool ifLimit = false;

    if (scale_dnum == 0){
      ifChangeScale = false;
      ifScaleLimit = true;
    }
    else{
      ifChangeScale = true;
      ifScaleLimit = false;
    }

    List<double> tt = new List<double>();
    List<int> seq = new List<int>();
    List<int> seq_F = new List<int>();
    List<double> kk = new List<double>();
    //======运行======
    while(!(totalOverlap <= 0 && density >= density_min && density <= density_max && plotRatio >= plotRatio_min && plotRatio <= plotRatio_max)){
      totalOverlap = 0;
      //通过缩小建筑基底收缩缓冲区
      if(ifChangeScale && ifScaleLimit == false){
        if(count > 50 && count % 15 == 0){
          //计算单个智能体不符合要求的面积
          for(int i = 0;i < bs.Count ;i++){
            bs[i].OverlapArea();
          }
          for(int i = 0;i < bs.Count;i++){
            for(int j = i + 1; j < bs.Count; j++){
              if(i != j){
                Curve[] intersecs = Curve.CreateBooleanIntersection(bs[i].shape, bs[j].offShape, 0.000001);
                double overlap = 0;
                if(intersecs.Length != 0){
                  for (int k = 0; k < intersecs.Length; k++){
                    overlap += AreaMassProperties.Compute(intersecs[k]).Area;
                  }
                }
                bs[i].overlapArea += overlap;
                intersecs = Curve.CreateBooleanIntersection(bs[j].shape, bs[i].offShape, 0.000001);
                overlap = 0;
                if(intersecs.Length != 0){
                  for (int k = 0; k < intersecs.Length; k++){
                    overlap += AreaMassProperties.Compute(intersecs[k]).Area;
                  }
                }
                bs[j].overlapArea += overlap;
              }
            }
          }
          //索引
          seq.Clear();
          seq = new List<int>();
          for(int i = 0;i < bs.Count ;i++){
            //获取缩小未完全达到限制的智能体索引
            if(bs[i].alimit != true){
              seq.Add(i);
            }
          }
          if(seq.Count == 0){
            ifScaleLimit = true;
          }
          else{
            //获取总面积从大到小的相应索引
            int temp = 0;
            for(int i = 0;i < seq.Count - 1;i++){
              for(int j = 0;j < seq.Count - i - 1;j++){
                if(bs[seq[j]].overlapArea < bs[seq[j + 1]].overlapArea){
                  temp = seq[j];
                  seq[j] = seq[j + 1];
                  seq[j + 1] = temp;
                }
              }
            }
            //缩小直至碰到一个可缩小的智能体，则退出循环
            for(int i = 0;i < seq.Count;i++){
              bool bool_atemp = bs[seq[i]].Narrow(scale_factor);
              if(bool_atemp)
                break;
            }
            //清空各智能体的存储数据——>不符合要求的面积总和
            for(int i = 0;i < bs.Count ;i++){
              bs[i].ClearOverlapArea();
            }
          }

        }
      }
      //通过降低楼层收缩缓冲区
      if(ifScaleLimit == true && ifFloorLimit == false){
        if(count > 50 && count % 20 == 0){
          if( (bs[0].floor_num - 1) >= (int) (plotRatio_min * boundaryArea / (AreaMassProperties.Compute(bs[0].shape).Area * build_num))){
            for(int i = 0;i < bs.Count;i++){
              bs[i].floor_num -= 1;
              bs[i].offShape = bs[i].CreateBuffer(bs[i].shape, bs[i].floor_height * bs[i].floor_num);
            }
          }
          else{
            ifFloorLimit = true;
          }
        }
      }
      for(int i = 0;i < bs.Count;i++){
        //计算场地边界对出界智能体的动量
        bs[i].CheckEdge();
        //根据该智能体与其他智能体的缓冲边界内的重叠情况，计算动量
        for(int j = i + 1; j < bs.Count; j++){
          if(i != j){
            bs[i].Seperate(bs[j]);
            bs[j].Seperate(bs[i]);
          }
        }
        //根据动量更新智能体位置
        bs[i].Update();
        //清空各智能体的存储数据——>不符合要求的面积总和
        bs[i].ClearOverlapArea();
      }

      totalOverlap = com_void.CheckOverlap_bs(bs);
      count++;

      if(count == 100 && totalOverlap > 0 && ifLimit){
        build_num = bs.Count - 1;
        //超出范围，退出循环
        if(build_num > build_num_max || build_num < build_num_min){
          run = false;
          warning = "拟合失败1，无法拟合参数，请适当放宽";
          break;
        }
        com_void.Change_build_num(build_num, floor_max, plotRatio_max, shape_type, ref shape_types, ref randomPoints, ref bs, ref ifFloorLimit, ref totalOverlap, ref count);
        ifScaleLimit = !ifChangeScale;
        ifLimit = false;
        //开启新循环
        tt.Add(00);
        continue;
      }
      //计算建筑密度与容积率
      double value_atemp = 0;
      double value_ftemp = 0;
      for(int i = 0;i < bs.Count;i++)
      {
        value_atemp += AreaMassProperties.Compute(bs[i].shape).Area;
        value_ftemp += bs[i].floor_num * AreaMassProperties.Compute(bs[i].shape).Area;
      }
      density = value_atemp / boundaryArea;
      plotRatio = value_ftemp / boundaryArea;


      //拟合失败，且面积与楼层缩小到极致
      if(totalOverlap > 0 && ifScaleLimit == true && ifFloorLimit == true){
        build_num = bs.Count - 1;

        //超出范围，退出循环
        if(build_num > build_num_max || build_num < build_num_min){
          run = false;
          warning = "拟合失败2，无法拟合参数，请适当放宽";
          break;
        }
        com_void.Change_build_num(build_num, floor_max, plotRatio_max, shape_type, ref shape_types, ref randomPoints, ref bs, ref ifFloorLimit, ref totalOverlap, ref count);
        ifScaleLimit = !ifChangeScale;
        ifLimit = false;
        //开启新循环
        tt.Add(11);
        continue;
      }
        //拟合成功
      else if(totalOverlap <= 0){
        //建筑密度大于上限（原则上不会出现）
        if(density > density_max){
          run = false;
          warning = "未知错误，建筑密度大于上限";
          break;
        }
          //建筑密度小于下限
        else if(density < density_min){
          build_num = bs.Count + 1;

          //超出范围，退出循环
          if(build_num > build_num_max || build_num < build_num_min){
            run = false;
            warning = "拟合失败3，无法拟合参数，请适当放宽";
            break;
          }
          com_void.Change_build_num(build_num, floor_max, plotRatio_max, shape_type, ref shape_types, ref randomPoints, ref bs, ref ifFloorLimit, ref totalOverlap, ref count);
          ifScaleLimit = !ifChangeScale;
          ifLimit = false;
          //开启新循环
          tt.Add(22);
          continue;
        }
          //建筑密度符合要求，开始拟合容积率
        else{
          //容积率不在范围内
          if(plotRatio > plotRatio_max || plotRatio < plotRatio_min){
            seq.Clear();
            seq = new List<int>();
            for(int i = 0;i < bs.Count ;i++){
              seq.Add(i);
            }
            //获取从北到南的相应索引
            int temp = 0;
            for(int i = 0;i < seq.Count - 1;i++){
              for(int j = 0;j < seq.Count - i - 1;j++){
                if(bs[seq[j]].pos.Y < bs[seq[j + 1]].pos.Y){
                  temp = seq[j];
                  seq[j] = seq[j + 1];
                  seq[j + 1] = temp;
                }
              }
            }
            //容积率大于上限（原则上不会出现）
            if(plotRatio > plotRatio_max){
              run = false;
              warning = "未知错误，容积率大于上限";
              break;
            }
              //容积率小于下限
            else{
              //逐建筑上调楼层数
              int j = 0;
              while(value_ftemp < plotRatio_min * boundaryArea){
                bs[j].floor_num += 1;
                value_ftemp += AreaMassProperties.Compute(bs[seq[j]].shape).Area;
                j++;
                if(j == bs.Count){
                  break;
                }
              }
              //逐建筑上调，可拟合容积率则继续重新迭代
              if(value_ftemp < plotRatio_min * boundaryArea){
                ifFloorLimit = true;
                ifLimit = true;
                totalOverlap = double.MaxValue;
                count = 0;
                for(int i = 0;i < bs.Count;i++){
                  bs[i].offShape = bs[i].CreateBuffer(bs[i].shape, bs[i].floor_height * bs[i].floor_num);
                }
                tt.Add(33);
                continue;
              }
                //由于建筑缩小的原因，全部建筑的层楼数加一，容积率仍低于下限，则Count-1
              else{
                build_num = bs.Count - 1;
                //超出范围，退出循环
                if(build_num > build_num_max || build_num < build_num_min){
                  run = false;
                  warning = "拟合失败4，无法拟合参数，请适当放宽";
                  break;
                }
                com_void.Change_build_num(build_num, floor_max, plotRatio_max, shape_type, ref shape_types, ref randomPoints, ref bs, ref ifFloorLimit, ref totalOverlap, ref count);
                ifScaleLimit = !ifChangeScale;
                ifLimit = false;
                //开启新循环
                tt.Add(44);
                continue;
              }
            }
          }
            //容积率在范围内
          else{
            run = true;
            warning = "拟合成功";
            break;
          }
        }
      }
    }

    //====输出=====
    footPrint = new List<Curve>();
    offSet = new List<Curve>();
    height_list = new List<double>();




    for(int i = 0; i < bs.Count; i++){
      footPrint.Add(bs[i].shape);
      offSet.Add(bs[i].offShape);
      tt.Add(AreaMassProperties.Compute(bs[i].shape).Area);
      tt.Add(bs[i].floor_num);
      height_list.Add(floor_height * bs[i].floor_num);
    }
    Buildings = footPrint;
    OffShape = offSet;
    Height = height_list;

    //计算建筑密度与容积率
    double value_atemp1 = 0;
    double value_ftemp1 = 0;
    for(int i = 0;i < bs.Count;i++)
    {
      value_atemp1 += AreaMassProperties.Compute(bs[i].shape).Area;
      value_ftemp1 += bs[i].floor_num * AreaMassProperties.Compute(bs[i].shape).Area;
    }
    density = value_atemp1 / boundaryArea;
    plotRatio = value_ftemp1 / boundaryArea;
    tt.Add(build_num);
    tt.Add(density);
    tt.Add(plotRatio);
    tt.Add(com_void.CheckOverlap_bs(bs));
    Message = tt;
    Tips = warning;

    other = new List<double>();
    other.Add(floor_height);
    other.Add(direction);
    other.Add(shadow_ratio);
    other.Add(boundaryArea);
    X = other;
# ---------- 生成建筑: C# additional code ----------
  //全局变量
  List<Building> bs;
  Common_void com_void;
  List<Curve> footPrint;
  List<Curve> offSet;
  List<double> height_list;
  List<double> other;


  //建筑单体类
  public class Building{
    //边界
    public Curve boundary;
    //边界中心
    public Point3d siteCenter;
    //静态建筑
    public List<Curve> build_steady;

    //建筑本身信息
    public Point3d pos;
    public Curve shape;
    public int direction;
    public double floor_height;
    public int floor_num;

    //缓冲
    public Curve offShape;
    //动量
    public Vector3d move;
    //重叠面积
    public double overlapArea;


    public double shadow_ratio;
    public int scale_dnum;
    public bool alimit;
    public Random rand;

    public Building(Curve boundary_, List<Curve> build_steady_, Point3d pos_, Curve shape_, double floor_height_, int floor_num_, int scale_dnum_, int direction_, double shadow_ratio_){
      pos = new Point3d();
      floor_height = new double();
      floor_num = new int();
      scale_dnum = new int();
      boundary = boundary_;
      build_steady = build_steady_;
      pos = pos_;
      shape = shape_;
      floor_height = floor_height_;
      floor_num = floor_num_;
      scale_dnum = scale_dnum_;
      direction = direction_;
      shadow_ratio = shadow_ratio_;

      siteCenter = GetCenter(boundary);

      //建筑原型中心
      Point3d center = AreaMassProperties.Compute(shape).Centroid;
      //移动到随机位置
      shape.Translate(new Vector3d(pos.X - center.X, pos.Y - center.Y, 0));
      //旋转图形
      shape = RotateCurve(shape, -1 * direction * Math.PI / 180, new Plane(AreaMassProperties.Compute(shape).Centroid, new Vector3d(0, 0, 1)));
      //创建缓冲
      offShape = CreateBuffer(shape, floor_height * floor_num);

      overlapArea = 0;
      if(scale_dnum > 0){
        alimit = false;
      }
      else{alimit = true;}
      rand = new Random();

    }

    //计算图形几何中心
    private Point3d GetCenter(Curve c){
      Point3d center = AreaMassProperties.Compute(c).Centroid;
      return center;
    }

    //清空各智能体的存储数据——>不符合要求的面积总和
    public void ClearOverlapArea(){
      overlapArea = 0;
    }

    //计算各智能体楼层数&&创建缓冲
    public void CalculateHeight(){
      offShape = CreateBuffer(shape, floor_height * floor_num);
    }
    //判断方向
    public string JudgeDirection(Point3d x1, Point3d x0){
      string direction = "";
      if(Math.Abs(x1.X - x0.X) > Math.Abs(x1.Y - x0.Y)){
        //北侧
        if((x1.X - x0.X) > 0){
          direction = "北";
        }
          //南侧
        else{
          direction = "南";
        }
      }
      else
      {
        //东侧
        if((x1.Y - x0.Y) < 0){
          direction = "东";
        }
          //西侧
        else{
          direction = "西";
        }
      }
      return direction;
    }
    //创建缓冲
    public Curve CreateBuffer(Curve x, double y)
    {
      //摆正图形
      x = RotateCurve(x, direction * Math.PI / 180, new Plane(AreaMassProperties.Compute(x).Centroid, new Vector3d(0, 0, 1)));
      List<Point3d> points_o = new List<Point3d>();
      List<Point3d> points_c1 = new List<Point3d>();
      List<Point3d> points_c2 = new List<Point3d>();
      int points_num = x.ToNurbsCurve().Points.Count;
      for (int i = 0;i < points_num;i++)
      {
        Point3d temp = new Point3d();
        x.ToNurbsCurve().Points.GetPoint(i, out temp);
        points_o.Add(temp);
        points_c1.Add(temp);
        points_c2.Add(temp);
      }
      Point3d point_judge = AreaMassProperties.Compute(x).Centroid;
      //计算东南西北侧方向上的缓冲距离
      double distance_N,distance_E,distance_W,distance;
      //if(0.3 * (y+20)< 6){
      //distance_E = distance_W = 6;
      //}
      //else{
      //distance_E = distance_W = 0.3 * 30 + 0.1 * y - 30 * 0.1;
      //}
      distance_E = distance_W = 0.3 * (y + 20);
      double sinHs = Math.Sin(Math.PI / 180 * 23) * Math.Sin(Math.PI / 180 * -23.5) + Math.Cos(Math.PI / 180 * 23) * Math.Cos(Math.PI / 180 * -23.5) * Math.Cos(0);
      double L = Math.Sqrt((y / sinHs) * (y / sinHs) - y * y);
      distance_N = L;
      distance_N = shadow_ratio * y;
      /*
      //找出最北面的边的长度
      List<Point3d> point_n = new List<Point3d>();
      point_n.Add(points_o[0]);
      point_n.Add(points_o[1]);
      for (int i = 0;i < points_num - 1;i++){
        //南北侧
        if(Math.Abs(points_o[i + 1].X - points_o[i].X) > Math.Abs(points_o[i + 1].Y - points_o[i].Y))
        {
          //北侧
          if((points_o[i + 1].X - points_o[i].X) > 0)
          {
            if((points_o[i + 1].Y + points_o[i].Y) > (point_n[0].Y + point_n[1].Y))
            {
              point_n.RemoveAt(1);
              point_n.RemoveAt(0);
              point_n.Add(points_o[i]);
              point_n.Add(points_o[i + 1]);
            }
          }
        }
      }
      */
      //图形均基于顺时针构建，因而可根据两点所形成的矢量方向，判断需要构建哪一方向的缓冲，最后用两点位置的移动进行缓冲的构建
      for (int i = 0;i < points_num - 1;i++){
        int[] i_list = new int[6];
        int temp_0 = i - 2;
        for(int j = 0;j < 6;j++){
          i_list[j] = temp_0;
          temp_0 += 1;
        }
        for(int j = 0;j < 6;j++){
          if(i_list[j] < 0){
            i_list[j] = i_list[j] + points_num - 1;
          }
          if(i_list[j] >= points_num - 1){
            i_list[j] = i_list[j] - points_num + 1;
          }
        }
        distance = 0;
        if(JudgeDirection(points_o[i_list[3]], points_o[i_list[2]]) == "西"){
          if((points_o[i_list[2]].X + points_o[i_list[3]].X) / 2 < pos.X){
            distance = distance_W;/*
            if(JudgeDirection(points_o[i_list[4]], points_o[i_list[3]]) == "南"){
            if(JudgeDirection(points_o[i_list[5]], points_o[i_list[4]]) == "东"){
            distance = 0;
            }
            }
            if(JudgeDirection(points_o[i_list[2]], points_o[i_list[1]]) == "北"){
            if(JudgeDirection(points_o[i_list[1]], points_o[i_list[0]]) == "东"){
            distance = 0;
            }
            }
            */
          }

        }
        else if(JudgeDirection(points_o[i_list[3]], points_o[i_list[2]]) == "东"){
          if((points_o[i_list[2]].X + points_o[i_list[3]].X) / 2 > pos.X){
            distance = distance_E;
            /*
            if(JudgeDirection(points_o[i_list[4]], points_o[i_list[3]]) == "北"){
              if(JudgeDirection(points_o[i_list[5]], points_o[i_list[4]]) == "西"){
                distance = 0;
              }
            }
            if(JudgeDirection(points_o[i_list[2]], points_o[i_list[1]]) == "南"){
              if(JudgeDirection(points_o[i_list[1]], points_o[i_list[0]]) == "西"){
                distance = 0;
              }
            }
      */
          }
        }
        else if(JudgeDirection(points_o[i_list[3]], points_o[i_list[2]]) == "南"){
          if((points_o[i_list[2]].Y + points_o[i_list[3]].Y) / 2 < pos.Y){
            distance = 8;
          }
        }
        else if(JudgeDirection(points_o[i_list[3]], points_o[i_list[2]]) == "北"){
          if((points_o[i_list[2]].Y + points_o[i_list[3]].Y) / 2 > pos.Y){
            distance = distance_N;
          }
        }
        //线中心
        Point3d line_center = new Point3d((points_o[i + 1].X + points_o[i].X) / 2, (points_o[i + 1].Y + points_o[i].Y) / 2, 0);
        //两点成线
        List<Point3d> line_p = new List<Point3d>();
        line_p.Add(points_o[i]);
        line_p.Add(points_o[i + 1]);
        Curve line = new Polyline(line_p).ToNurbsCurve();
        //旋转90度
        Curve line_cz = RotateCurve(line, 0.5 * Math.PI, new Plane(line_center, new Vector3d(0, 0, 1)));
        //单位化
        Vector3d vec = Point3d.Subtract(line_cz.PointAtEnd, line_cz.PointAtStart);
        vec.Unitize();
        //移动
        line.Translate(distance * vec);
        Point3d temp;
        //写入点
        if(JudgeDirection(points_o[i_list[3]], points_o[i_list[2]]) == "西" || JudgeDirection(points_o[i_list[3]], points_o[i_list[2]]) == "东"){
          //东西侧
          temp = new Point3d(line.PointAtStart.X, points_c1[i].Y, points_c1[i].Z);
          points_c1.RemoveAt(i);
          points_c1.Insert(i, temp);
          temp = new Point3d(line.PointAtEnd.X, points_c1[i + 1].Y, points_c1[i + 1].Z);
          points_c1.RemoveAt(i + 1);
          points_c1.Insert(i + 1, temp);

        }
        else if(JudgeDirection(points_o[i_list[3]], points_o[i_list[2]]) == "南"){
          //南侧
          temp = new Point3d(points_c1[i].X, line.PointAtStart.Y, points_c1[i].Z);
          points_c1.RemoveAt(i);
          points_c1.Insert(i, temp);
          temp = new Point3d(points_c1[i + 1].X, line.PointAtEnd.Y, points_c1[i + 1].Z);
          points_c1.RemoveAt(i + 1);
          points_c1.Insert(i + 1, temp);
        }
        else if(JudgeDirection(points_o[i_list[3]], points_o[i_list[2]]) == "北"){
          //北侧
          temp = new Point3d(points_c2[i].X, line.PointAtStart.Y, points_c2[i].Z);
          points_c2.RemoveAt(i);
          points_c2.Insert(i, temp);
          temp = new Point3d(points_c2[i + 1].X, line.PointAtEnd.Y, points_c2[i + 1].Z);
          points_c2.RemoveAt(i + 1);
          points_c2.Insert(i + 1, temp);
        }
      }
      //计算一个新的重合点，因为建筑轮廓上第一个点与最后一个点重合，构建缓冲后不重合
      double temp_x,temp_y;
      if(points_o[0].X == points_c1[0].X)
      {
        temp_x = points_c1[points_num - 1].X;
        temp_y = points_c1[0].Y;
      }
      else
      {
        temp_x = points_c1[0].X;
        temp_y = points_c1[points_num - 1].Y;
      }
      Point3d point_orignal = new Point3d(temp_x, temp_y, points_c1[0].Z);
      //重合点替换第一点
      points_c1.RemoveAt(0);
      points_c1.Insert(0, point_orignal);
      //重合点替换最后一点
      points_c1.RemoveAt(points_num - 1);
      points_c1.Insert(points_num - 1, point_orignal);
      Curve buffer1 = new Polyline(points_c1).ToNurbsCurve();
      /*
      if(points_o[0].X == points_c2[0].X)
      {
        temp_x = points_c2[points_num - 1].X;
        temp_y = points_c2[0].Y;
      }
      else
      {
        temp_x = points_c2[0].X;
        temp_y = points_c2[points_num - 1].Y;
      }
      */
      temp_x = points_c2[0].X;
      if(points_c2[0].Y > points_c2[points_num - 1].Y){
        temp_y = points_c2[0].Y;
      }
      else{
        temp_y = points_c2[points_num - 1].Y;
      }
      point_orignal = new Point3d(temp_x, temp_y, points_c2[0].Z);
      points_c2.RemoveAt(0);
      points_c2.Insert(0, point_orignal);
      points_c2.RemoveAt(points_num - 1);
      points_c2.Insert(points_num - 1, point_orignal);
      Curve buffer2 = new Polyline(points_c2).ToNurbsCurve();
      List<Curve> buffer0 = new List<Curve>();
      buffer0.Add(buffer1);
      buffer0.Add(buffer2);
      Curve buffer = Curve.CreateBooleanUnion(buffer0)[0];
      //旋转图形
      buffer = RotateCurve(buffer, -1 * direction * Math.PI / 180, new Plane(AreaMassProperties.Compute(buffer).Centroid, new Vector3d(0, 0, 1)));
      return buffer;
    }

    public Curve RotateCurve(Curve x, double angle, Plane p){
      var func_info = Rhino.NodeInCode.Components.FindComponent("Rotate");
      var func = func_info.Delegate as dynamic;
      var result = func(x, angle, p);
      List<Curve> curve_return = new List<Curve>();
      foreach (var temppp in result[0])
      {
        curve_return.Add((Curve) temppp);
      }
      return curve_return[0];
    }

    //避免中心点重叠
    public void Overlap(List < Building > buildings){
      Vector3d randMove = new Vector3d(0, 0, 0);
      for(int i = 0; i < buildings.Count; i++){
        Building b = buildings[i];
        if(b != this && pos == b.pos){
          double randDir = Math.PI * rand.NextDouble();
          double bArea = AreaMassProperties.Compute(b.offShape).Area; //面积越大移动越远
          randMove = new Vector3d(Math.Cos(randDir) * bArea * 0.005, Math.Sin(randDir) * bArea * 0.005, 0);
          break;
        }
      }
      pos = Point3d.Add(pos, randMove);
      shape.Translate(randMove);
      offShape.Translate(randMove);
    }


    //计算不符合建筑智能体超出边界及重合静止建筑的面积
    public void OverlapArea(){
      overlapArea = 0;
      Curve[] differC = Curve.CreateBooleanDifference(shape, boundary, 0.000001);
      if(differC.Length != 0){
        for (int i = 0; i < differC.Length; i++){
          overlapArea += AreaMassProperties.Compute(differC[i]).Area;
        }
      }
      for(int i = 0;i < build_steady.Count;i++){
        Curve[] intersecs = Curve.CreateBooleanIntersection(shape, build_steady[i], 0.000001);
        if(intersecs.Length != 0){
          for (int j = 0; j < intersecs.Length; j++){
            overlapArea += AreaMassProperties.Compute(intersecs[j]).Area;
          }
        }
      }
    }
    //计算场地边界对出界智能体的动量,以及静止建筑对重合智能体的动量
    public void CheckEdge(){
      Curve[] differC = Curve.CreateBooleanDifference(shape, boundary, 0.000001);
      if(differC.Length != 0){
        Vector3d pushBack = new Vector3d();
        for (int i = 0; i < differC.Length; i++){
          overlapArea += AreaMassProperties.Compute(differC[i]).Area;
          Point3d subCenter = GetCenter(differC[i]);
          Vector3d push = Point3d.Subtract(siteCenter, subCenter);
          pushBack = Vector3d.Add(pushBack, push);
        }
        pushBack = Vector3d.Multiply(pushBack, 2.5 / pushBack.Length);
        move += pushBack;
      }
      for(int i = 0;i < build_steady.Count;i++){
        Curve[] intersecs = Curve.CreateBooleanIntersection(shape, build_steady[i], 0.000001);
        double overlap = 0;
        if(intersecs.Length != 0){
          for (int j = 0; j < intersecs.Length; j++){
            overlap += AreaMassProperties.Compute(intersecs[j]).Area;
            Point3d interCenter = GetCenter(intersecs[j]);
            Vector3d pi = Point3d.Subtract(pos, interCenter);
            if(pi.Length == 0){
              pi = Point3d.Subtract(pos, GetCenter(build_steady[i]));
            }
            double dist = pos.DistanceTo(GetCenter(build_steady[i]));
            pi = Vector3d.Multiply(pi, 4 / dist);
            move = Vector3d.Add(move, Vector3d.Multiply(pi, 0.5));
          }
        }
      }
    }
    /*
    //计算静止建筑对重合智能体的动量
    public void CheckSteadyBuild(){
      for(int i = 0;i < build_steady.Count;i++){
        Curve[] intersecs = Curve.CreateBooleanIntersection(shape, build_steady[i], 0.000001);
        double overlap = 0;
        if(intersecs.Length != 0){
          for (int j = 0; j < intersecs.Length; j++){
            overlap += AreaMassProperties.Compute(intersecs[j]).Area;
            Point3d interCenter = GetCenter(intersecs[j]);
            Vector3d pi = Point3d.Subtract(pos, interCenter);
            if(pi.Length == 0){
              pi = Point3d.Subtract(pos, GetCenter(build_steady[i]));
            }
            double dist = pos.DistanceTo(GetCenter(build_steady[i]));
            pi = Vector3d.Multiply(pi, 4 / dist);
            move = Vector3d.Add(move, Vector3d.Multiply(pi, 0.5));
          }
        }
      }
    }
  */


    //判断该智能体是否与某智能体缓冲区内重叠，若有则两智能体都增加动量
    public void Seperate (Building b){
      double overlap = 0;
      Curve[] intersecs = Curve.CreateBooleanIntersection(shape, b.offShape, 0.000001);
      if(intersecs.Length != 0){
        for (int j = 0; j < intersecs.Length; j++){
          overlap += AreaMassProperties.Compute(intersecs[j]).Area;
          Point3d interCenter = GetCenter(intersecs[j]);
          Vector3d pi = Point3d.Subtract(pos, interCenter);
          Vector3d pj = Point3d.Subtract(GetCenter(b.offShape), interCenter);
          if(pi.Length == 0){
            pi = Point3d.Subtract(pos, b.pos);
            pj = Point3d.Subtract(b.pos, pos);
          }

          double dist = pos.DistanceTo(GetCenter(b.offShape));
          pi = Vector3d.Multiply(pi, 4 / dist);
          pj = Vector3d.Multiply(pj, 4 / dist);
          move = Vector3d.Add(move, Vector3d.Multiply(pi, 0.5));
          b.move = Vector3d.Add(b.move, Vector3d.Multiply(pj, 0.5));
        }
      }
    }

    //根据动量更新智能体位置
    public void Update (){
      pos = Point3d.Add(pos, move);
      shape.Translate(move);
      offShape.Translate(move);
      move = Vector3d.Multiply(move, 0);
    }

    //缩小
    public bool Narrow (double scale_factor){
      if(scale_dnum > 0)
      {
        shape.Transform(Transform.Scale(pos, scale_factor));
        offShape = CreateBuffer(shape, floor_height * floor_num);
        scale_dnum -= 1;
      }
      if(scale_dnum == 0)
      {
        alimit = true;
      }
      return(!alimit);
    }

    //计算各智能体不符合要求面积——>逾越场地边界的面积与其他智能体缓冲区内的重叠面积
    public void UpdateOverlap (List < Building > buildings){
      overlapArea = 0;
      for(int i = 0; i < buildings.Count; i++){
        Building b = buildings[i];
        Curve[] intersecs = Curve.CreateBooleanIntersection(shape, b.offShape, 0.000001);
        if(intersecs.Length != 0){
          for (int j = 0; j < intersecs.Length; j++){
            overlapArea += AreaMassProperties.Compute(intersecs[j]).Area;
          }
        }
      }
      Curve[] differC = Curve.CreateBooleanDifference(shape, boundary, 0.000001);
      if(differC.Length != 0){
        for (int i = 0; i < differC.Length; i++){
          overlapArea += AreaMassProperties.Compute(differC[i]).Area;
        }
      }
      for(int i = 0;i < build_steady.Count;i++){
        Curve[] intersecs = Curve.CreateBooleanIntersection(shape, build_steady[i], 0.000001);
        if(intersecs.Length != 0){
          for (int j = 0; j < intersecs.Length; j++){
            overlapArea += AreaMassProperties.Compute(intersecs[j]).Area;
          }
        }
      }

    }
  }


  //常用方法
  public class Common_void{
    public Common_void(){}

    //计算所有智能体不符合要求面积总和——>逾越场地边界的面积与其他智能体缓冲区内的重叠面积
    public double CheckOverlap_bs (List < Building > bs){
      double totalOverlap = 0;
      for(int i = 0; i < bs.Count; i++){
        for(int j = 0; j < bs.Count; j++){
          if(i != j)
          {
            Curve[] intersecs = Curve.CreateBooleanIntersection(bs[i].shape, bs[j].offShape, 0.000001);
            if(intersecs.Length != 0){
              for (int k = 0; k < intersecs.Length; k++){
                totalOverlap += AreaMassProperties.Compute(intersecs[k]).Area;
              }
            }
            intersecs = Curve.CreateBooleanIntersection(bs[j].shape, bs[i].offShape, 0.000001);
            if(intersecs.Length != 0){
              for (int k = 0; k < intersecs.Length; k++){
                totalOverlap += AreaMassProperties.Compute(intersecs[k]).Area;
              }
            }
          }
        }
        Curve[] differC = Curve.CreateBooleanDifference(bs[i].shape, bs[i].boundary, 0.000001);
        if(differC.Length != 0){
          for (int j = 0; j < differC.Length; j++){
            totalOverlap += AreaMassProperties.Compute(differC[j]).Area;
          }
        }
        for(int j = 0;j < bs[i].build_steady.Count;j++){
          Curve[] intersecs = Curve.CreateBooleanIntersection(bs[i].shape, bs[i].build_steady[j], 0.000001);
          if(intersecs.Length != 0){
            for (int k = 0; k < intersecs.Length; k++){
              totalOverlap += AreaMassProperties.Compute(intersecs[k]).Area;
            }
          }
        }
      }
      return totalOverlap;
    }

    //计算建筑基底的总面积
    public double CalculateTotalArea(List < Curve > curve)
    {
      double result = 0;
      for(int i = 0; i < curve.Count; i++)
      {
        result += AreaMassProperties.Compute(curve[i]).Area;
      }
      return result;
    }

    public int GetScaleANum(List < Building > bs)
    {
      int result = 0;
      for(int i = 0;i < bs.Count;i++)
      {
        if(bs[i].alimit == true)
        {
          result += 1;
        }
      }
      return result;
    }
    public List<Point3d> GetRandomPoints(int i, Curve curve)
    {
      var func_info = Rhino.NodeInCode.Components.FindComponent("PopulateGeometry");
      var func = func_info.Delegate as dynamic;
      List<Curve> curves = new List<Curve>();
      curves.Add(curve);
      var result = func(Brep.CreatePlanarBreps(curves), i, 1, null);
      List<Point3d> points = new List<Point3d>();
      foreach (var temp in result)
      {
        points.Add((Point3d) temp);
      }
      return points;
    }
    public List<Curve> RepeatCurve(int i, Curve curve)
    {
      var func_info = Rhino.NodeInCode.Components.FindComponent("RepeatData");
      var func = func_info.Delegate as dynamic;
      var result = func(curve, i);

      List<Curve> curves = new List<Curve>();
      foreach (var temp in result)
      {
        curves.Add((Curve) temp);
      }
      return curves;
    }

    public void Change_build_num(int build_num, int floor_max, double plotRatio_max, Curve shape_type, ref List< Curve> shape_types, ref List<Point3d> randomPoints, ref List<Building> bs, ref bool ifFloorLimit, ref double totalOverlap, ref double count){
      Curve boundary = bs[0].boundary;
      List< Curve> build_steady = bs[0].build_steady;
      double floor_height = bs[0].floor_height;
      int floor_num = bs[0].floor_num;
      int scale_dnum = bs[0].scale_dnum;
      int direction = bs[0].direction;
      double shadow_ratio = bs[0].shadow_ratio;
      double boundaryArea = AreaMassProperties.Compute(boundary).Area;
      double shape_area = AreaMassProperties.Compute(shape_type).Area;
      int floor_num_temp;


      randomPoints.Clear();
      randomPoints = GetRandomPoints(build_num, boundary);
      shape_types.Clear();
      shape_types = RepeatCurve(build_num, shape_type);
      if(floor_max > (int) (plotRatio_max * boundaryArea / (build_num * shape_area)))
      {
        floor_num_temp = (int) (plotRatio_max * boundaryArea / (build_num * shape_area));
      }
      else{
        floor_num_temp = floor_max;
      }
      bs.Clear();
      for(int i = 0; i < build_num; i++){
        Building b = new Building(boundary, build_steady, randomPoints[i], shape_types[i], floor_height, floor_num_temp, scale_dnum, direction, shadow_ratio);
        bs.Add(b);
      }

      ifFloorLimit = false;
      totalOverlap = double.MaxValue;
      count = 0;
    }

  }
# ---------- end 生成建筑 ----------
panel = Panel(c_script_2)
panel_2 = Panel(生成建筑.Tips)

geometry = Geometry(生成建筑.Buildings)
panel_3 = Panel(生成建筑.Message)

# ----
# 三维拉伸
number_slider = Slider(8, range=0..50)
层数 = CSharpScript(min=number_slider, max=Slider(48, range=0..100))  # -> floor; inputs min: Int32, max: Int32
# ---------- 层数: C# ----------
    if(min<max){
      List<int> temp = new List<int>();
      temp.Add(min);
      temp.Add(max);
      floor = temp;
    }
# ---------- end 层数 ----------
楼层随机化 = CSharpScript(
    floor=层数,
    X=生成建筑.X,
    boundary=生成建筑.Boundary,
    build_steady=生成建筑.Build_steady,
    buildings=生成建筑.Buildings,
    height=生成建筑.Height,
    random=Toggle(False))  # -> B, O, H; inputs floor: list of Int32, X: list of Double, boundary: Curve, build_steady: list of Curve, buildings: list of Curve, height: list of Double, random: Boolean; disabled
# ---------- 楼层随机化: C# ----------
    com_void = new Common_void();

    double floor_height = X[0];
    double direction = X[1];
    double shadow_ratio = X[2];
    double bondaryArea = X[3];

    int floor_min = floor[0];
    int floor_max = floor[1];
    int floor_total = 0;
    for(int i = 0; i < buildings.Count; i++){
      floor_total += (int) (height[i] / floor_height);
    }

    double value_fori = 0;
    bs = new List<Building>();
    List<int> ttt = new List<int>();
    List<Curve> tempppppp = new List<Curve>();
    for(int i = 0; i < buildings.Count; i++){
      Building b = new Building(boundary, build_steady, AreaMassProperties.Compute(buildings[i]).Centroid, buildings[i], floor_height, (int) (height[i] / floor_height), (int) direction, shadow_ratio);
      bs.Add(b);
      value_fori += bs[i].floor_num * AreaMassProperties.Compute(bs[i].shape).Area;
    }



    List<int> seqq = new List<int>();
    List<int> seqqq = new List<int>();
    for(int i = 0;i < bs.Count ;i++){
      seqq.Add(i);
      seqqq.Add(i);
    }
    //获取从北到南的相应索引
    int temp = 0;
    for(int i = 0;i < seqq.Count - 1;i++){
      for(int j = 0;j < seqq.Count - i - 1;j++){
        if(bs[seqq[j]].pos.Y < bs[seqq[j + 1]].pos.Y){
          temp = seqq[j];
          seqq[j] = seqq[j + 1];
          seqq[j + 1] = temp;
        }
      }
    }

    //楼层随机数
    int[] randomfloor = com_void.Random_assignment(floor_total, floor_min, floor_max, buildings.Count);
    int is_sucess = 0;
    for (int i = 0; i < randomfloor.Length; i++)
    {
      is_sucess += randomfloor[i];
    }
    if(random == true && is_sucess == floor_total){
      double value_ftemp = 0;
      //分配楼层数量
      for(int i = 0;i < bs.Count;i++){
        bs[seqq[i]].floor_num = randomfloor[i];
        value_ftemp += bs[i].floor_num * AreaMassProperties.Compute(bs[i].shape).Area;
        bs[i].offShape = bs[i].CreateBuffer(bs[i].shape, bs[i].floor_height * bs[i].floor_num);
      }

      //重新分配楼层后，使容积率接近原来
      int k = 0;
      if(value_ftemp > value_fori){
        while(value_ftemp > value_fori){
          if(bs[seqq[k]].floor_num - 1 >= floor_min){
            bs[seqq[k]].floor_num = bs[seqq[k]].floor_num - 1;
            value_ftemp -= AreaMassProperties.Compute(bs[k].shape).Area;
          }
          k++;
          if(k == bs.Count){
            k = k - bs.Count;
          }
        }
      }
      else if(value_ftemp < value_fori){
        while(value_ftemp < value_fori){
          if(bs[seqq[bs.Count - 1 - k]].floor_num + 1 <= floor_max){
            bs[seqq[bs.Count - 1 - k]].floor_num = bs[seqq[bs.Count - 1 - k]].floor_num + 1;
            value_ftemp += AreaMassProperties.Compute(bs[bs.Count - 1 - k].shape).Area;
          }
          k++;
          if(k == bs.Count){
            k = k - bs.Count;
          }
        }
        bs[seqq[0]].floor_num = bs[seqq[0]].floor_num - 1;
        value_ftemp -= AreaMassProperties.Compute(bs[0].shape).Area;
      }

      //获取楼层从高到低的索引
      temp = 0;
      for(int i = 0;i < seqqq.Count - 1;i++){
        for(int j = 0;j < seqqq.Count - i - 1;j++){
          if(bs[seqqq[j]].floor_num < bs[seqqq[j + 1]].floor_num){
            temp = seqqq[j];
            seqqq[j] = seqqq[j + 1];
            seqqq[j + 1] = temp;
          }
        }
      }
      //从北到南几何中心位置
      List<Point3d> center_ori = new List<Point3d>();
      for(int i = 0;i < bs.Count ;i++){
        center_ori.Add(bs[seqq[i]].pos);
      }

      //移动位置
      for(int i = 0;i < bs.Count ;i++){
        bs[seqqq[i]].shape.Translate(new Vector3d(center_ori[i].X - bs[seqqq[i]].pos.X, center_ori[i].Y - bs[seqqq[i]].pos.Y, 0));
        bs[seqqq[i]].pos = center_ori[i];
        bs[seqqq[i]].offShape = bs[seqqq[i]].CreateBuffer(bs[seqqq[i]].shape, bs[seqqq[i]].floor_height * bs[seqqq[i]].floor_num);
      }


      double totalOverlap = double.MaxValue;
      double count = 0;
      while(count < 700 && totalOverlap <= 0){
        totalOverlap = 0;
        for(int i = 0;i < bs.Count;i++){
          //计算场地边界对出界智能体的动量
          bs[i].CheckEdge();
          //根据该智能体与其他智能体的缓冲边界内的重叠情况，计算动量
          for(int j = 0; j < bs.Count; j++){
            if(i != j){
              bs[i].Seperate(bs[j]);
            }
          }
          //根据动量更新智能体位置
          bs[i].Update();
          //清空各智能体的存储数据——>不符合要求的面积总和
          bs[i].ClearOverlapArea();
        }
        totalOverlap = com_void.CheckOverlap_bs(bs);
        count++;
      }
    }


    //====输出=====
    footPrint = new List<Curve>();
    offSet = new List<Curve>();
    height_list = new List<double>();

    for(int i = 0; i < bs.Count; i++){
      footPrint.Add(bs[i].shape);
      offSet.Add(bs[i].offShape);
      height_list.Add(floor_height * bs[i].floor_num);
    }
    B = footPrint;
    O = offSet;
    H = height_list;
# ---------- 楼层随机化: C# additional code ----------
  //全局变量
  List<Building> bs;
  Common_void com_void;
  List<Curve> footPrint;
  List<Curve> offSet;
  List<double> height_list;


  //以下为构建建筑单体智能体代码
  public class Building{
    public Curve boundary;
    public List<Curve> build_steady;
    public Point3d pos;
    public Curve shape;
    public double floor_height;
    public int floor_num;
    public double shadow_ratio;

    public int direction;
    public Point3d siteCenter;
    public Curve offShape;
    public Vector3d move;

    public double overlapArea;
    public Random rand;

    public Building(Curve boundary_, List<Curve> build_steady_, Point3d pos_, Curve shape_, double floor_height_, int floor_num_, int direction_, double shadow_ratio_){

      pos = new Point3d();
      floor_height = new double();
      floor_num = new int();
      boundary = boundary_;
      build_steady = build_steady_;
      pos = pos_;
      shape = shape_;
      floor_height = floor_height_;
      floor_num = floor_num_;
      direction = direction_;
      shadow_ratio = shadow_ratio_;


      siteCenter = GetCenter(boundary);
      Point3d center = AreaMassProperties.Compute(shape).Centroid;
      shape.Translate(new Vector3d(pos.X - center.X, pos.Y - center.Y, 0));
      //旋转图形
      shape = RotateCurve(shape, -1 * direction * Math.PI / 180, new Plane(AreaMassProperties.Compute(shape).Centroid, new Vector3d(0, 0, 1)));
      offShape = CreateBuffer(shape, floor_height * floor_num);

      overlapArea = 0;
    }

    //计算图形几何中心
    private Point3d GetCenter(Curve c){
      Point3d center = AreaMassProperties.Compute(c).Centroid;
      return center;
    }

    //清空各智能体的存储数据——>不符合要求的面积总和
    public void ClearOverlapArea(){
      overlapArea = 0;
    }

    //计算各智能体楼层数&&创建缓冲
    public void CalculateHeight(){
      offShape = CreateBuffer(shape, floor_height * floor_num);
    }

    //创建缓冲
    public Curve CreateBuffer(Curve x, double y)
    {
      //摆正图形
      x = RotateCurve(x, direction * Math.PI / 180, new Plane(AreaMassProperties.Compute(x).Centroid, new Vector3d(0, 0, 1)));
      List<Point3d> points_o = new List<Point3d>();
      List<Point3d> points_c1 = new List<Point3d>();
      List<Point3d> points_c2 = new List<Point3d>();
      int points_num = x.ToNurbsCurve().Points.Count;
      for (int i = 0;i < points_num;i++)
      {
        Point3d temp = new Point3d();
        x.ToNurbsCurve().Points.GetPoint(i, out temp);
        points_o.Add(temp);
        points_c1.Add(temp);
        points_c2.Add(temp);
      }
      Point3d point_judge = AreaMassProperties.Compute(x).Centroid;
      //计算东南西北侧方向上的缓冲距离
      double distance_N,distance_E,distance_W,distance;
      //if(0.3 * (y+20)< 6){
      //distance_E = distance_W = 6;
      //}
      //else{
      //distance_E = distance_W = 0.3 * 30 + 0.1 * y - 30 * 0.1;
      //}
      distance_E = distance_W = 0.3 * (y + 20);
      double sinHs = Math.Sin(Math.PI / 180 * 23) * Math.Sin(Math.PI / 180 * -23.5) + Math.Cos(Math.PI / 180 * 23) * Math.Cos(Math.PI / 180 * -23.5) * Math.Cos(0);
      double L = Math.Sqrt((y / sinHs) * (y / sinHs) - y * y);
      distance_N = L;
      distance_N = shadow_ratio * y;
      /*
      //找出最北面的边的长度
      List<Point3d> point_n = new List<Point3d>();
      point_n.Add(points_o[0]);
      point_n.Add(points_o[1]);
      for (int i = 0;i < points_num - 1;i++){
        //南北侧
        if(Math.Abs(points_o[i + 1].X - points_o[i].X) > Math.Abs(points_o[i + 1].Y - points_o[i].Y))
        {
          //北侧
          if((points_o[i + 1].X - points_o[i].X) > 0)
          {
            if((points_o[i + 1].Y + points_o[i].Y) > (point_n[0].Y + point_n[1].Y))
            {
              point_n.RemoveAt(1);
              point_n.RemoveAt(0);
              point_n.Add(points_o[i]);
              point_n.Add(points_o[i + 1]);
            }
          }
        }
      }
      */
      //图形均基于顺时针构建，因而可根据两点所形成的矢量方向，判断需要构建哪一方向的缓冲，最后用两点位置的移动进行缓冲的构建
      for (int i = 0;i < points_num - 1;i++){
        int[] i_list = new int[6];
        int temp_0 = i - 2;
        for(int j = 0;j < 6;j++){
          i_list[j] = temp_0;
          temp_0 += 1;
        }
        for(int j = 0;j < 6;j++){
          if(i_list[j] < 0){
            i_list[j] = i_list[j] + points_num - 1;
          }
          if(i_list[j] >= points_num - 1){
            i_list[j] = i_list[j] - points_num + 1;
          }
        }
        distance = 0;
        if(JudgeDirection(points_o[i_list[3]], points_o[i_list[2]]) == "西"){
          if((points_o[i_list[2]].X + points_o[i_list[3]].X) / 2 < pos.X){
            distance = distance_W;/*
            if(JudgeDirection(points_o[i_list[4]], points_o[i_list[3]]) == "南"){
            if(JudgeDirection(points_o[i_list[5]], points_o[i_list[4]]) == "东"){
            distance = 0;
            }
            }
            if(JudgeDirection(points_o[i_list[2]], points_o[i_list[1]]) == "北"){
            if(JudgeDirection(points_o[i_list[1]], points_o[i_list[0]]) == "东"){
            distance = 0;
            }
            }
            */
          }

        }
        else if(JudgeDirection(points_o[i_list[3]], points_o[i_list[2]]) == "东"){
          if((points_o[i_list[2]].X + points_o[i_list[3]].X) / 2 > pos.X){
            distance = distance_E;
            /*
            if(JudgeDirection(points_o[i_list[4]], points_o[i_list[3]]) == "北"){
              if(JudgeDirection(points_o[i_list[5]], points_o[i_list[4]]) == "西"){
                distance = 0;
              }
            }
            if(JudgeDirection(points_o[i_list[2]], points_o[i_list[1]]) == "南"){
              if(JudgeDirection(points_o[i_list[1]], points_o[i_list[0]]) == "西"){
                distance = 0;
              }
            }
      */
          }
        }
        else if(JudgeDirection(points_o[i_list[3]], points_o[i_list[2]]) == "南"){
          if((points_o[i_list[2]].Y + points_o[i_list[3]].Y) / 2 < pos.Y){
            distance = 8;
          }
        }
        else if(JudgeDirection(points_o[i_list[3]], points_o[i_list[2]]) == "北"){
          if((points_o[i_list[2]].Y + points_o[i_list[3]].Y) / 2 > pos.Y){
            distance = distance_N;
          }
        }
        //线中心
        Point3d line_center = new Point3d((points_o[i + 1].X + points_o[i].X) / 2, (points_o[i + 1].Y + points_o[i].Y) / 2, 0);
        //两点成线
        List<Point3d> line_p = new List<Point3d>();
        line_p.Add(points_o[i]);
        line_p.Add(points_o[i + 1]);
        Curve line = new Polyline(line_p).ToNurbsCurve();
        //旋转90度
        Curve line_cz = RotateCurve(line, 0.5 * Math.PI, new Plane(line_center, new Vector3d(0, 0, 1)));
        //单位化
        Vector3d vec = Point3d.Subtract(line_cz.PointAtEnd, line_cz.PointAtStart);
        vec.Unitize();
        //移动
        line.Translate(distance * vec);
        Point3d temp;
        //写入点
        if(JudgeDirection(points_o[i_list[3]], points_o[i_list[2]]) == "西" || JudgeDirection(points_o[i_list[3]], points_o[i_list[2]]) == "东"){
          //东西侧
          temp = new Point3d(line.PointAtStart.X, points_c1[i].Y, points_c1[i].Z);
          points_c1.RemoveAt(i);
          points_c1.Insert(i, temp);
          temp = new Point3d(line.PointAtEnd.X, points_c1[i + 1].Y, points_c1[i + 1].Z);
          points_c1.RemoveAt(i + 1);
          points_c1.Insert(i + 1, temp);

        }
        else if(JudgeDirection(points_o[i_list[3]], points_o[i_list[2]]) == "南"){
          //南侧
          temp = new Point3d(points_c1[i].X, line.PointAtStart.Y, points_c1[i].Z);
          points_c1.RemoveAt(i);
          points_c1.Insert(i, temp);
          temp = new Point3d(points_c1[i + 1].X, line.PointAtEnd.Y, points_c1[i + 1].Z);
          points_c1.RemoveAt(i + 1);
          points_c1.Insert(i + 1, temp);
        }
        else if(JudgeDirection(points_o[i_list[3]], points_o[i_list[2]]) == "北"){
          //北侧
          temp = new Point3d(points_c2[i].X, line.PointAtStart.Y, points_c2[i].Z);
          points_c2.RemoveAt(i);
          points_c2.Insert(i, temp);
          temp = new Point3d(points_c2[i + 1].X, line.PointAtEnd.Y, points_c2[i + 1].Z);
          points_c2.RemoveAt(i + 1);
          points_c2.Insert(i + 1, temp);
        }
      }
      //计算一个新的重合点，因为建筑轮廓上第一个点与最后一个点重合，构建缓冲后不重合
      double temp_x,temp_y;
      if(points_o[0].X == points_c1[0].X)
      {
        temp_x = points_c1[points_num - 1].X;
        temp_y = points_c1[0].Y;
      }
      else
      {
        temp_x = points_c1[0].X;
        temp_y = points_c1[points_num - 1].Y;
      }
      Point3d point_orignal = new Point3d(temp_x, temp_y, points_c1[0].Z);
      //重合点替换第一点
      points_c1.RemoveAt(0);
      points_c1.Insert(0, point_orignal);
      //重合点替换最后一点
      points_c1.RemoveAt(points_num - 1);
      points_c1.Insert(points_num - 1, point_orignal);
      Curve buffer1 = new Polyline(points_c1).ToNurbsCurve();
      /*
      if(points_o[0].X == points_c2[0].X)
      {
        temp_x = points_c2[points_num - 1].X;
        temp_y = points_c2[0].Y;
      }
      else
      {
        temp_x = points_c2[0].X;
        temp_y = points_c2[points_num - 1].Y;
      }
      */
      temp_x = points_c2[0].X;
      if(points_c2[0].Y > points_c2[points_num - 1].Y){
        temp_y = points_c2[0].Y;
      }
      else{
        temp_y = points_c2[points_num - 1].Y;
      }
      point_orignal = new Point3d(temp_x, temp_y, points_c2[0].Z);
      points_c2.RemoveAt(0);
      points_c2.Insert(0, point_orignal);
      points_c2.RemoveAt(points_num - 1);
      points_c2.Insert(points_num - 1, point_orignal);
      Curve buffer2 = new Polyline(points_c2).ToNurbsCurve();
      List<Curve> buffer0 = new List<Curve>();
      buffer0.Add(buffer1);
      buffer0.Add(buffer2);
      Curve buffer = Curve.CreateBooleanUnion(buffer0)[0];
      //旋转图形
      buffer = RotateCurve(buffer, -1 * direction * Math.PI / 180, new Plane(AreaMassProperties.Compute(buffer).Centroid, new Vector3d(0, 0, 1)));
      return buffer;
    }

    public Curve RotateCurve(Curve x, double angle, Plane p){
      var func_info = Rhino.NodeInCode.Components.FindComponent("Rotate");
      var func = func_info.Delegate as dynamic;
      var result = func(x, angle, p);
      List<Curve> curve_return = new List<Curve>();
      foreach (var temppp in result[0])
      {
        curve_return.Add((Curve) temppp);
      }
      return curve_return[0];
    }

    public string JudgeDirection(Point3d x1, Point3d x0){
      string direction = "";
      if(Math.Abs(x1.X - x0.X) > Math.Abs(x1.Y - x0.Y)){
        //北侧
        if((x1.X - x0.X) > 0){
          direction = "北";
        }
          //南侧
        else{
          direction = "南";
        }
      }
      else
      {
        //东侧
        if((x1.Y - x0.Y) < 0){
          direction = "东";
        }
          //西侧
        else{
          direction = "西";
        }
      }
      return direction;
    }

    //避免中心点重叠
    public void Overlap(List < Building > buildings){
      Vector3d randMove = new Vector3d(0, 0, 0);
      for(int i = 0; i < buildings.Count; i++){
        Building b = buildings[i];
        if(b != this && pos == b.pos){
          double randDir = Math.PI * rand.NextDouble();
          double bArea = AreaMassProperties.Compute(b.offShape).Area; //面积越大移动越远
          randMove = new Vector3d(Math.Cos(randDir) * bArea * 0.005, Math.Sin(randDir) * bArea * 0.005, 0);
          break;
        }
      }
      pos = Point3d.Add(pos, randMove);
      shape.Translate(randMove);
      offShape.Translate(randMove);
    }

    //计算场地边界对出界智能体的动量,以及静止建筑对重合智能体的动量
    public void CheckEdge(){
      Curve[] differC = Curve.CreateBooleanDifference(shape, boundary, 0.000001);
      if(differC.Length != 0){
        Vector3d pushBack = new Vector3d();
        for (int i = 0; i < differC.Length; i++){
          overlapArea += AreaMassProperties.Compute(differC[i]).Area;
          Point3d subCenter = GetCenter(differC[i]);
          Vector3d push = Point3d.Subtract(siteCenter, subCenter);
          pushBack = Vector3d.Add(pushBack, push);
        }
        pushBack = Vector3d.Multiply(pushBack, 2.5 / pushBack.Length);
        move += pushBack;
      }
      for(int i = 0;i < build_steady.Count;i++){
        Curve[] intersecs = Curve.CreateBooleanIntersection(shape, build_steady[i], 0.000001);
        double overlap = 0;
        if(intersecs.Length != 0){
          for (int j = 0; j < intersecs.Length; j++){
            overlap += AreaMassProperties.Compute(intersecs[j]).Area;
            Point3d interCenter = GetCenter(intersecs[j]);
            Vector3d pi = Point3d.Subtract(pos, interCenter);
            if(pi.Length == 0){
              pi = Point3d.Subtract(pos, GetCenter(build_steady[i]));
            }
            double dist = pos.DistanceTo(GetCenter(build_steady[i]));
            pi = Vector3d.Multiply(pi, 4 / dist);
            move = Vector3d.Add(move, Vector3d.Multiply(pi, 0.5));
          }
        }
      }
    }
    //计算静止建筑对重合智能体的动量
    public void CheckSteadyBuild(){
      for(int i = 0;i < build_steady.Count;i++){
        Curve[] intersecs = Curve.CreateBooleanIntersection(shape, build_steady[i], 0.000001);
        double overlap = 0;
        if(intersecs.Length != 0){
          for (int j = 0; j < intersecs.Length; j++){
            overlap += AreaMassProperties.Compute(intersecs[j]).Area;
            Point3d interCenter = GetCenter(intersecs[j]);
            Vector3d pi = Point3d.Subtract(pos, interCenter);
            if(pi.Length == 0){
              pi = Point3d.Subtract(pos, GetCenter(build_steady[i]));
            }
            double dist = pos.DistanceTo(GetCenter(build_steady[i]));
            pi = Vector3d.Multiply(pi, 4 / dist);
            move = Vector3d.Add(move, Vector3d.Multiply(pi, 0.5));
          }
        }
      }
    }

    //判断该智能体是否与某智能体缓冲区内重叠，若有则两智能体都增加动量
    public void Seperate (Building b){
      double overlap = 0;
      Curve[] intersecs = Curve.CreateBooleanIntersection(shape, b.offShape, 0.000001);
      if(intersecs.Length != 0){
        for (int j = 0; j < intersecs.Length; j++){
          overlap += AreaMassProperties.Compute(intersecs[j]).Area;
          Point3d interCenter = GetCenter(intersecs[j]);
          Vector3d pi = Point3d.Subtract(pos, interCenter);
          Vector3d pj = Point3d.Subtract(GetCenter(b.offShape), interCenter);
          if(pi.Length == 0){
            pi = Point3d.Subtract(pos, b.pos);
            pj = Point3d.Subtract(b.pos, pos);
          }

          double dist = pos.DistanceTo(GetCenter(b.offShape));
          pi = Vector3d.Multiply(pi, 4 / dist);
          pj = Vector3d.Multiply(pj, 4 / dist);
          move = Vector3d.Add(move, Vector3d.Multiply(pi, 0.5));
          b.move = Vector3d.Add(b.move, Vector3d.Multiply(pj, 0.5));
        }
      }
    }

    //根据动量更新智能体位置
    public void Update (){
      pos = Point3d.Add(pos, move);
      shape.Translate(move);
      offShape.Translate(move);
      move = Vector3d.Multiply(move, 0);
    }

    //计算各智能体不符合要求面积——>逾越场地边界的面积与其他智能体缓冲区内的重叠面积
    public void UpdateOverlap (List < Building > buildings){
      overlapArea = 0;
      for(int i = 0; i < buildings.Count; i++){
        Building b = buildings[i];
        Curve[] intersecs = Curve.CreateBooleanIntersection(shape, b.offShape, 0.000001);
        if(intersecs.Length != 0){
          for (int j = 0; j < intersecs.Length; j++){
            overlapArea += AreaMassProperties.Compute(intersecs[j]).Area;
          }
        }
      }
      Curve[] differC = Curve.CreateBooleanDifference(shape, boundary, 0.000001);
      if(differC.Length != 0){
        for (int i = 0; i < differC.Length; i++){
          overlapArea += AreaMassProperties.Compute(differC[i]).Area;
        }
      }
      for(int i = 0;i < build_steady.Count;i++){
        Curve[] intersecs = Curve.CreateBooleanIntersection(shape, build_steady[i], 0.000001);
        if(intersecs.Length != 0){
          for (int j = 0; j < intersecs.Length; j++){
            overlapArea += AreaMassProperties.Compute(intersecs[j]).Area;
          }
        }
      }

    }
  }


  //常用方法
  public class Common_void{
    public Common_void(){}

    public int[] Random_assignment(int total, int min, int max, int length){
      int[] result = new int[length];
      Random ra = new Random();
      // 首先要判断是否符合 min 和 max 条件
      if (min * length > total || max * length < total) {

      }
      else{
        int restValue = total;
        int restLength = length;
        for (int i = 0; i < length - 1; i++) {
          restLength--;
          // 这一次要发的数量必须保证剩下的要足最小量
          // 同进要保证剩下的不能大于需要的最大量
          int restMin = restLength * min;
          int restMax = restLength * max;
          // 可发的量
          int usable = restValue - restMin;
          // 最少要发的量
          int minValue = Math.Max(min, restValue - restMax);
          // 以 minValue 为最左，max 为中线来进行随机，即随机范围是 (max - minValue) * 2
          // 如果这个范围大于 usable - minValue，取 usable - minValue
          int limit = Math.Min(usable - minValue, (max - minValue) * 2);
          // 随机部分加上最少要发的部分就是应该发的，但是如果大于 max，最大取到 max
          result[i] = Math.Min(max, minValue + (int) Math.Floor((double) ra.Next(0, limit)));
          restValue -= result[i];
        }
        result[length - 1] = restValue;
        Array.Sort(result);
        Array.Reverse(result);
      }
      return result;
    }
    //计算所有智能体不符合要求面积总和——>逾越场地边界的面积与其他智能体缓冲区内的重叠面积
    public double CheckOverlap_bs (List < Building > bs){
      double totalOverlap = 0;
      for(int i = 0; i < bs.Count; i++){
        for(int j = 0; j < bs.Count; j++){
          if(i != j)
          {
            Curve[] intersecs = Curve.CreateBooleanIntersection(bs[i].shape, bs[j].offShape, 0.000001);
            if(intersecs.Length != 0){
              for (int k = 0; k < intersecs.Length; k++){
                totalOverlap += AreaMassProperties.Compute(intersecs[k]).Area;
              }
            }
          }
        }
        Curve[] differC = Curve.CreateBooleanDifference(bs[i].shape, bs[i].boundary, 0.000001);
        if(differC.Length != 0){
          for (int j = 0; j < differC.Length; j++){
            totalOverlap += AreaMassProperties.Compute(differC[j]).Area;
          }
        }
      }
      return totalOverlap;
    }

    //Calculate total area of curves
    public double CalculateTotalArea(List < Curve > curve)
    {
      double result = 0;
      for(int i = 0; i < curve.Count; i++)
      {
        result += AreaMassProperties.Compute(curve[i]).Area;
      }
      return result;
    }

    public List<Point3d> GetRandomPoints(int i, Curve curve)
    {
      var func_info = Rhino.NodeInCode.Components.FindComponent("PopulateGeometry");
      var func = func_info.Delegate as dynamic;
      List<Curve> curves = new List<Curve>();
      curves.Add(curve);
      var result = func(Brep.CreatePlanarBreps(curves), i, 1, null);
      List<Point3d> points = new List<Point3d>();
      foreach (var temp in result)
      {
        points.Add((Point3d) temp);
      }
      return points;
    }
    public List<Curve> RepeatCurve(int i, Curve curve)
    {
      var func_info = Rhino.NodeInCode.Components.FindComponent("RepeatData");
      var func = func_info.Delegate as dynamic;
      var result = func(curve, i);

      List<Curve> curves = new List<Curve>();
      foreach (var temp in result)
      {
        curves.Add((Curve) temp);
      }
      return curves;
    }

  }
# ---------- end 楼层随机化 ----------
vec = VectorXYZ(XComponent=0, YComponent=0, ZComponent=楼层随机化.H)  # -> Vector, Length
extr = Extrude(Base=楼层随机化.B, Direction=vec.Vector)
brep = Brep(extr)
cap = CapHoles(Brep=brep)
drawbrep = CSharpScript(B=cap, C=ColourSwatch(SwatchColor=RGB(192, 192, 192)))  # -> out; inputs B: Brep, C: Color
# ---------- drawbrep: C# usings ----------
using System.IO;
using System.Linq;
using System.Data;
using System.Drawing;
using System.Reflection;
using System.Windows.Forms;
using System.Xml;
using System.Xml.Linq;
using System.Runtime.InteropServices;

using Rhino.DocObjects;
using Rhino.Collections;
using GH_IO;
using GH_IO.Serialization;
# ---------- drawbrep: C# ----------
    if (B == null) return;
    if (C.A == 0) return;

    _breps.Add(B);
    _materials.Add(new Rhino.Display.DisplayMaterial(C));
# ---------- drawbrep: C# additional code ----------
  private readonly List<Brep> _breps = new List<Brep>();
  private readonly List<Rhino.Display.DisplayMaterial> _materials = new List<Rhino.Display.DisplayMaterial>();
  private BoundingBox _box;

  /// <summary>
  /// This method will be called once every solution, before any calls to RunScript.
  /// </summary>
  public override void BeforeRunScript()
  {
    _box = BoundingBox.Empty;
    _breps.Clear();
    _materials.Clear();
  }

  public override BoundingBox ClippingBox
  {
    get { return _box; }
  }
  public override void DrawViewportMeshes(IGH_PreviewArgs args)
  {
    for (int i = 0; i < _breps.Count; i++)
      args.Display.DrawBrepWires(_breps[i], _materials[i].Diffuse, 0);
  }
  public override void DrawViewportWires(IGH_PreviewArgs args)
  {
    for (int i = 0; i < _breps.Count; i++)
      args.Display.DrawBrepShaded(_breps[i], _materials[i]);
  }
# ---------- end drawbrep ----------

# ----
# 生成道路
建筑轮廓_2 = Curve(生成建筑.Buildings)
边界 = Curve(生成建筑.Boundary)
几何中心 = PolygonCenter(Buildings=建筑轮廓_2)  # -> CenterV, CenterE, CenterA
外接矩形 = 外接矩形(boundary=边界)
泰森多边形 = VoronoiGroups(Boundary=外接矩形, Generation1=几何中心.CenterA)
trim_with_region = TrimWithRegion(Curve=泰森多边形, Region=边界)  # -> Inside, Outside
宽度 = Slider(5, range=0..20)
c_script_3 = CSharpScript(curve=trim_with_region.Inside, thickness=宽度, color=ColourSwatch(SwatchColor=RGB(67, 46, 83)))  # -> out, A; inputs curve: list of Curve, thickness: Int32, color: Color
# ---------- c_script_3: C# usings ----------
using System.Drawing;
# ---------- c_script_3: C# ----------
    if (curve == null) return;
    if (color.A == 0) return;
    for (int i = 0; i < curve.Count; i++)
    {
      _curves.Add(curve[i]);
    }
    _color = color;
    _thickness = thickness;
# ---------- c_script_3: C# additional code ----------
  private BoundingBox _box;
  private readonly List<Curve> _curves = new List<Curve>();
  private readonly List<Rhino.Display.DisplayMaterial> _materials = new List<Rhino.Display.DisplayMaterial>();
  public Color _color;
  public int _thickness;
  //private BoundingBox _box;

  /// <summary>
  /// This method will be called once every solution, before any calls to RunScript.
  /// </summary>
  public override void BeforeRunScript()
  {
    _box = BoundingBox.Empty;
    _curves.Clear();
  }

  public override BoundingBox ClippingBox
  {
    get { return _box; }
  }

  public override void DrawViewportWires(IGH_PreviewArgs args)
  {
    for (int i = 0; i < _curves.Count; i++)
    {
      args.Display.DrawCurve(_curves[i], _color, _thickness);
    }
  }
# ---------- end c_script_3 ----------

# ----
# 曲线渲染
toggle = BooleanToggle(True)  # disabled
宽度_2 = Slider(3, range=0..20)
crv = Curve()
c_script_4 = CSharpScript(curve=crv, thickness=宽度_2, ifSolidLine=toggle, color=ColourSwatch(SwatchColor=RGB(67, 46, 83)))  # -> out, A; inputs curve: list of Curve, thickness: Int32, ifSolidLine: Boolean, color: Color; same code as c_script_3

# ----
# 数据导出
panel_4 = Panel("samplea.3dm")
path = FilePath("C:\Users\panker98\Desktop\八北车辆段\")
c_script_5 = CSharpScript(filename=panel_4, directory=path, export=Toggle(False))  # inputs geometries: tree of GeometryBase, filename: String, directory: String, export: Boolean
# ---------- c_script_5: C# usings ----------
using System.IO;
# ---------- c_script_5: C# ----------
    if(export){

      var guids = new List<Guid>();

      for(int i = 0; i < geometries.BranchCount; i++){
        for(int n = 0; n < geometries.Branches[i].Count; n++){
          var geom = geometries.Branches[i][n];
          var guid = Rhino.RhinoDoc.ActiveDoc.Objects.Add(geom);
          guids.Add(guid);
        }
      }

      Rhino.RhinoDoc.ActiveDoc.Objects.Select(guids);

      string filepath = Path.Combine(directory, filename);
      string cmd = "_-Export " + "\"" + filepath + "\"" + " _Enter _Enter";

      Rhino.RhinoApp.RunScript(cmd, false);

      Rhino.RhinoDoc.ActiveDoc.Objects.Delete(guids, true);
    }
# ---------- end c_script_5 ----------

# ----
# 生成绿化
建筑轮廓_3 = Curve(生成建筑.Buildings)
边界_2 = Curve(生成建筑.Boundary)
宽度_3 = Slider(2, range=0..20)

绿化 = 绿化(用地边线=边界_2, 建筑轮廓=建筑轮廓_3)

联合 = 联合(curvesa=绿化, curves_b=建筑轮廓_3)
c_script_6 = CSharpScript(curve=联合, thickness=宽度_3, color=ColourSwatch(SwatchColor=RGB(39, 139, 84)))  # -> out, A; inputs curve: list of Curve, thickness: Int32, color: Color; same code as c_script_3

# ==== cluster 联合
curvesa = ClusterInput()
c_script = CSharpScript(CurvesA=curvesa)  # -> out, A; inputs CurvesA: list of Curve
# ---------- c_script: C# ----------
    List<Curve> result = new List<Curve>();

    for(int i = 0;i < CurvesA.Count;i++){
      if(CurvesA[i].PointAt(0).Z == 0){
        result.Add(CurvesA[i]);
      }
    }
    A = result;
# ---------- end c_script ----------
curves_b = ClusterInput()
region_difference = RegionDifference(CurvesA=c_script.A, CurvesB=curves_b)
control_points = ControlPoints(Curve=region_difference)  # -> Points, Weights, Knots
polyline = PolyLine(Vertices=control_points.Points, Closed=True)
c_script_2 = CSharpScript(x=polyline)  # -> out, A; inputs x: list of Curve
# ---------- c_script_2: C# ----------
    A = Curve.CreateBooleanUnion(x);
# ---------- end c_script_2 ----------
A = ClusterOutput(c_script_2.A)

# ==== cluster 外接矩形
boundary = ClusterInput()
control_points = ControlPoints(Boundary=boundary)  # -> Points, Weights, Knots
deconstruct = Deconstruct(Point=control_points.Points)  # -> XComponent, YComponent, ZComponent
bounds = Bounds(Numbers=deconstruct.XComponent)
bounds_2 = Bounds(Numbers=deconstruct.YComponent)
deconstruct_domain = DeconstructDomain(Domain=bounds_2)  # -> Start, End
deconstruct_domain_2 = DeconstructDomain(Domain=bounds)  # -> Start, End
construct_point = ConstructPoint(XCoordinate=deconstruct_domain_2.End, YCoordinate=deconstruct_domain.Start, ZCoordinate="0")
construct_point_2 = ConstructPoint(XCoordinate=deconstruct_domain_2.Start, YCoordinate=deconstruct_domain.Start, ZCoordinate="0")
construct_point_3 = ConstructPoint(XCoordinate=deconstruct_domain_2.Start, YCoordinate=deconstruct_domain.End, ZCoordinate="0")
construct_point_4 = ConstructPoint(XCoordinate=deconstruct_domain_2.End, YCoordinate=deconstruct_domain.End, ZCoordinate="0")
point = Point([construct_point_4, construct_point, construct_point_2, construct_point_3])
polyline = PolyLine(Vertices=point, Closed=True)
polyline_2 = ClusterOutput(polyline)

# ==== cluster 绿化
建筑轮廓 = ClusterInput()
用地边线 = ClusterInput()
用地边线_2 = Curve(用地边线)
建筑轮廓_2 = Curve(建筑轮廓)
bbp = BoundboxPlus(C=建筑轮廓_2, B=0)
offset = OffsetCurve(Curve=bbp, Distance=Slider(30, range=0..100), Plane=PlaneXY(0, 0, 0), Corners=1)
number_slider = Slider(10, range=0..10)

# ---- group: 平面布尔切 pro
cluster = Cluster(E_2=用地边线_2, E=offset)

# ----
explode = Explode(Curve=bbp, Recursive=True)  # -> Segments, Vertices
dom = ConstructDomain(DomainStart=expr("-x", number_slider), DomainEnd=number_slider)
dom_2 = ConstructDomain(DomainStart=expr("-x", number_slider), DomainEnd=number_slider)
cull_i = CullIndex(List=explode.Vertices, Indices=0, Wrap=True)
rectangle = Rectangle(Plane=cull_i, XSize=dom_2, YSize=dom, Radius=0)  # -> Rectangle, Length
runion = RegionUnion(Curves=flatten(rectangle.Rectangle))
panel = Panel("500")  # "单位：m2"
rint = RegionIntersection(CurvesA=用地边线_2, CurvesB=graft(runion))
wires = BrepWireframe(Brep=rint, Density=-1)
面积判断 = 面积判断(crv=cluster, B=panel)  # -> A, B_2
join = JoinCurves(Curves=wires, Preserve=False)
fp2d = FlipcurvePLus2D_2(C=面积判断.A)
panel_2 = Panel("3")
offset_l = OffsetCurveLoose(Curve=join, Distance=expr("-x", panel_2))
offset_l_2 = OffsetCurveLoose(Curve=fp2d, Distance=panel_2)
sp = SimplifyPlus(T=offset_l)
rint_2 = RegionIntersection(CurvesA=用地边线_2, CurvesB=graft(offset_l_2))
绿化区域 = Curve(flatten([fp2d, sp]))
boundary = BoundarySurfaces(Edges=[fp2d, sp])
c_script = CSharpScript(G=绿化区域, A="Layer=绿地轮廓")  # -> O; inputs G: GeometryBase, A: list of String
# ---------- c_script: C# ----------
    if(G != null)
    {
      foreach(string attr in A)
      {
        if (attr == null) continue;
        string str = attr.Trim();
        if (!str.Contains("=")) continue;
        string[] arr = str.Split('=');
        if (arr.Length != 2) continue;

        string k = arr[0];
        string v = arr[1];

        G.SetUserString(k, v);
      }

      O = G;
    }
# ---------- end c_script ----------
O = ClusterOutput(c_script)

# ==== cluster BoundboxPlus: Boundbox的升级版，自动跟随异形的倾斜而生成非xy方向的倾斜box； Input： C-输入要套box的线框； G-开关：是否启动长边校正 Output： C-输出一个包含输入曲线的较小矩形； //目标是这个输出的矩形尽量小，这样可用于评判很多异形线框的形态； //V2.2 skywoolf 190617 //v2.3 skywoolf 190701
# 作者：Skywoolf
# NCF参数化建筑联盟：bbs.ncf-china.com
# NCFZ数字设计平台：ncf.cz-studio.com
# 相关书籍：《Grasshopper参数化设计教程》--“数字冥想”
# 共同维护知识产权平台，请勿删除。感谢您对国人设计技术原创的支持！
C = ClusterInput()  # 需要计算矩形轮廓的曲线
# 祁鹏远 -- NCF站长；C+Z合伙人建筑师
crv = Curve(graft(C))
explode = Explode(Curve=crv, Recursive=True)  # -> Segments, Vertices
# 开发日志：
# 190620：测试版封装
# //将曲线简化为矩形线框可以用来简化大部分的算法开发工作，此算法有待进化
# 
# //单个数据成功运算结果：正常
# //树形数据测试结果：正常
# 
# 190701：多个数据录入失败，输入端graft之后回复正常
explode_2 = Explode(Curve=crv, Recursive=True)  # -> Segments, Vertices
area = Area(Geometry=crv)  # -> Area, Centroid
xy = XYPlane(Origin=area.Centroid)
hull = ConvexHull(Points=explode.Vertices, Plane=xy)  # -> Hull, HullZ, Indices
ll = LongestLine(C=explode_2.Segments)  # -> cl, cs
crv_cp = CurveClosestPoint(Point=area.Centroid, Curve=hull.Hull)  # -> Point, Parameter, Distance
end = EndPoints(Curve=ll.cl)  # -> Start, End
xy_2 = XYPlane(Origin=Point(0, 0, 0))
vec2pt = Vector2Pt(PointA=area.Centroid, PointB=crv_cp.Point, Unitize=False)  # -> Vector, Length
vec2pt_2 = Vector2Pt(PointA=end.Start, PointB=end.End, Unitize=False)  # -> simplify(Vector), Length
align = AlignPlane(Plane=xy_2, Direction=vec2pt_2.Vector)  # -> Plane, Angle
rotate = Rotate(Geometry=vec2pt.Vector, Angle=1.570796327, Plane=PlaneXY(0, 0, 0))  # -> Geometry, Transform

# ---- group: 保证两条流输出点秩一致？
rotate_2 = Rotate(Geometry=align.Plane, Angle=1.570796327, Plane=align.Plane)  # -> Geometry, Transform

# ----
pl = ConstructPlane(Origin=Point(0, 0, 0), XAxis=vec2pt.Vector, YAxis=rotate.Geometry)
bbox = BoundingBox(Content=crv, Plane=pl)  # -> Box, Box_2
bbox_2 = BoundingBox(Content=crv, Plane=rotate_2.Geometry)  # -> Box, Box_2
debrep = DeconstructBrep(Brep=bbox.Box)  # -> Faces, Edges, Vertices
debrep_2 = DeconstructBrep(Brep=bbox_2.Box)  # -> Faces, Edges, Vertices
B = ClusterInput()  # 是否启动最长边矫正算法
pline = PolyLine(Vertices=debrep.Vertices, Closed=True)
pline_2 = PolyLine(Vertices=debrep_2.Vertices, Closed=True)
filter = StreamFilter(Gate=B, Stream0=pline, Stream1=pline_2)
fp2d = FlipcurvePLus2D(C=filter)
crv_2 = Curve(fp2d)
R = ClusterOutput(crv_2)  # 依据心态生成旋转的矩形线框

# ==== cluster 面积判断
crv = ClusterInput()
panel = Panel("根据面积筛选用地")
crv_2 = Curve(crv)
area = Area(Geometry=crv_2)  # -> Area, Centroid
B = ClusterInput()
larger = LargerThan(FirstNumber=area.Area, SecondNumber=B)  # -> LargerThan, OrEqualTo
dispatch = Dispatch(List=crv_2, DispatchPattern=larger.LargerThan)  # -> simplify(ListA), simplify(ListB)
A = ClusterOutput(dispatch.ListA)
B_2 = ClusterOutput(dispatch.ListB)

# ==== cluster FlipcurvePLus2D_2: 统一曲线的方向为逆时针旋转；用于部分运算器输出曲线方向不一致的问题； Input： C-原始曲线； Output： C-方向统一后的曲线； //直线目前不适合该电池； //本版适合于平面曲线； //V2.1 skywoolf 190617
# 作者：Skywoolf
# NCF参数化建筑联盟：bbs.ncf-china.com
# NCFZ数字设计平台：ncf.cz-studio.com
# 相关书籍：《Grasshopper参数化设计教程》--“数字冥想”
# 共同维护知识产权平台，请勿删除。感谢您对国人设计技术原创的支持！
C = ClusterInput()  # 需要统一方向的曲线
crv = Curve(C)
# 祁鹏远 -- NCF站长；C+Z合伙人建筑师
explode = Explode(Curve=crv, Recursive=True)  # -> Segments, Vertices
P = ClusterInput()  # 参考哪个平面进行运算
# 开发日志：
# 190620：测试版封装
# //统一平面曲线的方向，在考虑保留这个运算器的必要性；
# //此运算器对line无效；
# 
# //单个数据成功运算结果：正常
# //Longlist法则测试结果：正常
# //树形数据测试结果：正常
xy = XYPlane(Origin=Point(0, 0, 0))
cull_i = CullIndex(List=explode.Vertices, Indices=0, Wrap=True)
dd = DefaultData(I=P, D=xy)
avr = Average(Input=cull_i)
pl_origin = PlaneOrigin(Base=dd, Origin=avr)
cir = Circle(Plane=pl_origin, Radius=1)
flip = FlipCurve(Curve=graft(crv), Guide=cir)  # -> simplify(Curve), Flag
crv_2 = Curve(flip.Curve)
# 不适合于单条线段
# 仅限于平面线条
# 没有graft多条线会报错
C_2 = ClusterOutput(crv_2)  # 统一方向后的曲面

# ==== cluster Cluster
E = ClusterInput()
E_2 = ClusterInput()
boundary = BoundarySurfaces(Edges=flatten(E))
boundary_2 = BoundarySurfaces(Edges=E_2)
Z = UnitZ(Factor=-1)
move = Move(Geometry=boundary, Motion=Z)  # -> Geometry, Transform
Z_2 = UnitZ(Factor=2)
extr = Extrude(Base=move.Geometry, Direction=Z_2)
trim = TrimSolid(Shape=boundary_2, Cutters=extr)
R = ClusterOutput(trim)

# ==== cluster SimplifyPlus: Simplify的升级版，原生电池中Simplify遇到单组数据不会优化数据级，这使得它在于pathmapper搭配的时候经常会出现数据无法联动的困扰。Slimplify Plus在原有基础上增加了新的规则，当多级路径名的单组数据输入给它的时候，它会将数据拍平至最简； //V1.2 skywoolf 190617
# 作者：Skywoolf
# NCF参数化建筑联盟：bbs.ncf-china.com
# NCFZ数字设计平台：ncf.cz-studio.com
# 相关书籍：《Grasshopper参数化设计教程》--“数字冥想”
# 共同维护知识产权平台，请勿删除。感谢您对国人设计技术原创的支持！
# 开发日志：
# 190620：测试版封装
# //为了让Cluster打包后输入端能够兼容单个数据和树形数据，这里对Simplify做的改造，原版Simplify不能自动把单组数据简化；
# //这里增加了对单组数据直接拍平的设置，为了在复杂的运算器过程中，路径名变化能够实现联动控制，不会因为树形转线性后路径名不变而产生bug；
# 
# //单个数据成功运算结果：正常
# //树形数据测试结果：正常
T = ClusterInput()  # 需要简化路径名的数据
data = Data(T)
# 祁鹏远 -- NCF站长；C+Z合伙人建筑师
tstat = TreeStatistics(Tree=data)  # -> Paths, Length, Count
equals = Equality(FirstNumber=tstat.Count, SecondNumber=1)  # -> Equality, Inequality
dispatch = Dispatch(List=data, DispatchPattern=equals.Equality)  # -> ListA, ListB
simplify = SimplifyTree(Tree=dispatch.ListB, Front=False)
flatten = FlattenTree(Tree=dispatch.ListA, Path="{0}")
filter = StreamFilter(Gate=equals.Equality, Stream0=simplify, Stream1=flatten)
data_2 = Data(filter)
T_2 = ClusterOutput(data_2)  # 简化路径名后的数据

# ==== cluster LongestLine: 输入一组曲线，判断最长线和最短线； Input： C-输入的曲线； Output Cl-最长的线 Cs-最短的线 //V2.0 skywoolf 190617
# 作者：Skywoolf
# NCF参数化建筑联盟：bbs.ncf-china.com
# NCFZ数字设计平台：ncf.cz-studio.com
# 相关书籍：《Grasshopper参数化设计教程》--“数字冥想”
# 共同维护知识产权平台，请勿删除。感谢您对国人设计技术原创的支持！
# 开发日志：
# 190620：测试版封装
# //除了求最长最短边以外，这个算法对矩形长短边的提取进行了优化，在同时出现多个长边的适合，自动选取靠近矩形闭合点位置的线条；
# 
# //单个数据成功运算结果：正常
# //树形数据测试结果：正常
C = ClusterInput()  # 一组多个曲线的数据
crv = Curve(C)
len = Length(Curve=crv)
bnd = Bounds(Numbers=len)
dedomain = DeconstructDomain(Domain=bnd)  # -> Start, End
similar = Similarity(FirstNumber=len, SecondNumber=dedomain.Start, Threshold=0.1)  # -> Similarity, AbsoluteDifference
similar_2 = Similarity(FirstNumber=len, SecondNumber=dedomain.End, Threshold=0.1)  # -> Similarity, AbsoluteDifference
cull = CullPattern(List=crv, CullPattern=similar_2.Similarity)

# ---- group: 等长多条线时，选择靠近此点的
# 祁鹏远 -- NCF站长；C+Z合伙人建筑师
curvepoint = PointOnCurve(crv, parameter=0.5)
item = ListItem(List=curvepoint, Index=0, Wrap=True)  # -> Item, Item1
avr = Average(Input=[item.Item, item.Item1])
crv_cp = CurveClosestPoint(Point=avr, Curve=cull)  # -> Point, Parameter, Distance

# ----
cull_2 = CullPattern(List=crv, CullPattern=similar.Similarity)
crv_cp_2 = CurveClosestPoint(Point=avr, Curve=cull_2)  # -> Point, Parameter, Distance
bnd_2 = Bounds(Numbers=crv_cp_2.Distance)
bnd_3 = Bounds(Numbers=crv_cp.Distance)
dedomain_2 = DeconstructDomain(Domain=bnd_2)  # -> Start, End
dedomain_3 = DeconstructDomain(Domain=bnd_3)  # -> Start, End
equals = Equality(FirstNumber=crv_cp_2.Distance, SecondNumber=dedomain_2.Start)  # -> Equality, Inequality
equals_2 = Equality(FirstNumber=crv_cp.Distance, SecondNumber=dedomain_3.Start)  # -> Equality, Inequality
cull_3 = CullPattern(List=cull, CullPattern=equals_2.Equality)
cull_4 = CullPattern(List=cull_2, CullPattern=equals.Equality)
crv_2 = Curve(cull_3)
crv_3 = Curve(cull_4)
cl = ClusterOutput(crv_2)  # 最长的一条曲线
cs = ClusterOutput(crv_3)  # 最短的一条曲线

# ==== cluster FlipcurvePLus2D: 统一曲线的方向为逆时针旋转；用于部分运算器输出曲线方向不一致的问题； Input： C-原始曲线； Output： C-方向统一后的曲线； //直线目前不适合该电池； //本版适合于平面曲线； //V2.1 skywoolf 190617
# 作者：Skywoolf
# NCF参数化建筑联盟：bbs.ncf-china.com
# NCFZ数字设计平台：ncf.cz-studio.com
# 相关书籍：《Grasshopper参数化设计教程》--“数字冥想”
# 共同维护知识产权平台，请勿删除。感谢您对国人设计技术原创的支持！
C = ClusterInput()  # 需要统一方向的曲线
crv = Curve(C)
# 祁鹏远 -- NCF站长；C+Z合伙人建筑师
explode = Explode(Curve=crv, Recursive=True)  # -> Segments, Vertices
P = ClusterInput()  # 参考哪个平面进行运算
# 开发日志：
# 190620：测试版封装
# //统一平面曲线的方向，在考虑保留这个运算器的必要性；
# //此运算器对line无效；
# 
# //单个数据成功运算结果：正常
# //Longlist法则测试结果：正常
# //树形数据测试结果：正常
xy = XYPlane(Origin=Point(0, 0, 0))
cull_i = CullIndex(List=explode.Vertices, Indices=0, Wrap=True)
dd = DefaultData(I=P, D=xy)
avr = Average(Input=cull_i)
pl_origin = PlaneOrigin(Base=dd, Origin=avr)
cir = Circle(Plane=pl_origin, Radius=1)
flip = FlipCurve(Curve=graft(crv), Guide=cir)  # -> simplify(Curve), Flag
# 不适合于单条线段
# 仅限于平面线条
# 没有graft多条线会报错
C_2 = ClusterOutput(flip.Curve)  # 统一方向后的曲面

# ==== cluster DefaultData: 为Cluster输入端设置默认参数 input: I-输入数据； D-默认数据； V1.0 skywoolf 190620
# 作者：Skywoolf
# NCF参数化建筑联盟：bbs.ncf-china.com
# NCFZ数字设计平台：ncf.cz-studio.com
# 相关书籍：《Grasshopper参数化设计教程》--“数字冥想”
# 共同维护知识产权平台，请勿删除。感谢您对国人设计技术原创的支持！
I = ClusterInput()  # 输入数据
# 开发日志：
# 190620：测试版封装
# //专门为Cluster设置默认数据使用；
# 
# //单个数据成功运算结果：正常
# //Longlist法则测试结果：正常
# //树形数据测试结果：正常
D = ClusterInput()  # 默认数据
data = Data(D)
data_2 = Data(I)
# 祁鹏远 -- NCF站长；C+Z合伙人建筑师
null = NullItem(Item=data_2)  # -> NullFlags, InvalidFlags, Description
item = ListItem(List=null.NullFlags, Index=0, Wrap=True)
filter = StreamFilter(Gate=item, Stream0=data_2, Stream1=data)
O = Data(filter)
O_2 = ClusterOutput(O)  # 输出数据
